# Grasshopper definition Combined.gh (Grasshopper 0.9.76)
# plug-ins: Python Interpreter, Badger

year = Slider(2015, range=2015..2115)
get_rel_path = VBScript()  # -> File, Folder
# ---------- get_rel_path: C# ----------
    File = "<unset>"
    Folder = "<unset>"

    If (String.IsNullOrEmpty(GrasshopperDocument.FilePath)) Then Return
    
    Try
      File = GrasshopperDocument.FilePath
      Folder = IO.Path.GetDirectoryName(GrasshopperDocument.FilePath) & IO.Path.DirectorySeparatorChar
    Catch
    End Try
# ---------- end get_rel_path ----------
panel = Panel("Flows")
panel_2 = Panel("Plants")
panel_3 = Panel("Floods")
panel_4 = Panel("Fields")
panel_5 = Panel("Terrain")
definition_path = Text(get_rel_path.Folder)
time = Number(year)
set_hidden = BooleanToggle(False)
wire_changer = WireDisplayChanger(WireDisplay=set_hidden)  # -> out, a
# ---------- wire_changer: Python ----------
"""
Courtesy Steph Maher - https://gist.github.com/StepMaher/18b7d18d137ddf32f1aa
"""
"""
Allows for dynamically changing the Grasshopper document's Faint and Hidden wire display types. This will not affect wires set to Default.
    Inputs: WireDisplay: Plug in a boolean value here. True = "Faint" wires, False = "Hidden" wires.
"""

# Name component
ghenv.Component.Name = "Wire Display Changer"
ghenv.Component.NickName = 'Wire Changer'

# Import libraries and methods
from Grasshopper.Kernel import GH_ParamWireDisplay as GH_PWD

for obj  in ghenv.Component.OnPingDocument().Objects: # Ping all objects on the canvas
    if not hasattr(obj, 'Params'): continue
    if WireDisplay: # Toggle script
        for param in obj.Params.Input:
            if param.WireDisplay == GH_PWD.default: continue # Skip components with Default wires
            else: param.WireDisplay = GH_PWD.faint # Change to Faint
    else:
        for param in obj.Params.Input:
            if param.WireDisplay == GH_PWD.default: continue # Skip components with Default wires
            else: param.WireDisplay = GH_PWD.hidden # Change to Hidden
# ---------- end wire_changer ----------

# ---- group: Import CSV relative to current path
concatenate = Concatenate(FragmentA=definition_path, FragmentB="Combined.csv")
read_file = ReadFile(File=concatenate, PerLineParse=True)

# ----
mesh_reduce_tolerance_for_performance = Slider(0.5, range=0..1)
concatenate_2 = Concatenate(FragmentA=definition_path, FragmentB="Combined.csv")
concatenate_3 = Concatenate(FragmentA=definition_path, FragmentB="Combined.csv")
createplanes_can_be_slow = BooleanToggle(False)
pipeline = GeometryPipeline(
    GroupByLayer=False,
    GroupByType=False,
    IncludeHidden=True,
    IncludeLocked=True,
    LayerFilter="Contours",
    NameFilter="*",
    TypeFilter=4)
panel_6 = Panel("TERRAIN")
read_file_2 = ReadFile(File=concatenate_3, PerLineParse=True)
read_file_3 = ReadFile(File=concatenate_2, PerLineParse=True)
bounds = Curve(<curve referenced from the Rhino model>)
concatenate_4 = Concatenate(FragmentA=definition_path, FragmentB="Combined.csv")
concatenate_5 = Concatenate(FragmentA=definition_path, FragmentB="Combined.csv")
concatenate_6 = Concatenate(FragmentA=definition_path, FragmentB="Combined.csv")
concatenate_7 = Concatenate(FragmentA=definition_path, FragmentB="Combined.csv")

panel_7 = Panel("CSV & Generic Importer")
species_attribute_importer = SpeciesAttributeImporter(CSVFile=read_file)
generic_species_attributes = GenericSpeciesAttributes()  # -> ShrubP, GrassP, TreeP

panel_8 = Panel("Planting Locations/Time")
curve = Curve(<curve referenced from the Rhino model>)
years = Slider(30, range=0..100)
boundary_surfaces = BoundarySurfaces(Edges=curve)
manual_points = Point([<point referenced from the Rhino model> x12])

geometry_pipeline = GeometryPipeline(
    GroupByLayer=False,
    GroupByType=False,
    IncludeHidden=True,
    IncludeLocked=True,
    LayerFilter="Sediment Retention",
    NameFilter="*",
    TypeFilter=4)
geometry_pipeline_2 = GeometryPipeline(
    GroupByLayer=False,
    GroupByType=False,
    IncludeHidden=True,
    IncludeLocked=True,
    LayerFilter="Visual Area",
    NameFilter="*",
    TypeFilter=4)
geometry_pipeline_3 = GeometryPipeline(
    GroupByLayer=False,
    GroupByType=False,
    IncludeHidden=True,
    IncludeLocked=True,
    LayerFilter="Field Inflow",
    NameFilter="*",
    TypeFilter=4)
geometry_pipeline_4 = GeometryPipeline(
    GroupByLayer=False,
    GroupByType=False,
    IncludeHidden=True,
    IncludeLocked=True,
    LayerFilter="Stream Shading",
    NameFilter="*",
    TypeFilter=4)
read_file_4 = ReadFile(File=concatenate_4, PerLineParse=True)
read_file_5 = ReadFile(File=concatenate_5, PerLineParse=True)
read_file_6 = ReadFile(File=concatenate_6, PerLineParse=True)
read_file_7 = ReadFile(File=concatenate_7, PerLineParse=True)
offset_on_srf = OffsetOnSrf(Curve=geometry_pipeline_4, Distance=1)
read_file_8 = ReadFile(File="C:\Users\s3321811\Dropbox\PhD Work\0 Code\field-tests\Cartography\Field Visualisers\Fields.py", PerLineParse=False)  # -> Content; disabled
#   port File: Uri of file to read
# ---------- read_file_8: VB line parser ----------
    action = GH_LineParserAction.Include
    Return line

    'Parse the line and return some data that represents the line.
    'If the line cannot be parsed, you can return Nothing and
    'assign a different action.
    'The default implementation is to just return the line itself.
    'If you return types that implement IGH_Goo, this component
    'will work substantially faster.
# ---------- end read_file_8 ----------
grid_divisions = Integer(Slider(10, range=0..10))
grid_rectangle = Curve(<curve referenced from the Rhino model>)
number = Number()
regions = Curve([<curve referenced from the Rhino model> x4])
debug = Boolean(True)
plant_placement_solver = PlantPlacementSolver(Plants=species_attribute_importer, Area=boundary_surfaces)  # -> Plants, Locations
plant_placement_solver_2 = PlantPlacementSolver(Plants=generic_species_attributes.ShrubP, Area=boundary_surfaces)  # -> Plants, Locations
c_script = CSharpScript(Bounds=grid_rectangle, Divisions=grid_divisions, Regions=regions)  # -> Out, Field
plant_appearance_simulator = PlantAppearanceSimulator(Plants=species_attribute_importer, Locations=manual_points, Times=years)  # -> Trunk, Root, Crown, Spacing, Color, Label
plant_placement_solver_3 = PlantPlacementSolver(Plants=read_file_7, Area=geometry_pipeline_4)  # -> Plants, Locations
plant_placement_solver_4 = PlantPlacementSolver(Plants=read_file_5, Area=geometry_pipeline)  # -> Plants, Locations
plant_placement_solver_5 = PlantPlacementSolver(Plants=read_file_6, Area=geometry_pipeline_3)  # -> Plants, Locations
plant_placement_solver_6 = PlantPlacementSolver(Plants=read_file_4, Area=geometry_pipeline_2)  # -> Plants, Locations
circle = Circle(plant_appearance_simulator.Trunk)
circle_2 = Circle(plant_appearance_simulator.Crown)
circle_3 = Circle(plant_appearance_simulator.Root)
circle_4 = Circle(plant_appearance_simulator.Spacing)
swatch = ColourSwatch(SwatchColor=RGB(255, 255, 255))
text_tag_3d = TextTag3D(Location=manual_points, Size=Slider(141, range=0..1000), Justification=7)

colour_picker = ColourPicker(PickedColour=RGBA(255, 0, 255, 106))
colour_picker_2 = ColourPicker(PickedColour=RGBA(0, 255, 255, 105))
colour_picker_3 = ColourPicker(PickedColour=RGBA(0, 119, 255, 107))
panel_9 = Panel("Colours")
colour_picker_4 = ColourPicker(PickedColour=RGBA(67, 117, 255, 105))

mean_high_water_springs = Slider(1000, range=0..5000)
mean_low_water_springs = Slider(430, range=0..5000)
mean_high_water_neaps = Slider(1450, range=0..5000)
mean_low_water_neaps = Slider(700, range=0..5000)
mean_sea_level = Slider(0, range=0..5000)
panel_10 = Panel("High Tide Data")

terrain = Brep(<brep referenced from the Rhino model>)
coast = Curve(<curve referenced from the Rhino model>)
panel_11 = Panel("Testing Area")
terrain_2 = Brep(terrain)
frontline = Curve(coast)

sea_level_rise_year = Slider(1.6, range=0..5)
storm_surge_height = Slider(500, range=0..5000)
panel_12 = Panel("Site Data")
sea_datum_z = Slider(0, range=-3000..3000)

frontline_2 = Curve(frontline)
terrain_3 = Brep(terrain_2)

# ---- group: Constructing from Contours
contour_fix = ContourFix(ContourCurves=pipeline)  # -> AllContours, FixedContours
contour_clip = ContourClip(ContourCurves=contour_fix.AllContours, Boundary=bounds, CreatePlanarSrfs=createplanes_can_be_slow)  # -> Contours, EdgedContours, PlanarSurfaces
# TODO: REMOVE Duplicatae points at the boundary edge (get ones with the same x and y and then get the highest)
brepstodrape = Brep(contour_clip.PlanarSurfaces)
surfaceterrain = Brep(<brep referenced from the Rhino model>)

# ----
redpline = Reduce(Polyline=contour_clip.EdgedContours, Tolerance=mesh_reduce_tolerance_for_performance)  # -> Polyline, Reduction
surfaceterrain_2 = Brep(surfaceterrain)

panel_13 = Panel("Testing Surface/Mesh")
fidelity_of_flow_steps = Slider(1, range=0..100)
surface = Surface(surfaceterrain_2)

panel_14 = Panel("Starting Points")
divide_surface = DivideSurface(Surface=surface, UCount=Slider(60, range=0..100), VCount=Slider(40, range=0..100))  # -> flatten(Points), Normals, Parameters

flows = FlowSimulation(Surface=surface, Points=divide_surface.Points, Fidelity=fidelity_of_flow_steps, Jump=100)  # -> FlowPaths, FlowCatchments, FlowEndPoints
custom_preview = CustomPreview(Geometry=flows.FlowPaths, Shader=ColourSwatch(SwatchColor=RGB(0, 195, 255)))
custom_preview_2 = CustomPreview(Geometry=flows.FlowEndPoints, Shader=ColourSwatch(SwatchColor=RGB(0, 152, 199)))

# ---- group: Constructing from Contours (continued)
cp = ControlPoints(Curve=redpline.Polyline)  # -> flatten(Points), Weights, Knots

# ----
remove_overlapping = RemoveOverlapping(pt=cp.Points)

# ---- group: Constructing from Contours (continued)
del = DelaunayMesh(Points=remove_overlapping, Plane=PlaneXY(0, 0, 0))
meshterrain = Mesh(del)

# ----
meshterrain_2 = Mesh(meshterrain)
mesh = MeshSlope(Mesh=meshterrain_2)  # -> M, FaceCenters, FaceSlopeVectors, FaceSlopeAngles
gradient = Gradient(
    LowerLimit=0,
    UpperLimit=90,
    Parameter=mesh.FaceSlopeAngles,
    stops=[0: RGB(0, 128, 0), 0.404: RGB(255, 255, 0), 0.799: RGB(255, 0, 0), 1: RGB(0, 0, 0)])
mesh_2 = Mesh(simplify(graft(mesh.M)))
int = Integer(mesh.FaceSlopeAngles)
mcol = MeshColours(Mesh=mesh_2, Colours=simplify(graft(gradient)))
medges = MeshEdges(Mesh=mesh_2)  # -> NakedEdges, InteriorEdges, NonManifoldEdges
vdisex = VectorDisplayEx(Point=mesh.FaceCenters, Vector=mesh.FaceSlopeVectors, Colour=swatch, Width=1)
tag = TextTag3D(Location=mesh.FaceCenters, Text=int, Size=Slider(0.5, range=0..1), Colour=swatch, Justification=5)

number_2 = Number(sea_datum_z)
number_3 = Number(time)
number_4 = Number(sea_level_rise_year)
number_5 = Number(mean_high_water_springs)
number_6 = Number(mean_low_water_springs)
number_7 = Number(mean_sea_level)
number_8 = Number(mean_high_water_neaps)
number_9 = Number(mean_low_water_neaps)
number_10 = Number(storm_surge_height)

flood_simulator = FloodSimulator(
    Datum=number_2,
    Year=number_3,
    Rise=number_4,
    Surge=number_10,
    HighNeap=number_8,
    LowNeap=number_9,
    HighSpring=number_5,
    LowSpring=number_6)  # -> SeaLevel, StormSurgeLevel, HighNeap, LowNeap, HighSpring, LowSpring

mean_high_water_neap = Geometry(flood_simulator.HighNeap)
mean_high_water_spring = Geometry(flood_simulator.HighSpring)
mean_low_water_spring = Geometry(flood_simulator.LowSpring)
mean_low_water_neap = Geometry(flood_simulator.LowNeap)
mean_sea_level_2 = Geometry(flood_simulator.SeaLevel)
storm_surge_level = Geometry(flood_simulator.StormSurgeLevel)

storm_surge_level_2 = Geometry(storm_surge_level)
mean_high_water_spring_2 = Geometry(mean_high_water_spring)
mean_high_water_neap_2 = Geometry(mean_high_water_neap)
mean_low_water_neap_2 = Geometry(mean_low_water_neap)
mean_low_water_spring_2 = Geometry(mean_low_water_spring)
mean_sea_level_3 = Geometry(mean_sea_level_2)
cluster = Cluster(level=mean_sea_level_3, frontline=frontline_2, terrain=terrain_3)  # -> curve_3, list
cluster_2 = Cluster(level=mean_low_water_neap_2, frontline=frontline_2, terrain=terrain_3)  # -> curve_3, list
cluster_3 = Cluster(level=storm_surge_level_2, frontline=frontline_2, terrain=terrain_3)  # -> curve_3, list
cluster_4 = Cluster(level=mean_high_water_neap_2, frontline=frontline_2, terrain=terrain_3)  # -> curve_3, list
cluster_5 = Cluster(level=mean_low_water_spring_2, frontline=frontline_2, terrain=terrain_3)  # -> curve_3, list
cluster_6 = Cluster(level=mean_high_water_spring_2, frontline=frontline_2, terrain=terrain_3)  # -> curve_3, list
mean_sea_level_srf = CustomPreview(Geometry=cluster.list, Shader=colour_picker_3)
mean_sea_level_srf_2 = CustomPreview(Geometry=cluster_2.list, Shader=colour_picker_3)
mean_sea_level_srf_3 = CustomPreview(Geometry=cluster_4.list, Shader=colour_picker_3)
mean_sea_level_srf_4 = CustomPreview(Geometry=cluster_5.list, Shader=colour_picker_3)
mean_sea_level_srf_5 = CustomPreview(Geometry=cluster_6.list, Shader=colour_picker_3)
mean_sea_level_srf_6 = CustomPreview(Geometry=cluster_3.list, Shader=colour_picker_3)
mean_sea_level_crv = CustomPreview(Geometry=cluster.curve_3, Shader=colour_picker_3)
mean_sea_level_crv_2 = CustomPreview(Geometry=cluster_2.curve_3, Shader=colour_picker_3)
mean_sea_level_crv_3 = CustomPreview(Geometry=cluster_4.curve_3, Shader=colour_picker_3)
mean_sea_level_crv_4 = CustomPreview(Geometry=cluster_5.curve_3, Shader=colour_picker_3)
mean_sea_level_crv_5 = CustomPreview(Geometry=cluster_6.curve_3, Shader=colour_picker_3)
mean_sea_level_crv_6 = CustomPreview(Geometry=cluster_3.curve_3, Shader=colour_picker_3)

# ==== cluster Cluster
level = ClusterInput()
frontline = ClusterInput()
terrain = ClusterInput()
level_2 = Brep(level)
terrain_2 = Brep(terrain)
bbx = BrepBrep(BrepA=terrain_2, BrepB=level_2)  # -> Curves, Points
find_closest = FindClosest(curve=bbx.Curves, curve_2=frontline)
split_with_brep = SplitWithBrep(Curve=level_2, Brep=terrain_2)  # -> Curve, Points
find_closest_2 = FindClosest(curve=split_with_brep.Curve, curve_2=frontline)
curve = Curve(find_closest)
list_item = ListItem(List=find_closest_2, Index=1, Wrap=True)
join_curves = JoinCurves(Curves=[curve, list_item], Preserve=False)
boundary_surfaces = BoundarySurfaces(Edges=join_curves)
list_length = ListLength(List=bbx.Curves)
larger_than = LargerThan(FirstNumber=list_length, SecondNumber=0)  # -> LargerThan, OrEqualTo
cull_pattern = CullPattern(List=boundary_surfaces, CullPattern=larger_than.LargerThan)
curve_2 = Curve(find_closest)
curve_3 = ClusterOutput(curve_2)
list = ClusterOutput(cull_pattern)

# ==== cluster RemoveOverlapping
pt = ClusterInput()
pt_2 = Point(pt)
sort_pt = SortPoints(Points=pt_2)  # -> Points, Indices
shift = ShiftList(List=sort_pt.Points, Shift=1, Wrap=True)
pdecon = Deconstruct(Point=sort_pt.Points)  # -> XComponent, YComponent, ZComponent
pdecon_2 = Deconstruct(Point=shift)  # -> XComponent, YComponent, ZComponent
equals = Equality(FirstNumber=pdecon.YComponent, SecondNumber=pdecon_2.YComponent)  # -> Equality, Inequality
equals_2 = Equality(FirstNumber=pdecon.XComponent, SecondNumber=pdecon_2.XComponent)  # -> Equality, Inequality
and = GateAnd(A=equals_2.Equality, B=equals.Equality)
equals_3 = Equality(FirstNumber=and, SecondNumber=0)  # -> Equality, Inequality
cull = CullPattern(List=sort_pt.Points, CullPattern=equals_3.Equality)
pt_3 = Point(cull)
pt_4 = ClusterOutput(pt_3)

# ==== cluster FindClosest
curve = ClusterInput()
curve_2 = ClusterInput()
divide_curve = DivideCurve(Curve=curve_2, Count=2, Kinks=False)  # -> Points, Tangents, Parameters
divide_curve_2 = DivideCurve(Curve=curve, Count=2, Kinks=False)  # -> Points, Tangents, Parameters
list_item = ListItem(List=divide_curve_2.Points, Index=1, Wrap=True)  # -> flatten(Item)
list_item_2 = ListItem(List=divide_curve.Points, Index=1, Wrap=True)
distance = Distance(PointA=list_item, PointB=list_item_2)
sort_list = SortList(Keys=distance)  # -> Keys, ValuesValuesA
list_item_3 = ListItem(List=sort_list.Keys, Index=0, Wrap=True)
member_index = MemberIndex(Set=distance, Member=list_item_3)  # -> Index, Count
list_item_4 = ListItem(List=curve, Index=member_index.Index, Wrap=True)
i = ClusterOutput(list_item_4)
