# Grasshopper definition Flows.gh (Grasshopper 0.9.76)
# plug-ins: Badger

number_slider = Slider(5, range=0..10)
srf = Surface(<surface referenced from the Rhino model>)
sdivide = DivideSurface(Surface=srf, UCount=number_slider, VCount=number_slider)  # -> flatten(Points), Normals, Parameters
flows = Badger(Surface=srf, Points=sdivide.Points, Fidelity=Slider(50, range=0..100))  # -> F, P
