# Grasshopper definition Flows Examples.gh (Grasshopper 0.9.76)
# plug-ins: Groundhog

number_slider = Slider(5, range=0..10)
srf = Surface(<surface referenced from the Rhino model>)
sdivide = DivideSurface(Surface=srf, UCount=number_slider, VCount=number_slider)  # -> flatten(Points), Normals, Parameters
flows = FlowSimulation(Surface=srf, Points=sdivide.Points, Fidelity=Slider(50, range=0..100), Thread=False)  # -> FlowPoints, flatten(FlowPaths)
catchments = FlowCatchments(FlowPaths=flows.FlowPaths, ProximtyThreshold=Slider(50, range=0..100))  # -> Catchments, FlowPaths, ColorCodes
crv = Curve(catchments.FlowPaths)
crv_2 = Curve(catchments.Catchments)
