# Grasshopper definition Fields Tests.gh (Grasshopper 0.9.76)
# plug-ins: Groundhog

pipeline = GeometryPipeline(
    GroupByLayer=False,
    GroupByType=False,
    IncludeHidden=True,
    IncludeLocked=True,
    LayerFilter="Data1",
    NameFilter="*",
    TypeFilter=4)
pipeline_2 = GeometryPipeline(
    GroupByLayer=False,
    GroupByType=False,
    IncludeHidden=True,
    IncludeLocked=True,
    LayerFilter="Data2",
    NameFilter="*",
    TypeFilter=4)
pipeline_3 = GeometryPipeline(
    GroupByLayer=False,
    GroupByType=False,
    IncludeHidden=True,
    IncludeLocked=True,
    LayerFilter="Data3",
    NameFilter="*",
    TypeFilter=4)
text_size = Slider(2, range=0..10)
fidelity_divisions = Slider(8, range=0..100)
boudary_boxes = Curve(<curve referenced from the Rhino model>)
regions = Curve([pipeline, pipeline_2, pipeline_3])
fixed_index_issue = CSharpScript(B=boudary_boxes, F=fidelity_divisions, A=regions)  # -> out, location, baseOverlap, interpolatedOverlap, largestOverlap, index, gridIndex; inputs B: Curve, F: Int32, A: list of Curve; disabled
# ---------- fixed_index_issue: C# ----------
    double TOLERANCE = Rhino.RhinoDoc.ActiveDoc.ModelAbsoluteTolerance;

    // Fidelity should default to like 10?
    int FIDELITY = F;
    Curve BOUNDARY = B;
    List<Curve> ALL_DATA_REGIONS = A;
    double Z_RANGE; // Hight differential; defaults to 10% of width/height
    bool INTERPOLATE = true;

    Z_RANGE = 0; // default value

    // Validate input curves are planar
    //if (!BOUNDARY.IsPlanar())
    //{
    //AddRuntimeMessage(GH_RuntimeMessageLevel.Error, "Boundary curve is not planar");
    //}
    //if (!BOUNDARY.IsClosed())
    //{
    //AddRuntimeMessage(GH_RuntimeMessageLevel.Error, "Boundary curve is not closed");
    //}

    //for (int i = 0; i < A.Length; i = i + 1)
    //{
    //  if (!A[i].IsPlanar())
    //  {
    //    //AddRuntimeMessage(GH_RuntimeMessageLevel.Error, "Boundary curve #{0}, is not planar", i);
    //  }
    //  if (!A[i].IsClosed())
    //  {
    //    //AddRuntimeMessage(GH_RuntimeMessageLevel.Error, "Boundary curve #{0}, is not closed", i);
    //  }
    //}


    // Construct the bounding box for the search limits boundary; identify its extents and if its square
    BoundingBox boundaryBox = BOUNDARY.GetBoundingBox(false); // False = uses estimate method
    bool BOUNDARY_IS_RECT = isBoundaryRect(BOUNDARY, TOLERANCE);

    // Construct the boundary boxes for the search targets
    List<BoundingBox> regionBoxes = new List<BoundingBox>();
    for (int i = 0; i < ALL_DATA_REGIONS.Count; i = i + 1) {
      regionBoxes.Add(ALL_DATA_REGIONS[i].GetBoundingBox(false));
    }

    // Construct the grid points
    var gridInfo = createGridPts(BOUNDARY, boundaryBox, BOUNDARY_IS_RECT, FIDELITY, Z_RANGE);
    // Unpack the returned values
    var gridPts = gridInfo.Item1;
    double zRange = gridInfo.Item2;
    int xGridExtents = gridInfo.Item3;
    int yGridExtents = gridInfo.Item4;

    // TODO: cull the grid points here if they are outside of the bounds?
    // Don't feed those outside the box into the RTree
    // Best check by setting an out of bounds = false property or something

    // Create and search the rTree
    Print("Creating/searching the rTree");
    Rhino.Geometry.RTree rTree = new Rhino.Geometry.RTree();
    for (int x = 0; x < gridPts.GetLength(0); x = x + 1) {
      for (int y = 0; y < gridPts.GetLength(1); y = y + 1) {        
        rTree.Insert(gridPts[x, y].Location, gridPts[x, y].GridIndex);
      }
    }

    for (int i = 0; i < regionBoxes.Count; i = i + 1) {
      // Construct a tuple to stuff state into the callback
      var data = Tuple.Create(i, gridPts, ALL_DATA_REGIONS, xGridExtents, yGridExtents, TOLERANCE);
      rTree.Search(regionBoxes[i], regionOverlapCallback, data);
    }

    // Set all the point's z values based on count; maybe set it to like 10% of extents?
    if (INTERPOLATE) {
      for (int x = 0; x < gridPts.GetLength(0); x = x + 1) {
        for (int y = 0; y < gridPts.GetLength(1); y = y + 1) {
          var pt = gridPts[x, y];
          if (pt.BaseOverlaps == 0) {
            pt.InterpolatedOverlaps = interpolateOverlaps(x, y, pt, gridPts);
          }
        }
      }
    }

    double overlapsMax = 0;
    for (int x = 0; x < gridPts.GetLength(0); x = x + 1) {
      for (int y = 0; y < gridPts.GetLength(1); y = y + 1) {
        if (gridPts[x, y].BaseOverlaps > overlapsMax) {
          overlapsMax = gridPts[x, y].BaseOverlaps;
        }
      }
    }
    Print("overlapsMax: {0}", overlapsMax);

    // Set Z values according to range/max
    for (int x = 0; x < gridPts.GetLength(0); x = x + 1) {
      for (int y = 0; y < gridPts.GetLength(1); y = y + 1) {
        var pt = gridPts[x, y];
        var newZ = pt.Location.Z + overlapsMax * pt.LargestOverlap();
        pt.Location = new Point3d(pt.Location.X, pt.Location.Y, newZ);
      }
    }

    // Real Output
    //var fieldSrf = NurbsSurface.CreateFromPoints(
    //  gridPts.Select(item => item.Location).ToList(),
    //  xGridExtents, //int uCount,
    //  yGridExtents, //int vCount,
    //  3,//int uDegree,
    //  3 //int vDegree
    //);

    // Fake output

    List<Point3d> outputs1 = new List<Point3d>();
    List<double> outputs2 = new List<double>();
    List<double> outputs3 = new List<double>();
    List<double> outputs4 = new List<double>();
    List<int> outputs5 = new List<int>();
    List<string> outputs6 = new List<string>();

    for (int x = 0; x < gridPts.GetLength(0); x = x + 1) {
      for (int y = 0; y < gridPts.GetLength(1); y = y + 1) {
        outputs1.Add(gridPts[x, y].Location);
        outputs2.Add(gridPts[x, y].BaseOverlaps);
        outputs3.Add(gridPts[x, y].InterpolatedOverlaps);
        outputs4.Add(gridPts[x, y].LargestOverlap());
        outputs5.Add(gridPts[x, y].GridIndex);
        outputs6.Add(System.String.Format("[{0},{1}]", x, y));
      }
    }

    location = outputs1;
    baseOverlap = outputs2;
    interpolatedOverlap = outputs3;
    largestOverlap = outputs4;
    index = outputs5;
    gridIndex = outputs6;
# ---------- fixed_index_issue: C# additional code ----------
  // Convoluted process to check if boundary is a rectangle

  private void regionOverlapCallback(object sender, RTreeEventArgs e) {
    int dataIndex = e.Id; // The full-grid index of the point found

    // Reconstruct variables from the data tag
    var data = e.Tag as Tuple<int, GridPt[,], List<Curve>, int, int, double>;
    var regionIndex = data.Item1;
    var gridPoints = data.Item2;
    Curve overlapRegion = data.Item3[regionIndex];
    var xExtents = data.Item4;
    var yExtents = data.Item5;
    var tolerance = data.Item6;

    // Find the x/y index from the full grid index
    //x = index % width
    //y = index / width
    
    Print("regionOverlapCallback (start) xExtents={0} yExtents={1}", xExtents, yExtents);
    var xIndex = dataIndex / yExtents;
    var yIndex = dataIndex % yExtents;
    Print("\t\tPt where dataIndex={0} is at {1},{2}", dataIndex, xIndex, yIndex);

    // Increment overlaps after checking if the curve actually overlaps
    GridPt overlappingPt = gridPoints[xIndex, yIndex];
    Print("\t\tPt where gridIndex={0} is at {1}", overlappingPt.GridIndex, overlappingPt.Location);

    var worldXY = Rhino.Geometry.Plane.WorldXY;
    var isOutside = Rhino.Geometry.PointContainment.Outside;
    var containmentTest = overlapRegion.Contains(overlappingPt.Location, worldXY, tolerance);
    if (containmentTest != isOutside)
    {
      overlappingPt.BaseOverlaps += 1;
      Print("\t\t\t\t Point inside");
    }
    else {
      Print("\t\t\t\t Point outside {0}", containmentTest);
    }
    Print("\n");
  }

  private bool isBoundaryRect(Curve BOUNDARY, double TOLERANCE) {
    bool isRect = false;
    if (BOUNDARY.IsPolyline())
    {
      Polyline BOUNDARY_PLINE;
      BOUNDARY.TryGetPolyline(out BOUNDARY_PLINE);
      if (BOUNDARY_PLINE != null && BOUNDARY_PLINE.SegmentCount == 4)
      {
        Line[] edges = BOUNDARY_PLINE.GetSegments();
        // Is each pair of segments the same length?
        if (Math.Abs(edges[0].Length - edges[1].Length) < TOLERANCE)
        {
          if (Math.Abs(edges[0].Length - edges[1].Length) < TOLERANCE)
          {
            // Are each of the diagonals the same length?
            double diagonalA = edges[0].From.DistanceTo(edges[2].From);
            double diagonalB = edges[1].From.DistanceTo(edges[3].From);
            if (Math.Abs(diagonalA - diagonalB) < TOLERANCE)
            {
              isRect = true;
            }
          }
        }
      }
    }
    return isRect;
  }

  private int[] range(int start, int times, int step)
  {
    // Oh for python
    int[] sequence = new int[times];
    for (int i = 0; i < times; i = i + 1) {
      sequence[i] = start + i * step;
    }
    return sequence;
  }

  private double interpolateOverlaps(int x, int y, GridPt fromPt, GridPt[,] searchPts)
  {
    int xExtents = searchPts.GetLength(0);
    int yExtents = searchPts.GetLength(1);
    double maximumProximity = Math.Max(xExtents, yExtents); // Farthest distance possible
    double maximumOverlaps = 0; // The number of overlaps for the closest neighbour
    double interpolatedOverlaps = 0; // The inerpolated overlap value

    // here i is the offset from the base position
    for (int i = 1; i < maximumProximity; i++) {

      Print("#[{0},{1} iteration {2}]_______", x, y, i);

      int travelDistance = i * 2 + 1; // The length of the rows to find
      var offset = (travelDistance - 1) / 2;  // The amount to go in x/y directions from centerpts
      var totalNeighbours = (travelDistance * 4) - 4;

      var neighbourIndices = new List<System.Drawing.Point>();

      for (int u = 0; u < travelDistance; u++) {
        neighbourIndices.Add(new System.Drawing.Point(x - offset + u, y + offset)); // Tops
      }
      for (int u = 0; u < travelDistance; u++) {
        neighbourIndices.Add(new System.Drawing.Point(x - offset + u, y - offset)); // Bottoms
      }
      for (int u = 0; u < travelDistance - 2; u++) {
        neighbourIndices.Add(new System.Drawing.Point(x - offset, y - offset + u + 1)); // Lefts
      }
      for (int u = 0; u < travelDistance - 2; u++) {
        neighbourIndices.Add(new System.Drawing.Point(x + offset, y - offset + u + 1)); // Rights

      }

      //neighbourIndices.RemoveAll(pt => pt.X < 0);
      //neighbourIndices.RemoveAll(pt => pt.Y < 0);
      //neighbourIndices.RemoveAll(pt => pt.X > xExtents);
      //neighbourIndices.RemoveAll(pt => pt.Y > yExtents);


      // Find the maximum hit value
      for (int j = 0; j < neighbourIndices.Count; j++) {
        var pt = neighbourIndices[j];
        Print("{0},{1}", pt.X, pt.Y);
        // TODO: index out of range here; why?
        //double searchPtOverlaps = searchPts[pt.X, pt.Y].BaseOverlaps;
        //if (searchPtOverlaps > maximumOverlaps) {
        //  maximumOverlaps = searchPtOverlaps;
        //  Print("    Found a maximum overlap of {0} at position {1}", maximumOverlaps, neighbourIndices[j]);
        //}
      }

      if (maximumOverlaps > 0) {
        interpolatedOverlaps = ((maximumProximity - i) / maximumProximity) * maximumOverlaps;
        Print("    Setting max overlap to {0}", interpolatedOverlaps);
        break; // Found the closest neighbour so we break
      }

    }
    return interpolatedOverlaps;

  }

  private Tuple<GridPt[,], double, int, int> createGridPts(Curve BOUNDARY, BoundingBox boundaryBox, bool BOUNDARY_IS_RECT, int FIDELITY, double zRange)
  {
    // Determine boundary dimensions
    Point3d[] corners = boundaryBox.GetCorners();
    double xLength = corners[1][0] - corners[0][0];
    double yLength = corners[2][1] - corners[0][1];
    double BOUNDARYZ = corners[0][2];
    double maxLength = Math.Sqrt(Math.Pow(xLength, 2) + Math.Pow(yLength, 2));

    // Use these to determine the number of grid points
    double gridSpacing = Math.Max(xLength, yLength) / (double) FIDELITY;
    int xGridExtents = (int) Math.Floor(xLength / gridSpacing);
    int yGridExtents = (int) Math.Floor(yLength / gridSpacing);

    Point3d middlePt = new Point3d(
      corners[0][0] + xLength / 2,
      corners[0][1] + yLength / 2,
      BOUNDARYZ);

    // Start bottom left (as measured from center point)
    Point3d startPt = new Point3d(
      middlePt[0] - gridSpacing * (xGridExtents / 2),
      middlePt[1] - gridSpacing * (yGridExtents / 2),
      BOUNDARYZ);

    double xSpacingBump;
    if (xGridExtents % 2 == 0)
    {
      xSpacingBump = gridSpacing / 2;
    }
    else
    {
      xSpacingBump = 0;
    }

    double ySpacingBump;
    if (yGridExtents % 2 == 0)
    {
      ySpacingBump = gridSpacing / 2;
    }
    else
    {
      ySpacingBump = 0;
    }

    if (zRange == 0) {
      // If Z_RANGE is not set use 5% of the maximum side
      zRange = Math.Max(xLength, yLength) * 0.10;
    }
    Print("createGridPts: with a Z range of {0}", zRange);

    // Make grid points
    GridPt[,] gridPts = new GridPt[xGridExtents, yGridExtents];
    var i = 0;
    for (int x = 0; x < xGridExtents; x++) {
      for (int y = 0; y < yGridExtents; y++) {
        gridPts[x, y] = new GridPt{
            Location = new Point3d(
            startPt[0] + gridSpacing * x + xSpacingBump,
            startPt[1] + gridSpacing * y + ySpacingBump,
            BOUNDARYZ),
            GridIndex = i,
            BaseOverlaps = 0,
            InterpolatedOverlaps = 0,
            InsideBoundary = true
        };
        i++;
      }
    }

    Print("createGridPts: Making {0} columns", gridPts.GetLength(0));
    Print("createGridPts: Making {0} rows", gridPts.GetLength(1));

    // If out boundary is not rectangular cull the points outside of it
    if (!BOUNDARY_IS_RECT){
      var isOutside = Rhino.Geometry.PointContainment.Outside;
      for (int x = 0; x < gridPts.GetLength(0); x++) {
        for (int y = 0; y < gridPts.GetLength(1); y++) {
          if (BOUNDARY.Contains(gridPts[x, y].Location) == isOutside) {
            gridPts[x, y].InsideBoundary = false;
          }
        }
      }
    }

    return Tuple.Create(gridPts, zRange, xGridExtents, yGridExtents);

  }

  class GridPt
  {
    public Point3d Location { get; set;}
    public int GridIndex { get; set;}
    public bool InsideBoundary { get; set;}

    public double BaseOverlaps { get; set; } // Records number of times it overlaps with a data region
    public double InterpolatedOverlaps { get; set; } // Nearest neighbour interpolation of overlaps

    public double LargestOverlap() {
      return Math.Max(BaseOverlaps, InterpolatedOverlaps);
    }

  }
# ---------- end fixed_index_issue ----------
c_script = CSharpScript(B=boudary_boxes, F=fidelity_divisions, A=regions)  # -> out, srf, location, baseOverlap, interpolatedOverlap, largestOverlap, index, gridIndex; inputs B: Curve, F: Int32, A: list of Curve
# ---------- c_script: C# ----------
    double TOLERANCE = Rhino.RhinoDoc.ActiveDoc.ModelAbsoluteTolerance;

    // Fidelity should default to like 10?
    int FIDELITY = F;
    Curve BOUNDARY = B;
    List<Curve> ALL_DATA_REGIONS = A;
    double Z_RANGE; // Hight differential; defaults to 10% of width/height
    bool INTERPOLATE = true;

    Z_RANGE = 0; // default value

    // Validate input curves are planar
    //if (!BOUNDARY.IsPlanar())
    //{
    //AddRuntimeMessage(GH_RuntimeMessageLevel.Error, "Boundary curve is not planar");
    //}
    //if (!BOUNDARY.IsClosed())
    //{
    //AddRuntimeMessage(GH_RuntimeMessageLevel.Error, "Boundary curve is not closed");
    //}

    //for (int i = 0; i < A.Length; i = i + 1)
    //{
    //  if (!A[i].IsPlanar())
    //  {
    //    //AddRuntimeMessage(GH_RuntimeMessageLevel.Error, "Boundary curve #{0}, is not planar", i);
    //  }
    //  if (!A[i].IsClosed())
    //  {
    //    //AddRuntimeMessage(GH_RuntimeMessageLevel.Error, "Boundary curve #{0}, is not closed", i);
    //  }
    //}


    // Construct the bounding box for the search limits boundary; identify its extents and if its square
    BoundingBox boundaryBox = BOUNDARY.GetBoundingBox(false); // False = uses estimate method
    bool BOUNDARY_IS_RECT = isBoundaryRect(BOUNDARY, TOLERANCE);

    // Construct the boundary boxes for the search targets
    List<BoundingBox> regionBoxes = new List<BoundingBox>();
    for (int i = 0; i < ALL_DATA_REGIONS.Count; i = i + 1) {
      regionBoxes.Add(ALL_DATA_REGIONS[i].GetBoundingBox(false));
    }

    // Construct the grid points
    var gridInfo = createGridPts(BOUNDARY, boundaryBox, BOUNDARY_IS_RECT, FIDELITY, Z_RANGE);
    // Unpack the returned values
    var gridPts = gridInfo.Item1;
    double zRange = gridInfo.Item2;
    int xGridExtents = gridInfo.Item3;
    int yGridExtents = gridInfo.Item4;

    // TODO: cull the grid points here if they are outside of the bounds?
    // Don't feed those outside the box into the RTree
    // Best check by setting an out of bounds = false property or something

    // Create and search the rTree
    Print("Creating/searching the rTree");
    Rhino.Geometry.RTree rTree = new Rhino.Geometry.RTree();
    for (int x = 0; x < gridPts.GetLength(0); x = x + 1) {
      for (int y = 0; y < gridPts.GetLength(1); y = y + 1) {
        // Only add points inside the containment area to the RTree to search
        if (gridPts[x, y].InsideBoundary)
        {
          rTree.Insert(gridPts[x, y].Location, gridPts[x, y].GridIndex);
        }
      }
    }

    for (int i = 0; i < regionBoxes.Count; i = i + 1) {
      // Construct a tuple to stuff state into the callback
      var data = Tuple.Create(i, gridPts, ALL_DATA_REGIONS, xGridExtents, yGridExtents, TOLERANCE);
      rTree.Search(regionBoxes[i], regionOverlapCallback, data);
    }

    // Set all the point's z values based on count; maybe set it to like 10% of extents?
    if (INTERPOLATE) {
      for (int x = 0; x < gridPts.GetLength(0); x = x + 1) {
        for (int y = 0; y < gridPts.GetLength(1); y = y + 1) {
          var pt = gridPts[x, y];
          if (pt.BaseOverlaps == 0) {
            pt.InterpolatedOverlaps = interpolateOverlaps(x, y, pt, gridPts);
          }
        }
      }
    }

    double overlapsMax = 0;
    for (int x = 0; x < gridPts.GetLength(0); x = x + 1) {
      for (int y = 0; y < gridPts.GetLength(1); y = y + 1) {
        if (gridPts[x, y].BaseOverlaps > overlapsMax) {
          overlapsMax = gridPts[x, y].BaseOverlaps;
        }
      }
    }
    Print("overlapsMax: {0}", overlapsMax);

    // Set Z values according to range/max
    for (int x = 0; x < gridPts.GetLength(0); x = x + 1) {
      for (int y = 0; y < gridPts.GetLength(1); y = y + 1) {
        var pt = gridPts[x, y];
        var newZ = pt.Location.Z + overlapsMax * pt.LargestOverlap();
        pt.Location = new Point3d(pt.Location.X, pt.Location.Y, newZ);
      }
    }

    // Real Output
    //var pointsList = gridPts.Select(item => item.Location).ToList(); ONLY for visual studio
    // Replacement for C#:
    List<Point3d> pointsList = new List<Point3d>(xGridExtents * yGridExtents);
    int size1 = gridPts.GetLength(1);
    int size0 = gridPts.GetLength(0);
    for(int i = 0;i < size0; i++)
    {
      for(int j = 0;j < size1; j++)
      {
        pointsList.Add(gridPts[i, j].Location);
      }
    }

    var fieldSrf = NurbsSurface.CreateFromPoints(
      pointsList, xGridExtents, yGridExtents, 3, 3); // points, x/y counts, u/v degrees
    srf = fieldSrf;

    // Fake output

    List<Point3d> outputs1 = new List<Point3d>();
    List<double> outputs2 = new List<double>();
    List<double> outputs3 = new List<double>();
    List<double> outputs4 = new List<double>();
    List<int> outputs5 = new List<int>();
    List<string> outputs6 = new List<string>();

    for (int x = 0; x < gridPts.GetLength(0); x = x + 1) {
      for (int y = 0; y < gridPts.GetLength(1); y = y + 1) {
        outputs1.Add(gridPts[x, y].Location);
        outputs2.Add(gridPts[x, y].BaseOverlaps);
        outputs3.Add(gridPts[x, y].InterpolatedOverlaps);
        outputs4.Add(gridPts[x, y].LargestOverlap());
        outputs5.Add(gridPts[x, y].GridIndex);
        outputs6.Add(System.String.Format("[{0},{1}]", x, y));
      }
    }

    location = outputs1;
    baseOverlap = outputs2;
    interpolatedOverlap = outputs3;
    largestOverlap = outputs4;
    index = outputs5;
    gridIndex = outputs6;
# ---------- c_script: C# additional code ----------
  // Convoluted process to check if boundary is a rectangle

  private void regionOverlapCallback(object sender, RTreeEventArgs e) {
    int dataIndex = e.Id; // The full-grid index of the point found

    // Reconstruct variables from the data tag
    var data = e.Tag as Tuple<int, GridPt[,], List<Curve>, int, int, double>;
    var regionIndex = data.Item1;
    var gridPoints = data.Item2;
    Curve overlapRegion = data.Item3[regionIndex];
    var xExtents = data.Item4;
    var yExtents = data.Item5;
    var tolerance = data.Item6;

    // Using the known GridPt 2D array bounds, locate the 2D indices from the 1D dataIndex
    Print("regionOverlapCallback (start) xExtents={0} yExtents={1}", xExtents, yExtents);
    var xIndex = dataIndex / yExtents;
    var yIndex = dataIndex % yExtents;
    Print("\t\tPt where dataIndex={0} is at {1},{2}", dataIndex, xIndex, yIndex);

    // Increment overlaps after checking if the curve actually overlaps
    GridPt overlappingPt = gridPoints[xIndex, yIndex];
    Print("\t\tPt where gridIndex={0} is at {1}", overlappingPt.GridIndex, overlappingPt.Location);

    var worldXY = Rhino.Geometry.Plane.WorldXY;
    var isOutside = Rhino.Geometry.PointContainment.Outside;
    var containmentTest = overlapRegion.Contains(overlappingPt.Location, worldXY, tolerance);
    if (containmentTest != isOutside)
    {
      overlappingPt.BaseOverlaps += 1;
      Print("\t\t\t\t Point inside");
    }
    else {
      Print("\t\t\t\t Point outside {0}", containmentTest);
    }
    Print("\n");
  }

  private bool isBoundaryRect(Curve BOUNDARY, double TOLERANCE) {
    bool isRect = false;
    if (BOUNDARY.IsPolyline())
    {
      Polyline BOUNDARY_PLINE;
      BOUNDARY.TryGetPolyline(out BOUNDARY_PLINE);
      if (BOUNDARY_PLINE != null && BOUNDARY_PLINE.SegmentCount == 4)
      {
        Line[] edges = BOUNDARY_PLINE.GetSegments();
        // Is each pair of segments the same length?
        if (Math.Abs(edges[0].Length - edges[1].Length) < TOLERANCE)
        {
          if (Math.Abs(edges[0].Length - edges[1].Length) < TOLERANCE)
          {
            // Are each of the diagonals the same length?
            double diagonalA = edges[0].From.DistanceTo(edges[2].From);
            double diagonalB = edges[1].From.DistanceTo(edges[3].From);
            if (Math.Abs(diagonalA - diagonalB) < TOLERANCE)
            {
              isRect = true;
            }
          }
        }
      }
    }
    return isRect;
  }

  private int[] range(int start, int times, int step)
  {
    // Oh for python
    int[] sequence = new int[times];
    for (int i = 0; i < times; i = i + 1) {
      sequence[i] = start + i * step;
    }
    return sequence;
  }

  private double interpolateOverlaps(int x, int y, GridPt fromPt, GridPt[,] searchPts)
  {
    int xExtents = searchPts.GetLength(0);
    int yExtents = searchPts.GetLength(1);
    double maximumProximity = Math.Max(xExtents, yExtents); // Farthest distance possible
    double maximumOverlaps = 0; // The number of overlaps for the closest neighbour
    double interpolatedOverlaps = 0; // The inerpolated overlap value

    // here i is the offset from the base position
    for (int i = 1; i < maximumProximity; i++) {

      Print("#[{0},{1} iteration {2}]_______", x, y, i);

      int travelDistance = i * 2 + 1; // The length of the rows to find
      var offset = (travelDistance - 1) / 2;  // The amount to go in x/y directions from centerpts
      var totalNeighbours = (travelDistance * 4) - 4;

      var neighbourIndices = new List<System.Drawing.Point>();

      for (int u = 0; u < travelDistance; u++) {
        neighbourIndices.Add(new System.Drawing.Point(x - offset + u, y + offset)); // Tops
      }
      for (int u = 0; u < travelDistance; u++) {
        neighbourIndices.Add(new System.Drawing.Point(x - offset + u, y - offset)); // Bottoms
      }
      for (int u = 0; u < travelDistance - 2; u++) {
        neighbourIndices.Add(new System.Drawing.Point(x - offset, y - offset + u + 1)); // Lefts
      }
      for (int u = 0; u < travelDistance - 2; u++) {
        neighbourIndices.Add(new System.Drawing.Point(x + offset, y - offset + u + 1)); // Rights

      }

      //neighbourIndices.RemoveAll(pt => pt.X < 0);
      //neighbourIndices.RemoveAll(pt => pt.Y < 0);
      //neighbourIndices.RemoveAll(pt => pt.X > xExtents);
      //neighbourIndices.RemoveAll(pt => pt.Y > yExtents);


      // Find the maximum hit value
      for (int j = 0; j < neighbourIndices.Count; j++) {
        var pt = neighbourIndices[j];
        Print("{0},{1}", pt.X, pt.Y);
        // TODO: index out of range here; why?
        //double searchPtOverlaps = searchPts[pt.X, pt.Y].BaseOverlaps;
        //if (searchPtOverlaps > maximumOverlaps) {
        //  maximumOverlaps = searchPtOverlaps;
        //  Print("    Found a maximum overlap of {0} at position {1}", maximumOverlaps, neighbourIndices[j]);
        //}
      }

      if (maximumOverlaps > 0) {
        interpolatedOverlaps = ((maximumProximity - i) / maximumProximity) * maximumOverlaps;
        Print("    Setting max overlap to {0}", interpolatedOverlaps);
        break; // Found the closest neighbour so we break
      }

    }
    return interpolatedOverlaps;

  }

  private Tuple<GridPt[,], double, int, int> createGridPts(Curve BOUNDARY, BoundingBox boundaryBox, bool BOUNDARY_IS_RECT, int FIDELITY, double zRange)
  {
    // Determine boundary dimensions
    Point3d[] corners = boundaryBox.GetCorners();
    double xLength = corners[1][0] - corners[0][0];
    double yLength = corners[2][1] - corners[0][1];
    double BOUNDARYZ = corners[0][2];
    double maxLength = Math.Sqrt(Math.Pow(xLength, 2) + Math.Pow(yLength, 2));

    // Use these to determine the number of grid points
    double gridSpacing = Math.Max(xLength, yLength) / (double) FIDELITY;
    int xGridExtents = (int) Math.Floor(xLength / gridSpacing);
    int yGridExtents = (int) Math.Floor(yLength / gridSpacing);

    Point3d middlePt = new Point3d(
      corners[0][0] + xLength / 2,
      corners[0][1] + yLength / 2,
      BOUNDARYZ);

    // Start bottom left (as measured from center point)
    Point3d startPt = new Point3d(
      middlePt[0] - gridSpacing * (xGridExtents / 2),
      middlePt[1] - gridSpacing * (yGridExtents / 2),
      BOUNDARYZ);

    double xSpacingBump;
    if (xGridExtents % 2 == 0)
    {
      xSpacingBump = gridSpacing / 2;
    }
    else
    {
      xSpacingBump = 0;
    }

    double ySpacingBump;
    if (yGridExtents % 2 == 0)
    {
      ySpacingBump = gridSpacing / 2;
    }
    else
    {
      ySpacingBump = 0;
    }

    if (zRange == 0) {
      // If Z_RANGE is not set use 5% of the maximum side
      zRange = Math.Max(xLength, yLength) * 0.10;
    }
    Print("createGridPts: with a Z range of {0}", zRange);

    // Make grid points
    GridPt[,] gridPts = new GridPt[xGridExtents, yGridExtents];
    var i = 0;
    for (int x = 0; x < xGridExtents; x++) {
      for (int y = 0; y < yGridExtents; y++) {
        gridPts[x, y] = new GridPt{
            Location = new Point3d(
            startPt[0] + gridSpacing * x + xSpacingBump,
            startPt[1] + gridSpacing * y + ySpacingBump,
            BOUNDARYZ),
            GridIndex = i,
            BaseOverlaps = 0,
            InterpolatedOverlaps = 0,
            InsideBoundary = true
            };
        i++;
      }
    }

    Print("createGridPts: Making {0} columns", gridPts.GetLength(0));
    Print("createGridPts: Making {0} rows", gridPts.GetLength(1));

    // If out boundary is not rectangular cull the points outside of it
    if (!BOUNDARY_IS_RECT){
      var isOutside = Rhino.Geometry.PointContainment.Outside;
      for (int x = 0; x < gridPts.GetLength(0); x++) {
        for (int y = 0; y < gridPts.GetLength(1); y++) {
          if (BOUNDARY.Contains(gridPts[x, y].Location) == isOutside) {
            gridPts[x, y].InsideBoundary = false;
          }
        }
      }
    }

    return Tuple.Create(gridPts, zRange, xGridExtents, yGridExtents);

  }

  class GridPt
  {
    public Point3d Location { get; set;}
    public int GridIndex { get; set;}
    public bool InsideBoundary { get; set;}

    public double BaseOverlaps { get; set; } // Records number of times it overlaps with a data region
    public double InterpolatedOverlaps { get; set; } // Nearest neighbour interpolation of overlaps

    public double LargestOverlap() {
      return Math.Max(BaseOverlaps, InterpolatedOverlaps);
    }

  }
# ---------- end c_script ----------
field = FieldMapper(Bounds=boudary_boxes, Divisions=fidelity_divisions, Areas=regions)
c_script_2 = CSharpScript(B=boudary_boxes, F=fidelity_divisions, A=regions)  # -> out, out1, out2, out3; inputs B: Curve, F: Int32, A: list of Curve; disabled
# ---------- c_script_2: C# ----------
    double TOLERANCE = Rhino.RhinoDoc.ActiveDoc.ModelAbsoluteTolerance;

    // Fidelity should default to like 10?
    int FIDELITY = F;
    Curve BOUNDARY = B;
    List<Curve> ALL_DATA_REGIONS = A;
    double Z_RANGE; // Hight differential; defaults to 10% of width/height
    bool INTERPOLATE = true;


    Z_RANGE = 0; // default value

    // Validate input curves are planar
    //if (!BOUNDARY.IsPlanar())
    //{
    //AddRuntimeMessage(GH_RuntimeMessageLevel.Error, "Boundary curve is not planar");
    //}
    //if (!BOUNDARY.IsClosed())
    //{
    //AddRuntimeMessage(GH_RuntimeMessageLevel.Error, "Boundary curve is not closed");
    //}

    //for (int i = 0; i < A.Length; i = i + 1)
    //{
    //  if (!A[i].IsPlanar())
    //  {
    //    //AddRuntimeMessage(GH_RuntimeMessageLevel.Error, "Boundary curve #{0}, is not planar", i);
    //  }
    //  if (!A[i].IsClosed())
    //  {
    //    //AddRuntimeMessage(GH_RuntimeMessageLevel.Error, "Boundary curve #{0}, is not closed", i);
    //  }
    //}


    // Construct the bounding box for the search limits boundary; identify its extents and if its square
    BoundingBox boundaryBox = BOUNDARY.GetBoundingBox(false); // False = uses estimate method
    bool BOUNDARY_IS_RECT = isBoundaryRect(BOUNDARY, TOLERANCE);

    // Construct the boundary boxes for the search targets
    List<BoundingBox> regionBoxes = new List<BoundingBox>();
    for (int i = 0; i < ALL_DATA_REGIONS.Count; i = i + 1) {
      regionBoxes.Add(ALL_DATA_REGIONS[i].GetBoundingBox(false));
    }

    // Construct the grid points
    var gridInfo = createGridPts(BOUNDARY, boundaryBox, BOUNDARY_IS_RECT, FIDELITY, Z_RANGE);
    // Unpack the returned values
    List<GridPt> gridPts = gridInfo.Item1;
    double zRange = gridInfo.Item2;
    int xGridExtents = gridInfo.Item3;
    int yGridExtents = gridInfo.Item4;


    // Create and search the rTree
    Rhino.Geometry.RTree rTree = new Rhino.Geometry.RTree();
    for (int i = 0; i < gridPts.Count; i = i + 1) {
      rTree.Insert(gridPts[i].Location, i);
    }
    for (int i = 0; i < regionBoxes.Count; i = i + 1) {
      // Construct a tuple to stuff state into the callback
      var data = Tuple.Create(i, gridPts, ALL_DATA_REGIONS);
      rTree.Search(regionBoxes[i], regionOverlapCallback, data);
    }


    // Set all the point's z values based on count; maybe set it to like 10% of extents?
    if (INTERPOLATE) {
            
        //gridPts[96].Overlaps = interpolateOverlaps(96, xGridExtents, yGridExtents, gridPts[86], gridPts);
        var searchPts = gridPts.FindAll(item => item.BaseOverlaps > 0.0); // Only search pts with overlaps
        for (int i = 0; i < gridPts.Count(); i = i + 1) {
        if (gridPts[i].BaseOverlaps == 0) {
            gridPts[i].InterpolatedOverlaps = interpolateOverlaps(i, xGridExtents, yGridExtents, gridPts[i], searchPts);
          }
        }
    }


    // Get Highest Overlaps
    double overlapsMax = gridPts.Max(item => item.BaseOverlaps);
    // Set Z values according to range/max
    Print("{0}", overlapsMax);
    gridPts.ForEach(item => item.Location = new Point3d(item.Location.X, item.Location.Y,
      item.Location.Z + (zRange / overlapsMax) * item.LargestOverlap()));


    // Output Pts
    gridPts.ForEach(item => item.Location = new Point3d(item.Location.X, item.Location.Y,
      item.Location.Z + (zRange / overlapsMax) * item.LargestOverlap()));
    Print("Making grid of {0} by {0}", xGridExtents, yGridExtents);


    // Real Output
    var fieldSrf = NurbsSurface.CreateFromPoints(
      gridPts.Select(item => item.Location).ToList(),
      xGridExtents, //int uCount,
      yGridExtents, //int vCount,
      3,//int uDegree,
      3 //int vDegree
    );

    // Fake output

    List<Point3d> outputs = new List<Point3d>();
    for (int i = 0; i < gridPts.Count; i = i + 1) {
      outputs.Add(gridPts[i].Location);
    }

    out1 = outputs;
    out2 = gridPts.Select(gpt => gpt.LargestOverlap()).ToList();
    out3 = fieldSrf;
# ---------- c_script_2: C# additional code ----------
  // Convoluted process to check if boundary is a rectangle

  private void regionOverlapCallback(object sender, RTreeEventArgs e) {
    // Reconstruct variables from the data tag
    var data = e.Tag as Tuple<int, List<GridPt>, List<Curve>>;
    GridPt overlappingPt = data.Item2[e.Id];
    Curve overlapRegion = data.Item3[data.Item1];
    // Increment overlaps if they exist
    var isOutside = Rhino.Geometry.PointContainment.Outside;
    if (overlapRegion.Contains(overlappingPt.Location) != isOutside)
    {
      overlappingPt.BaseOverlaps += 1;
    }
  }

  private bool isBoundaryRect(Curve BOUNDARY, double TOLERANCE) {
    bool isRect = false;
    if (BOUNDARY.IsPolyline())
    {
      Polyline BOUNDARY_PLINE;
      BOUNDARY.TryGetPolyline(out BOUNDARY_PLINE);
      if (BOUNDARY_PLINE != null && BOUNDARY_PLINE.SegmentCount == 4)
      {
        Line[] edges = BOUNDARY_PLINE.GetSegments();
        // Is each pair of segments the same length?
        if (Math.Abs(edges[0].Length - edges[1].Length) < TOLERANCE)
        {
          if (Math.Abs(edges[0].Length - edges[1].Length) < TOLERANCE)
          {
            // Are each of the diagonals the same length?
            double diagonalA = edges[0].From.DistanceTo(edges[2].From);
            double diagonalB = edges[1].From.DistanceTo(edges[3].From);
            if (Math.Abs(diagonalA - diagonalB) < TOLERANCE)
            {
              isRect = true;
            }
          }
        }
      }
    }
    return isRect;
  }

  private int[] range(int start, int times, int step)
  {
    // Oh for python
    int[] sequence = new int[times];
    for (int i = 0; i < times; i = i + 1) {
      sequence[i] = start + i * step;
    }
    return sequence;
  }

  private double interpolateOverlaps(int gridIndex, int xGridExtents, int yGridExtents, GridPt fromPt, List<GridPt> searchPts)
  {    
    double maximumProximity = Math.Max(xGridExtents, yGridExtents); // Farthest distance possible
    double maximumOverlaps = 0; // The number of overlaps for the closest neighbour
    double interpolatedOverlaps = 0; // The inerpolated overlap value
    
    // here i is the offset from the base position
    for (int i = 1; i < maximumProximity; i = i + 1) {
      int travelDistane = i * 2 + 1; // The length of the row to find
      int[] neighbourIndices = new int[travelDistane * 4 - 4];

      var bottomCenterI = gridIndex - xGridExtents * i;
      var bottomLeftI = bottomCenterI - (travelDistane - 1) / 2;

      Print("index: {0} step: {1} BC {2} CL {3}", gridIndex, i, bottomCenterI, bottomLeftI);

      int[] leftIs = range(bottomLeftI, travelDistane - 1, yGridExtents); // Exclude TL
      int[] topsIs = range(leftIs[travelDistane - 2] + yGridExtents, travelDistane - 1, 1); // Exclude TR
      int[] rightIs = range(topsIs[travelDistane - 2] + 1, travelDistane - 1, yGridExtents * -1); // Exclude BR
      int[] bottomsIs = range(rightIs[travelDistane - 2] - yGridExtents, travelDistane - 1, -1); // Exclude BL   

      // Add all the indices to a single list
      leftIs.CopyTo(neighbourIndices, 0);
      topsIs.CopyTo(neighbourIndices, travelDistane - 1);
      rightIs.CopyTo(neighbourIndices, travelDistane * 2 - 2);
      bottomsIs.CopyTo(neighbourIndices, travelDistane * 3 - 3);

      Print("    L {0}>{1} T {2}>{3} T {4}>{5} B {6}>{7}", leftIs[0], leftIs[leftIs.Length - 1],
        topsIs[0], topsIs[topsIs.Length - 1], rightIs[0], rightIs[topsIs.Length - 1], bottomsIs[0], bottomsIs[bottomsIs.Length - 1]);

      // Find the maximum hit value
      for (int j = 1; j < neighbourIndices.Length; j = j + 1) {
        // Have to check the item exists as I'm not checking for edges cases where numbers can go negative etc
        if(searchPts.ElementAtOrDefault(neighbourIndices[j]) != null)
        {
          double searchPtOverlaps = searchPts[neighbourIndices[j]].BaseOverlaps;
          if (searchPtOverlaps > maximumOverlaps) {
            maximumOverlaps = searchPtOverlaps;
            Print("    Found a maximum overlap of {0} at position {1}", maximumOverlaps, neighbourIndices[j]);
          }
        }
      }
      if (maximumOverlaps > 0) {
        interpolatedOverlaps = ((maximumProximity - i) / maximumProximity) * maximumOverlaps;
        Print("    Setting max overlap to {0}", interpolatedOverlaps);
        break; // Found the closest neighbour so we break
      }
    }

    return interpolatedOverlaps;
  }

  private Tuple<List<GridPt>, double, int, int> createGridPts(Curve BOUNDARY, BoundingBox boundaryBox, bool BOUNDARY_IS_RECT, int FIDELITY, double zRange)
  {
    // Determine boundary dimensions
    Point3d[] corners = boundaryBox.GetCorners();
    double xLength = corners[1][0] - corners[0][0];
    double yLength = corners[2][1] - corners[0][1];
    double BOUNDARYZ = corners[0][2];
    double maxLength = Math.Sqrt(Math.Pow(xLength, 2) + Math.Pow(yLength, 2));

    // Use these to determine the number of grid points
    double gridSpacing = Math.Max(xLength, yLength) / (double) FIDELITY;
    int xGridExtents = (int) Math.Floor(xLength / gridSpacing);
    int yGridExtents = (int) Math.Floor(yLength / gridSpacing);

    Point3d middlePt = new Point3d(
      corners[0][0] + xLength / 2,
      corners[0][1] + yLength / 2,
      BOUNDARYZ);

    // Start bottom left (as measured from center point)
    Point3d startPt = new Point3d(
      middlePt[0] - gridSpacing * (xGridExtents / 2),
      middlePt[1] - gridSpacing * (yGridExtents / 2),
      BOUNDARYZ);

    double xSpacingBump;
    if (xGridExtents % 2 == 0)
    {
      xSpacingBump = gridSpacing / 2;
    }
    else
    {
      xSpacingBump = 0;
    }

    double ySpacingBump;
    if (yGridExtents % 2 == 0)
    {
      ySpacingBump = gridSpacing / 2;
    }
    else
    {
      ySpacingBump = 0;
    }

    if (zRange == 0) {
      // If Z_RANGE is not set use 5% of the maximum side
      zRange = Math.Max(xLength, yLength) * 0.10;
    }
    Print("{0}", zRange);

    // Make grid points
    List<GridPt> gridPts = new List<GridPt>();
    for (int y = 0; y < yGridExtents; y = y + 1)
    {
      for (int x = 0; x < xGridExtents; x = x + 1)
      {
        gridPts.Add(new GridPt{
            Location = new Point3d(
            startPt[0] + gridSpacing * x + xSpacingBump,
            startPt[1] + gridSpacing * y + ySpacingBump,
            BOUNDARYZ),
            U = x,
            V = y,
            BaseOverlaps = 0,
            InterpolatedOverlaps = 0
            });
      }
    }

    // If out boundary is not rectangular cull the points outside of it
    if (!BOUNDARY_IS_RECT)
    {
      var isOutside = Rhino.Geometry.PointContainment.Outside;
      gridPts.RemoveAll(gpt => BOUNDARY.Contains(gpt.Location) == isOutside);
    }
    return Tuple.Create(gridPts, zRange, xGridExtents, yGridExtents);

  }

  class GridPt
  {
    public Point3d Location { get; set;}
    public double U { get; set; }
    public double V { get; set; }
    public double BaseOverlaps { get; set; } // Records number of times it overlaps with a data region
    public double InterpolatedOverlaps { get; set; } // Nearest neighbour interpolation of overlaps
    
    public double LargestOverlap() {
      return Math.Max(BaseOverlaps, InterpolatedOverlaps);
    }
    
  }
# ---------- end c_script_2 ----------
pt = Point(c_script.location)
interpolatedoverlap = Text(simplify(graft(c_script.interpolatedOverlap)))
largestoverlap = Text(simplify(graft(c_script.largestOverlap)))
number_slider = Slider(1.5, range=0..10)

text_size_2 = Slider(2, range=0..10)
locations = Point(c_script.location)
gridindex = Text(c_script.gridIndex)
multiplication = Multiplication(A=text_size_2, B=-3)
Y = UnitY(Factor=multiplication)
move = Move(Geometry=locations, Motion=Y)  # -> Geometry, Transform
grid_index = TextTag3D(
    Location=locations,
    Text=gridindex,
    Size=text_size_2,
    Colour=ColourSwatch(SwatchColor=RGB(255, 255, 255)),
    Justification=7)

locations_2 = Point(c_script.location)
index = Text(c_script.index)
text_size_3 = Slider(2, range=0..10)
multiplication_2 = Multiplication(A=text_size_3, B=-1.5)
Y_2 = UnitY(Factor=multiplication_2)
move_2 = Move(Geometry=locations_2, Motion=Y_2)  # -> Geometry, Transform
index_2 = TextTag3D(
    Location=move_2.Geometry,
    Text=index,
    Size=text_size_3,
    Colour=ColourSwatch(SwatchColor=RGB(255, 255, 255)),
    Justification=7)

multiplication_3 = Multiplication(A=number_slider, B=1.5)
Y_3 = UnitY(Factor=multiplication_3)
panel = Panel(c_script.baseOverlap)
srf = Surface(c_script.srf)
edges = BrepEdges(Brep=srf)  # -> Naked, Interior, NonManifold
sdivide = DivideSurface(Surface=srf, UCount=10, VCount=10)  # -> flatten(Points), Normals, Parameters
end = EndPoints(Curve=edges.Naked)  # -> Start, End
bnd = Bounds2D(Coordinates=end.Start)
pdecon = Deconstruct(Point=sdivide.Points)  # -> XComponent, YComponent, ZComponent

# ---- group: Old/Deprecated
# See blending http://formularch.blogspot.com.au/2012/03/gh-surface-blend.html?m=1
# Field Gen (Makes Surface from Geo)
# Field Vis (Heat Map)
# Field Gen (Makes Surface from Geo)
slider = Slider(100, range=0..100)  # disabled
crv = Curve([<curve referenced from the Rhino model> x3])  # disabled
crv_2 = Curve([<curve referenced from the Rhino model> x3])  # disabled
crv_3 = Curve([<curve referenced from the Rhino model> x3])  # disabled
crv_4 = Curve(<curve referenced from the Rhino model>)  # disabled
crv_5 = Curve([<curve referenced from the Rhino model> x4])  # disabled
crv_6 = Curve(<curve referenced from the Rhino model>)  # disabled
crv_7 = Curve([crv, crv_3, crv_2])  # disabled
field_2 = FieldMapper(Bounds=crv_6, Divisions=slider, Areas=crv_7)  # disabled
field_3 = FieldMapper(Bounds=crv_4, Areas=crv_5)  # disabled
num = Number()  # disabled
num_2 = Number()  # disabled
boundary = BoundarySurfaces(Edges=crv_4)  # disabled
sdivide_2 = DivideSurface(Surface=boundary, UCount=10, VCount=10)  # -> Points, Normals, Parameters; disabled
lng = ListLength(List=flatten(sdivide_2.Points))  # disabled
random = Random(Range=Domain(0, 10), Number=lng, Seed=2)  # disabled
panel_2 = Panel("Field Tween(Circles)")  # disabled
panel_3 = Panel("Fild Vis (Circles)")  # disabled
num_3 = Number([num_2, num])  # disabled
Z = UnitZ(Factor=random)  # disabled
num_4 = Number(num_2)  # disabled
number_slider_2 = Slider(11, range=0..100)  # disabled
move_3 = Move(Geometry=flatten(sdivide_2.Points), Motion=Z)  # -> Geometry, Transform; disabled
panel_4 = Panel("Field Vis (Circles)")  # disabled
srfgrid = SurfaceFromPoints(Points=move_3.Geometry, UCount=number_slider_2, Interpolate=False)  # disabled
num_5 = Number(num_3)  # disabled
num_6 = Number(num_3)  # disabled

# ----
bnd_2 = Bounds(Numbers=pdecon.ZComponent)
circle = CircleCNR(Center=sdivide.Points, Normal=Vector(0, 0, 1), Radius=1)

baseoverlap = Text(simplify(graft(c_script.baseOverlap)))
locations_3 = Point(c_script.location)

join = TextJoin(Text=[baseoverlap, interpolatedoverlap, largestoverlap], Join=":")  # -> flatten(Result)
move_4 = Move(Geometry=locations_3, Motion=Y_3)  # -> Geometry, Transform

value = TextTag3D(
    Location=move_4.Geometry,
    Text=join,
    Size=number_slider,
    Colour=ColourSwatch(SwatchColor=RGB(98, 255, 0)),
    Justification=7)
