# Grasshopper definition Test Flows.gh (Grasshopper 0.9.76)
# plug-ins: Badger

panel = Panel("NORMAL")
panel_2 = Panel("INPUT ERRORS")
normal_surface = Surface(<surface referenced from the Rhino model>)
normal_surface_2 = Surface(<surface referenced from the Rhino model>)
normal_mesh = Mesh(<mesh referenced from the Rhino model>)
sdivide = DivideSurface(Surface=normal_surface_2, UCount=10, VCount=10)  # -> flatten(Points), Normals, Parameters
facen = FaceNormals(Mesh=normal_mesh)  # -> Centers, Normals
flows = FlowSimulation(Surface=normal_surface_2, Points=sdivide.Points, Fidelity=Slider(1, range=0..1), Thread=False)  # -> FlowPoints, FlowPaths
double_input_warn = FlowSimulation(Surface=normal_surface, Mesh=normal_mesh, Points=facen.Centers, Fidelity=Slider(1, range=0..1), Thread=False)  # -> FlowPoints, FlowPaths
normal_mesh_2 = Mesh(<mesh referenced from the Rhino model>)
geo = Geometry(<curve referenced from the Rhino model>)
divide = DivideCurve(Curve=geo, Count=10, Kinks=False)  # -> Points, Tangents, Parameters
facen_2 = FaceNormals(Mesh=normal_mesh_2)  # -> Centers, Normals
flows_2 = FlowSimulation(Mesh=normal_mesh_2, Points=facen_2.Centers, Fidelity=Slider(1, range=0..1), Thread=False)  # -> FlowPoints, FlowPaths
bad_input_warn = FlowSimulation(Surface=geo, Points=divide.Points, Fidelity=Slider(1, range=0..1), Thread=False)  # -> FlowPoints, FlowPaths
no_inputs_warn = FlowSimulation(Fidelity=null, Thread_2=False)  # -> FlowPoints, FlowPaths
