# Grasshopper definition Groundhog - General Demo.ghx (Grasshopper 1.0.4)
# plug-ins: Groundhog

# ---- group: Global Parameters
# Groundhog Demo File
# Definition prepared for Groundhog v0.7.1b and depends on components from that plugin. It is available for download at http://groundhog.la/
# 
# Contact groundhog@philipbelesky.com for support or feedback
# 
# This is an incomplete/unfinished demonstration file.
# 
# This definition is licensed under the terms of the GPL v3 https://opensource.org/licenses/GPL-3.0
year = Slider(2015, range=2015..2115)
get_rel_path = VBScript()  # -> File, Folder
# ---------- get_rel_path: C# ----------
    File = "<unset>"
    Folder = "<unset>"

    If (String.IsNullOrEmpty(GrasshopperDocument.FilePath)) Then Return

    Try
      File = GrasshopperDocument.FilePath
      Folder = IO.Path.GetDirectoryName(GrasshopperDocument.FilePath) & IO.Path.DirectorySeparatorChar
    Catch
    End Try
# ---------- end get_rel_path ----------
demo_plant_palette = Text("Demo.csv")
global_time_parameter = Number(year)
panel = Panel(demo_plant_palette)
definition_path = Text(get_rel_path.Folder)
sitebounds = Curve(<curve referenced from the Rhino model>)

# ---- group: Navigation Jumps
panel_2 = Panel("Floods")
panel_3 = Panel("Flows")
panel_4 = Panel("Plants")
panel_5 = Panel("Fields")
panel_6 = Panel("Terrain")

# ----
demo_plant_palette_2 = Text(demo_plant_palette)

# ---- group: Fixing Contours and Creating the Mesh/Srf
pipeline = GeometryPipeline(
    GroupByLayer=False,
    GroupByType=False,
    IncludeHidden=True,
    IncludeLocked=True,
    LayerFilter="Contours",
    NameFilter="*",
    SublayerFiltering=False,
    TypeFilter=4)
gap_bridging_tolerance = Slider(7, range=0..10)
createplanes_can_be_slow = BooleanToggle(False)
mesh_reduce_tolerance_for_performance = Slider(0.5, range=0..1)
sitebounds_2 = Curve(sitebounds)
contour_fix = ContourFix(ContourCurves=pipeline)  # -> AllContours, FixedContours
contour_gap_fix = ContourGapFix(ContourCurves=contour_fix.AllContours, Boundary=sitebounds_2, MaximumDistance=gap_bridging_tolerance)  # -> Contours, Joins
contour_clip = ContourClip(ContourCurves=contour_gap_fix.Contours, Boundary=sitebounds_2, CreatePlanarSrfs=createplanes_can_be_slow)  # -> Contours, EdgedContours, PlanarSurfaces
redpline = Reduce(Polyline=contour_clip.EdgedContours, Tolerance=mesh_reduce_tolerance_for_performance)  # -> Polyline, Reduction
cp = ControlPoints(Curve=redpline.Polyline)  # -> flatten(Points), Weights, Knots
remove_overlapping = RemoveOverlapping(pt=cp.Points)
del = DelaunayMesh(Points=remove_overlapping, Plane=PlaneXY(0, 0, 0))
meshterrain = Mesh(del)

# ----
panel_7 = Panel("TERRAIN")
mesh_terrain = CustomPreview(Geometry=del, Shader=ColourSwatch(SwatchColor=RGB(0, 0, 0)))

# ---- group: Basic Mesh Grade Analysis
meshterrain_2 = Mesh(meshterrain)
angle_vector_color = ColourSwatch(SwatchColor=RGB(255, 255, 255))
angle_text = Slider(0.5, range=0..1)
mesh = MeshSlope(Mesh=meshterrain_2)  # -> M, FaceCenters, FaceSlopeVectors, FaceSlopeAngles
gradient = Gradient(
    LowerLimit=0,
    UpperLimit=90,
    Parameter=mesh.FaceSlopeAngles,
    stops=[0: RGB(0, 128, 0), 0.404: RGB(255, 255, 0), 0.799: RGB(255, 0, 0), 1: RGB(0, 0, 0)])
int = Integer(mesh.FaceSlopeAngles)
mesh_2 = Mesh(simplify(graft(mesh.M)))
mcol = MeshColours(Mesh=mesh_2, Colours=simplify(graft(gradient)))
grade_coloring = Mesh(mcol)
meshterrain_3 = Mesh(meshterrain_2)
angles_vectors = VectorDisplayEx(Point=mesh.FaceCenters, Vector=mesh.FaceSlopeVectors, Colour=angle_vector_color, Width=1)
angles_labels = TextTag3D(Location=mesh.FaceCenters, Text=int, Size=angle_text, Colour=angle_vector_color, Justification=5)

# ----
panel_8 = Panel("Catchments")
number_slider = Slider(500, range=0..1000)
panel_9 = Panel("FLOWS")
hexgrid = Hexagonal(
    Plane=PlaneXY(0, 0, 0),
    Size=Slider(2500, range=0..10000),
    ExtentX=Slider(54, range=0..100),
    ExtentY=Slider(24, range=0..100))  # -> Cells, Points
Z = UnitZ(Factor=1)
panel_10 = Panel("FLOODS")  # disabled

sea_level_rise_year = Slider(1.6, range=0..5)  # disabled
storm_surge_height = Slider(500, range=0..5000)  # disabled
panel_11 = Panel("Site Data")  # disabled
sea_datum_z = Slider(0, range=-3000..3000)  # disabled

mean_high_water_springs = Slider(1000, range=0..5000)  # disabled
mean_low_water_springs = Slider(430, range=0..5000)  # disabled
mean_high_water_neaps = Slider(1450, range=0..5000)  # disabled
mean_low_water_neaps = Slider(700, range=0..5000)  # disabled
mean_sea_level = Slider(0, range=0..5000)  # disabled
panel_12 = Panel("High Tide Data")  # disabled

coast = Curve(<curve referenced from the Rhino model>)  # disabled
surface_terrain = Brep(<brep referenced from the Rhino model>)  # disabled
panel_13 = Panel("Testing Area")  # disabled
frontline = Curve(coast)  # disabled
terrain = Brep(surface_terrain)  # disabled

panel_14 = Panel("TOOO: FIX")  # disabled
year_2 = Number(global_time_parameter)  # disabled
geometry_pipeline = GeometryPipeline(
    GroupByLayer=False,
    GroupByType=False,
    IncludeHidden=True,
    IncludeLocked=True,
    LayerFilter="Visual Area",
    NameFilter="*",
    SublayerFiltering=False,
    TypeFilter=4)  # disabled
geometry_pipeline_2 = GeometryPipeline(
    GroupByLayer=False,
    GroupByType=False,
    IncludeHidden=True,
    IncludeLocked=True,
    LayerFilter="Sediment Retention",
    NameFilter="*",
    SublayerFiltering=False,
    TypeFilter=4)  # disabled
geometry_pipeline_3 = GeometryPipeline(
    GroupByLayer=False,
    GroupByType=False,
    IncludeHidden=True,
    IncludeLocked=True,
    LayerFilter="Stream Shading",
    NameFilter="*",
    SublayerFiltering=False,
    TypeFilter=4)  # disabled
geometry_pipeline_4 = GeometryPipeline(
    GroupByLayer=False,
    GroupByType=False,
    IncludeHidden=True,
    IncludeLocked=True,
    LayerFilter="Field Inflow",
    NameFilter="*",
    SublayerFiltering=False,
    TypeFilter=4)  # disabled
panel_15 = Panel("PLANTS")  # disabled
definition_path_2 = Text(definition_path)  # disabled
demo_plant_palette_3 = Text(demo_plant_palette_2)  # disabled

# ---- group: Import CSV relative to current path
panel_16 = Panel(panel)  # disabled
concatenate = Concatenate(FragmentA=definition_path, FragmentB=panel_16)  # disabled
read_file = ReadFile(File=concatenate, PerLineParse=True)  # disabled

# ----
geometry_pipeline_5 = GeometryPipeline(
    GroupByLayer=False,
    GroupByType=False,
    IncludeHidden=True,
    IncludeLocked=True,
    LayerFilter="Sediment Retention",
    NameFilter="*",
    SublayerFiltering=False,
    TypeFilter=4)  # disabled
concatenate_2 = Concatenate(FragmentA=definition_path_2, FragmentB=demo_plant_palette_3)  # disabled

panel_18 = Panel("CSV & Generic Importer")  # disabled
species_attribute_importer = SpeciesAttributeImporter(CSVFile=read_file)  # disabled

sitebounds_3 = Curve(sitebounds)  # disabled
pop2d = Populate2D(Region=sitebounds_3, Count=100, Seed=1)  # disabled

curve = Curve(geometry_pipeline_5)  # disabled
panel_19 = Panel("Planting Locations/Time")  # disabled
boundary_surfaces = BoundarySurfaces(Edges=curve)  # disabled
manual_points = Point(pop2d)  # disabled

read_file_2 = ReadFile(File=concatenate_2, PerLineParse=True)  # disabled
generic_species = GenericSpeciesAttributes()  # -> ShrubP, GrassP, TreeP; disabled
pimport = SpeciesAttributeImporter(CSVFile=read_file)  # disabled
global_time_parameter_2 = Number(global_time_parameter)  # disabled
shower = PlantAppearanceSimulator(Plants=species_attribute_importer, Locations=manual_points, Times=global_time_parameter_2)  # -> Trunk, Root, Crown, Spacing, Color, Label; disabled

# ---- group: Hydrology Parameters
fidelity_of_flow_steps = Slider(1000, range=100..10000)
panel_20 = Panel("Base Surface/Mesh")
proximity_threshold = Slider(2500, range=100..10000)
meshterrain_4 = Mesh(meshterrain_3)
meshterrain_5 = Mesh(meshterrain_4)

# ----
project = ProjectPoint(Point=hexgrid.Points, Direction=Z, Geometry=meshterrain_4)  # -> Point, Index
proximity_threshold_2 = Number(proximity_threshold)

# ---- group: Hydrology Parameters (continued)
origins = Point(project.Point)

# ----
meshterrain_6 = Mesh(meshterrain_5)
fidelity = Number(fidelity_of_flow_steps)
origins_2 = Point(origins)
mesh_flows = FlowSimulationMesh(Mesh=meshterrain_6, Points=origins_2, Fidelity=fidelity, Steps=0, Thread=False)  # -> FlowPoints, FlowPaths
flow_paths = Curve(mesh_flows.FlowPaths)
flow_points = Point(mesh_flows.FlowPoints)

# ---- group: Flow Path Vis
flow_points_2 = Point(flow_points)
lng = ListLength(List=flow_points_2)
series = Series(Start=1, Step=-0.025, Count=lng)
hsl = ColourHSL(Alpha=1, Hue=series, Saturation=series, Luminance=0.5)
flow_paths_hue_shifted_by_distance = CustomPreview(Geometry=flow_points_2, Shader=hsl)

# ---- group: Catchment Analysis
proximity_threshold_3 = Number(proximity_threshold_2)
flow_paths_2 = Curve(flow_paths)
catchments = FlowCatchments(FlowPaths=flatten(flow_paths_2), ProximtyThreshold=proximity_threshold_3)  # -> Catchments, FlowPaths, ColorCodes
catchment_boundaries = Curve(catchments.Catchments)
catchment_colors = Colour(catchments.ColorCodes)
flow_paths_3 = Curve(catchments.FlowPaths)
catchment_boundaries_2 = CustomPreview(Geometry=catchments.Catchments, Shader=catchments.ColorCodes)
catchment_paths = CustomPreview(Geometry=catchments.FlowPaths, Shader=catchments.ColorCodes)

# ----
number = Number(sea_datum_z)  # disabled
number_2 = Number(year_2)  # disabled
number_3 = Number(sea_level_rise_year)  # disabled
number_4 = Number(mean_low_water_neaps)  # disabled
number_5 = Number(mean_high_water_springs)  # disabled
number_6 = Number(mean_low_water_springs)  # disabled
number_7 = Number(mean_sea_level)  # disabled
number_8 = Number(mean_high_water_neaps)  # disabled
number_9 = Number(storm_surge_height)  # disabled

flood_simulator = FloodSimulator(
    Datum=number,
    Year=number_2,
    Rise=number_3,
    Surge=number_9,
    HighNeap=number_8,
    LowNeap=number_4,
    HighSpring=number_5,
    LowSpring=number_6)  # -> SeaLevel, StormSurgeLevel, HighNeap, LowNeap, HighSpring, LowSpring; disabled

mean_high_water_neap = Geometry(flood_simulator.HighNeap)  # disabled
mean_high_water_spring = Geometry(flood_simulator.HighSpring)  # disabled
mean_low_water_spring = Geometry(flood_simulator.LowSpring)  # disabled
mean_low_water_neap = Geometry(flood_simulator.LowNeap)  # disabled
mean_sea_level_2 = Geometry(flood_simulator.SeaLevel)  # disabled
storm_surge_level = Geometry(flood_simulator.StormSurgeLevel)  # disabled

frontline_2 = Curve(frontline)  # disabled
terrain_2 = Brep(terrain)  # disabled
mean_high_water_spring_2 = Geometry(mean_high_water_spring)  # disabled
storm_surge_level_2 = Geometry(storm_surge_level)  # disabled
mean_high_water_neap_2 = Geometry(mean_high_water_neap)  # disabled
mean_low_water_neap_2 = Geometry(mean_low_water_neap)  # disabled
mean_low_water_spring_2 = Geometry(mean_low_water_spring)  # disabled
mean_sea_level_3 = Geometry(mean_sea_level_2)  # disabled
cluster = Cluster(level=mean_sea_level_3, frontline=frontline_2, terrain=terrain_2)  # -> curve_3, list; disabled
cluster_2 = Cluster(level=mean_low_water_neap_2, frontline=frontline_2, terrain=terrain_2)  # -> curve_3, list; disabled
cluster_3 = Cluster(level=storm_surge_level_2, frontline=frontline_2, terrain=terrain_2)  # -> curve_3, list; disabled
cluster_4 = Cluster(level=mean_high_water_neap_2, frontline=frontline_2, terrain=terrain_2)  # -> curve_3, list; disabled
cluster_5 = Cluster(level=mean_low_water_spring_2, frontline=frontline_2, terrain=terrain_2)  # -> curve_3, list; disabled
cluster_6 = Cluster(level=mean_high_water_spring_2, frontline=frontline_2, terrain=terrain_2)  # -> curve_3, list; disabled
mean_sea_level_srf = CustomPreview(
    Geometry=cluster.list,
    Shader={diffuse=RGB(255, 105, 180), emission=RGB(76, 32, 54), shine=0.5, specular=RGB(255, 255, 255), transparency=0})  # disabled
mean_sea_level_srf_2 = CustomPreview(
    Geometry=cluster_2.list,
    Shader={diffuse=RGB(255, 105, 180), emission=RGB(76, 32, 54), shine=0.5, specular=RGB(255, 255, 255), transparency=0})  # disabled
mean_sea_level_srf_3 = CustomPreview(
    Geometry=cluster_4.list,
    Shader={diffuse=RGB(255, 105, 180), emission=RGB(76, 32, 54), shine=0.5, specular=RGB(255, 255, 255), transparency=0})  # disabled
mean_sea_level_srf_4 = CustomPreview(
    Geometry=cluster_5.list,
    Shader={diffuse=RGB(255, 105, 180), emission=RGB(76, 32, 54), shine=0.5, specular=RGB(255, 255, 255), transparency=0})  # disabled
mean_sea_level_srf_5 = CustomPreview(
    Geometry=cluster_6.list,
    Shader={diffuse=RGB(255, 105, 180), emission=RGB(76, 32, 54), shine=0.5, specular=RGB(255, 255, 255), transparency=0})  # disabled
mean_sea_level_srf_6 = CustomPreview(
    Geometry=cluster_3.list,
    Shader={diffuse=RGB(255, 105, 180), emission=RGB(76, 32, 54), shine=0.5, specular=RGB(255, 255, 255), transparency=0})  # disabled
mean_sea_level_crv = CustomPreview(
    Geometry=cluster.curve_3,
    Shader={diffuse=RGB(255, 105, 180), emission=RGB(76, 32, 54), shine=0.5, specular=RGB(255, 255, 255), transparency=0})  # disabled
mean_sea_level_crv_2 = CustomPreview(
    Geometry=cluster_2.curve_3,
    Shader={diffuse=RGB(255, 105, 180), emission=RGB(76, 32, 54), shine=0.5, specular=RGB(255, 255, 255), transparency=0})  # disabled
mean_sea_level_crv_3 = CustomPreview(
    Geometry=cluster_4.curve_3,
    Shader={diffuse=RGB(255, 105, 180), emission=RGB(76, 32, 54), shine=0.5, specular=RGB(255, 255, 255), transparency=0})  # disabled
mean_sea_level_crv_4 = CustomPreview(
    Geometry=cluster_5.curve_3,
    Shader={diffuse=RGB(255, 105, 180), emission=RGB(76, 32, 54), shine=0.5, specular=RGB(255, 255, 255), transparency=0})  # disabled
mean_sea_level_crv_5 = CustomPreview(
    Geometry=cluster_6.curve_3,
    Shader={diffuse=RGB(255, 105, 180), emission=RGB(76, 32, 54), shine=0.5, specular=RGB(255, 255, 255), transparency=0})  # disabled
mean_sea_level_crv_6 = CustomPreview(
    Geometry=cluster_3.curve_3,
    Shader={diffuse=RGB(255, 105, 180), emission=RGB(76, 32, 54), shine=0.5, specular=RGB(255, 255, 255), transparency=0})  # disabled

# ==== cluster Cluster
level = ClusterInput()
frontline = ClusterInput()
terrain = ClusterInput()
level_2 = Brep(level)
terrain_2 = Brep(terrain)
bbx = BrepBrep(BrepA=terrain_2, BrepB=level_2)  # -> Curves, Points
find_closest = FindClosest(curve=bbx.Curves, curve_2=frontline)
split_with_brep = SplitWithBrep(Curve=level_2, Brep=terrain_2)  # -> Curve, Points
find_closest_2 = FindClosest(curve=split_with_brep.Curve, curve_2=frontline)
curve = Curve(find_closest)
list_item = ListItem(List=find_closest_2, Index=1, Wrap=True)
join_curves = JoinCurves(Curves=[curve, list_item], Preserve=False)
boundary_surfaces = BoundarySurfaces(Edges=join_curves)
list_length = ListLength(List=bbx.Curves)
larger_than = LargerThan(FirstNumber=list_length, SecondNumber=0)  # -> LargerThan, OrEqualTo
cull_pattern = CullPattern(List=boundary_surfaces, CullPattern=larger_than.LargerThan)
curve_2 = Curve(find_closest)
curve_3 = ClusterOutput(curve_2)
list = ClusterOutput(cull_pattern)

# ==== cluster RemoveOverlapping
pt = ClusterInput()
pt_2 = Point(pt)
sort_pt = SortPoints(Points=pt_2)  # -> Points, Indices
shift = ShiftList(List=sort_pt.Points, Shift=1, Wrap=True)
pdecon = Deconstruct(Point=sort_pt.Points)  # -> XComponent, YComponent, ZComponent
pdecon_2 = Deconstruct(Point=shift)  # -> XComponent, YComponent, ZComponent
equals = Equality(FirstNumber=pdecon.YComponent, SecondNumber=pdecon_2.YComponent)  # -> Equality, Inequality
equals_2 = Equality(FirstNumber=pdecon.XComponent, SecondNumber=pdecon_2.XComponent)  # -> Equality, Inequality
and = GateAnd(A=equals_2.Equality, B=equals.Equality)
equals_3 = Equality(FirstNumber=and, SecondNumber=0)  # -> Equality, Inequality
cull = CullPattern(List=sort_pt.Points, CullPattern=equals_3.Equality)
pt_3 = Point(cull)
pt_4 = ClusterOutput(pt_3)

# ==== cluster FindClosest
curve = ClusterInput()
curve_2 = ClusterInput()
divide_curve = DivideCurve(Curve=curve_2, Count=2, Kinks=False)  # -> Points, Tangents, Parameters
divide_curve_2 = DivideCurve(Curve=curve, Count=2, Kinks=False)  # -> Points, Tangents, Parameters
list_item = ListItem(List=divide_curve_2.Points, Index=1, Wrap=True)  # -> flatten(Item)
list_item_2 = ListItem(List=divide_curve.Points, Index=1, Wrap=True)
distance = Distance(PointA=list_item, PointB=list_item_2)
sort_list = SortList(Keys=distance)  # -> Keys, ValuesValuesA
list_item_3 = ListItem(List=sort_list.Keys, Index=0, Wrap=True)
member_index = MemberIndex(Set=distance, Member=list_item_3)  # -> Index, Count
list_item_4 = ListItem(List=curve, Index=member_index.Index, Wrap=True)
i = ClusterOutput(list_item_4)
