# Grasshopper definition Groundhog - Planting Plan Demo.ghx (Grasshopper 0.9.76)
# plug-ins: Groundhog

# Groundhog Demo File
# Definition prepared for Groundhog v0.10.2b and depends on components from that plugin. It is available for download at http://groundhog.la/
# 
# Contact groundhog@philipbelesky.com for support or feedback
# 
# This is an incomplete/unfinished demonstration file.
# 
# This definition is licensed under the terms of the GPL v3 https://opensource.org/licenses/GPL-3.0
simulated_time = Slider(50, range=0..100)

bounds = Curve(<curve referenced from the Rhino model>)
areas = Curve([<curve referenced from the Rhino model> x2])

paths = Curve([<curve referenced from the Rhino model> x3])

# ---- group: Create plant locations
pop2d = Populate2D(Region=bounds, Count=Slider(851, range=0..1000), Seed=1)

# ---- group: Offset paths
parametric_paths = ParametricPaths(C=paths, D=Slider(10000, range=0..10000))

# ---- group: Remove points not in planted areas
incurve = PointInCurve(Point=pop2d, Curve=graft(areas))  # -> Relationship, Point
equals = Equality(FirstNumber=incurve.Relationship, SecondNumber=2)  # -> Equality, Inequality
cull = CullPattern(List=pop2d, CullPattern=equals.Equality)  # -> flatten(List)

# ---- group: Remove points on paths
incurve_2 = PointInCurve(Point=cull, Curve=graft(parametric_paths))  # -> Relationship, Point
flip = FlipMatrix(Data=incurve_2.Relationship)
ma = MassAddition(Input=flip)  # -> flatten(Result), PartialResults
larger = LargerThan(FirstNumber=ma.Result, SecondNumber=0)  # -> LargerThan, OrEqualTo
cull_2 = CullPattern(List=cull, CullPattern=invert(larger.LargerThan))

# ---- group: Control the mix between species
planted_locations = Point(cull_2)
cluster = Cluster(L=planted_locations, B_2=Slider(0.4, range=0..1), B=Slider(0.3, range=0..1), B_3=Slider(0.3, range=0..1))  # -> D, D_2, D_3
species_data = Data([cluster.D, cluster.D_2, cluster.D_3])

# ---- group: Project plant growth at given time period
shower = PlantAppearanceSimulator(Plants=species_data, Locations=cull_2, Times=simulated_time)  # -> Trunk, Root, Crown, Spacing, Color, Label

# ---- group: Visualise crowns and root radii
preview = CustomPreview(Geometry=shower.Root, Shader=ColourSwatch(SwatchColor=RGB(105, 105, 105)))
preview_2 = CustomPreview(Geometry=shower.Crown, Shader=shower.Color)

# ---- group: Species proportions
pie = PieChart(species_data)

# ----
species_labels = Text(shower.Label)

# ---- group: Label species
darc = DeconstructArc(Arc=shower.Crown)  # -> BasePlane, Radius, Angle
tag = TextTag3D(
    Location=darc.BasePlane,
    Text=species_labels,
    Size=Slider(3300, range=0..10000),
    Colour=ColourSwatch(SwatchColor=RGB(212, 212, 212)),
    Justification=7)

# ==== cluster ParametricPaths
D = ClusterInput()
C = ClusterInput()
multiplication = Multiplication(A=D, B=-1)
offset = Offset(Curve=C, Distance=multiplication, Plane=PlaneXY(0, 0, 0), Corners=1)
offset_2 = Offset(Curve=C, Distance=D, Plane=PlaneXY(0, 0, 0), Corners=1)
end = EndPoints(Curve=offset_2)  # -> Start, End
end_2 = EndPoints(Curve=offset)  # -> Start, End
ln = Line(StartPoint=end.Start, EndPoint=end_2.Start)
ln_2 = Line(StartPoint=end.End, EndPoint=end_2.End)
join = JoinCurves(Curves=[offset_2, offset, ln, ln_2], Preserve=False)  # -> flatten(Curves)
C_2 = ClusterOutput(join)

# ==== cluster Cluster
L = ClusterInput()
lng = ListLength(List=L)
generic_species = GenericSpeciesAttributes()  # -> ShrubP, GrassP, TreeP
B = ClusterInput()
B_2 = ClusterInput()
B_3 = ClusterInput()
multiplication = Multiplication(A=lng, B=B)
multiplication_2 = Multiplication(A=lng, B=B_2)
multiplication_3 = Multiplication(A=lng, B=B_3)
repeat = RepeatData(Data=generic_species.ShrubP, Length=multiplication_2)
repeat_2 = RepeatData(Data=generic_species.GrassP, Length=multiplication)
repeat_3 = RepeatData(Data=generic_species.TreeP, Length=multiplication_3)
D = ClusterOutput(repeat)
D_2 = ClusterOutput(repeat_2)
D_3 = ClusterOutput(repeat_3)
