# Grasshopper definition Planting Plan.gh (Grasshopper 1.0.4)
# plug-ins: Groundhog

bounds = Curve(<curve referenced from the Rhino model>)
paths = Curve([<curve referenced from the Rhino model> x3])
areas = Curve([<curve referenced from the Rhino model> x2])
parametric_paths = ParametricPaths(C=paths, D=Slider(10000, range=0..10000))
pop2d = Populate2D(Region=bounds, Count=Slider(1000, range=0..1000), Seed=1)
crv = Curve(parametric_paths)

# ---- group: Remove points not in planted areas
incurve = PointInCurve(Point=pop2d, Curve=graft(areas))  # -> Relationship, Point
equals = Equality(FirstNumber=incurve.Relationship, SecondNumber=2)  # -> Equality, Inequality
cull = CullPattern(List=pop2d, CullPattern=equals.Equality)  # -> flatten(List)

# ---- group: Remove points on paths
incurve_2 = PointInCurve(Point=cull, Curve=graft(crv))  # -> Relationship, Point
equals_2 = Equality(FirstNumber=incurve_2.Relationship, SecondNumber=2)  # -> Equality, Inequality
cull_2 = CullPattern(List=cull, CullPattern=equals_2.Equality)
index = ItemIndex(List=cull, Item=cull_2)  # -> flatten(Index)
replace = ReplaceItems(List=cull, Indices=index, Wrap=False)
null = NullItem(Item=replace)  # -> NullFlags, InvalidFlags, Description
cull_3 = CullPattern(List=replace, CullPattern=invert(null.NullFlags))

# ----
generic_species = GenericSpeciesAttributes()  # -> ShrubP, GrassP, TreeP
lng = ListLength(List=cull_3)
lng_2 = ListLength(List=cull_3)
lng_3 = ListLength(List=cull_3)
multiplication = Multiplication(A=lng, B=Slider(0.5, range=0..1))
multiplication_2 = Multiplication(A=lng_2, B=Slider(0.5, range=0..1))
multiplication_3 = Multiplication(A=lng_3, B=Slider(0.5, range=0..1))
repeat = RepeatData(Data=generic_species.ShrubP, Length=multiplication)
repeat_2 = RepeatData(Data=generic_species.GrassP, Length=multiplication_2)
repeat_3 = RepeatData(Data=generic_species.TreeP, Length=multiplication_3)
data = Data([repeat, repeat_2, repeat_3])
pie = PieChart(data)
shower = PlantAppearanceSimulator(Plants=data, Locations=cull_3, Times=Slider(10, range=0..10))  # -> Trunk, Root, Crown, Spacing, Color, Label

# ---- group: Visualised crowns + tag species
darc = DeconstructArc(Arc=shower.Crown)  # -> BasePlane, Radius, Angle
tag = TextTag(Location=darc.BasePlane, Text=shower.Label, Colour=shower.Color)
preview = CustomPreview(Geometry=shower.Crown, Shader=shower.Color)

# ==== cluster ParametricPaths
D = ClusterInput()
C = ClusterInput()
multiplication = Multiplication(A=D, B=-1)
offset = Offset(Curve=C, Distance=multiplication, Plane=PlaneXY(0, 0, 0), Corners=1)
offset_2 = Offset(Curve=C, Distance=D, Plane=PlaneXY(0, 0, 0), Corners=1)
end = EndPoints(Curve=offset_2)  # -> Start, End
end_2 = EndPoints(Curve=offset)  # -> Start, End
ln = Line(StartPoint=end.Start, EndPoint=end_2.Start)
ln_2 = Line(StartPoint=end.End, EndPoint=end_2.End)
join = JoinCurves(Curves=[offset_2, offset, ln, ln_2], Preserve=False)  # -> flatten(Curves)
C_2 = ClusterOutput(join)
