# Grasshopper definition Groundhog - Channels Examples.ghx (Grasshopper 1.0.7)
# plug-ins: Groundhog

# ---- group: Channel Information
m = Slider(1000, range=0..1000)
area_m = Slider(13745, range=0..100000)
channel_open_planar_curve = Curve([<curve referenced from the Rhino model> x19])
multiplication = Multiplication(A=area_m, B=m)

# ----
number_of_profiles = Slider(6, range=0..10)
guide_curve = Curve(<curve referenced from the Rhino model>)
base_brep = Brep(<brep referenced from the Rhino model>)

# ---- group: Channel Information
# Groundhog Example File
# Definition prepared for Groundhog v0.10.2b and depends on components from that plugin. It is available for download at http://groundhog.la/
# 
# Contact groundhog@philipbelesky.com for support or feedback.
# 
# This is an example file related to the plugin's documentation.
# 
# This definition is licensed under the terms of the GPL v3 https://opensource.org/licenses/GPL-3.0
number_slider = Slider(3308527, range=0..10000000)

# ---- group: Profile Information
number_slider_2 = Slider(0.026, range=0..1)
number_slider_3 = Slider(0.01, range=0..1)

# ---- group: Calculate Water Channel
channel_region = ChannelRegion(Channel=channel_open_planar_curve, Area=multiplication)  # -> Channel, Area

# ---- group: Get Sections from Guide Curve
divide = DivideCurve(Curve=guide_curve, Count=number_of_profiles, Kinks=False)  # -> Points, Tangents, Parameters
pl = PlaneNormal(Origin=divide.Points, ZAxis=divide.Tangents)
sec = BrepPlane(Brep=base_brep, Plane=pl)  # -> flatten(Curves), Points

# ---- group: Calculate Characteristics of Given Channel
channel_profile = ChannelProfile(Channel=channel_region.Channel, Roughness=number_slider_2, Slope=number_slider_3)  # -> Area, MaxDepth, MeanDepth, WettedPerimeter, HydraulicRadius, Velocity, Discharge

# ---- group: Channel for Data Read Out
number_slider_4 = Slider(0, range=0..10)

# ---- group: Calculate Water Channel
channel_region_2 = ChannelRegion(Channel=sec.Curves, Area=number_slider)  # -> Channel, Area

# ---- group: Show profiles as solid
boundary_surfaces = BoundarySurfaces(Edges=[channel_region_2.Channel, channel_region.Channel])
custom_preview = CustomPreview(
    Geometry=boundary_surfaces,
    Shader={diffuse=RGB(255, 255, 255), emission=RGB(76, 76, 76), shine=0.5, specular=RGB(255, 255, 255), transparency=0})

# ---- group: Visualise Results of the First Area
list_item = ListItem(List=flatten(channel_profile.Area), Index=number_slider_4, Wrap=True)
point = Point(<point referenced from the Rhino model>)
point_2 = Point(<point referenced from the Rhino model>)
point_3 = Point(<point referenced from the Rhino model>)
list_item_2 = ListItem(List=flatten(channel_profile.MaxDepth), Index=number_slider_4, Wrap=True)
point_4 = Point(<point referenced from the Rhino model>)
list_item_3 = ListItem(List=flatten(channel_profile.WettedPerimeter), Index=number_slider_4, Wrap=True)
list_item_4 = ListItem(List=flatten(channel_profile.Discharge), Index=number_slider_4, Wrap=True)
point_5 = Point(<point referenced from the Rhino model>)
point_6 = Point(<point referenced from the Rhino model>)
list_item_5 = ListItem(List=flatten(channel_profile.MeanDepth), Index=number_slider_4, Wrap=True)
list_item_6 = ListItem(List=flatten(channel_profile.HydraulicRadius), Index=number_slider_4, Wrap=True)
list_item_7 = ListItem(List=flatten(channel_profile.Velocity), Index=number_slider_4, Wrap=True)
point_7 = Point(<point referenced from the Rhino model>)
xz_plane = XZPlane(Origin=point)
xz_plane_2 = XZPlane(Origin=point_3)
xz_plane_3 = XZPlane(Origin=point_5)
xz_plane_4 = XZPlane(Origin=point_2)
xz_plane_5 = XZPlane(Origin=point_4)
xz_plane_6 = XZPlane(Origin=point_6)
xz_plane_7 = XZPlane(Origin=point_7)

# ----
division = Division(A=list_item_3, B=1000)
division_2 = Division(A=list_item_2, B=1000)
division_3 = Division(A=list_item, B=1000000)
division_4 = Division(A=list_item_6, B=1000)
division_5 = Division(A=list_item_5, B=1000)
division_6 = Division(A=list_item_7, B=100)
division_7 = Division(A=list_item_4, B=100000000)

# ---- group: Visualise Results of the First Area (continued)
concatenate = Concatenate(FragmentA=division_2, FragmentB="m max depth")
concatenate_2 = Concatenate(FragmentA=division, FragmentB="m wetted perimeter")
concatenate_3 = Concatenate(FragmentA=division_5, FragmentB="m mean depth")
concatenate_4 = Concatenate(FragmentA=division_3, FragmentB="m2 area")
concatenate_5 = Concatenate(FragmentA=division_4, FragmentB="m hydraulic radius")
concatenate_6 = Concatenate(FragmentA=division_7, FragmentB="m3/s discharge volume ")
concatenate_7 = Concatenate(FragmentA=division_6, FragmentB="m/s mean flow velocity")
text_tag_3d = TextTag3D(Location=xz_plane, Text=concatenate, Size=1000, Colour=RGB(255, 255, 255), Justification=7)
text_tag_3d_2 = TextTag3D(Location=xz_plane_4, Text=concatenate_2, Size=1000, Colour=RGB(255, 255, 255), Justification=7)
text_tag_3d_3 = TextTag3D(Location=xz_plane_5, Text=concatenate_3, Size=1000, Colour=RGB(255, 255, 255), Justification=7)
text_tag_3d_4 = TextTag3D(Location=xz_plane_3, Text=concatenate_4, Size=1000, Colour=RGB(255, 255, 255), Justification=7)
text_tag_3d_5 = TextTag3D(Location=xz_plane_6, Text=concatenate_5, Size=1000, Colour=RGB(255, 255, 255), Justification=7)
text_tag_3d_6 = TextTag3D(Location=xz_plane_7, Text=concatenate_7, Size=1000, Colour=RGB(255, 255, 255), Justification=7)
text_tag_3d_7 = TextTag3D(Location=xz_plane_2, Text=concatenate_6, Size=1000, Colour=RGB(255, 255, 255), Justification=7)
