# Grasshopper definition Groundhog - Contour Examples.ghx (Grasshopper 0.9.76)
# plug-ins: Groundhog

bridging_distance = Slider(2000, range=0..10000)
sitebounds = Curve(<curve referenced from the Rhino model>)
# Groundhog Example File
# Definition prepared for Groundhog v0.7.2b and depends on components from that plugin. It is available for download at http://groundhog.la/
# 
# Contact groundhog@philipbelesky.com for support or feedback.
# 
# This is an example file related to the plugin's documentation.
# 
# This definition is licensed under the terms of the GPL v3 https://opensource.org/licenses/GPL-3.0
contours = Curve([<curve referenced from the Rhino model> x104])

join_curves = JoinCurves(Curves=contours, Preserve=False)

# ---- group: Check and make all contours planar
contour_planarity_fix = ContourPlanarityFix(ContourCurves=join_curves)  # -> AllContours, FixedContours

# ---- group: Attempt to bridge gaps between disjointed contours
contour_gap_fix = ContourGapFix(ContourCurves=contour_planarity_fix.AllContours, Boundary=sitebounds, MaximumDistance=bridging_distance)  # -> Contours, Joins

# ----
point_on_curve = PointOnCurve(contour_planarity_fix.FixedContours, parameter=0.5)
createplanes_can_be_slow = BooleanToggle(False)
planarised_contours = CustomPreview(Geometry=point_on_curve, Shader=ColourSwatch(SwatchColor=RGB(0, 255, 190)))

# ---- group: Clip contours to a given boundary
contour_clip = ContourClip(ContourCurves=contour_gap_fix.Contours, Boundary=sitebounds, CreatePlanarSrfs=createplanes_can_be_slow)  # -> Contours, EdgedContours, PlanarSurfaces

# ----
end_points = EndPoints(Curve=contour_gap_fix.Joins)  # -> Start, End
fixed_contours_in_bounds = Curve(contour_clip.Contours)
fixed_contours_to_and_around_bounds = Curve(contour_clip.EdgedContours)
bridged_gaps = CustomPreview(Geometry=[end_points.Start, end_points.End], Shader=ColourSwatch(SwatchColor=RGB(239, 255, 10)))
bridged_gaps_2 = CustomPreview(Geometry=fixed_contours_to_and_around_bounds, Shader=ColourSwatch(SwatchColor=RGB(250, 250, 250)))
