# Grasshopper definition Groundhog - Fields Examples.ghx (Grasshopper 0.9.76)
# plug-ins: Groundhog

desired_domain_start = Slider(0, range=0..100)
desired_domain_end = Slider(100, range=0..100)
visualisation_boundary = Curve(<curve referenced from the Rhino model>)

desired_domain_start_2 = Slider(25, range=0..100)
desired_domain_end_2 = Slider(50, range=0..100)

desired_domain_start_3 = Slider(50, range=0..100)
desired_domain_end_3 = Slider(100, range=0..100)

number_slider = Slider(25, range=0..100)
grid_boundary = Curve(<curve referenced from the Rhino model>)

grid_visualisation_boundary = Curve(<curve referenced from the Rhino model>)
analysed_geometry = Curve([<curve referenced from the Rhino model> x12])

# ----
# Groundhog Example File
# Definition prepared for Groundhog v0.7.1b and depends on components from that plugin. It is available for download at http://groundhog.la/
# 
# Contact groundhog@philipbelesky.com for support or feedback.
# 
# This is an example file related to the plugin's documentation.
# 
# This definition is licensed under the terms of the GPL v3 https://opensource.org/licenses/GPL-3.0
number_slider_2 = Slider(40, range=0..100)
grid_visualisation_boundary_2 = Curve(<curve referenced from the Rhino model>)
analysed_geometry_2 = Curve([<curve referenced from the Rhino model> x13])

geometry_pipeline = GeometryPipeline(
    GroupByLayer=False,
    GroupByType=False,
    IncludeHidden=True,
    IncludeLocked=True,
    LayerFilter="Data3",
    NameFilter="*",
    TypeFilter=4)
geometry_pipeline_2 = GeometryPipeline(
    GroupByLayer=False,
    GroupByType=False,
    IncludeHidden=True,
    IncludeLocked=True,
    LayerFilter="Data1",
    NameFilter="*",
    TypeFilter=4)
geometry_pipeline_3 = GeometryPipeline(
    GroupByLayer=False,
    GroupByType=False,
    IncludeHidden=True,
    IncludeLocked=True,
    LayerFilter="Data2",
    NameFilter="*",
    TypeFilter=4)

# ---- group: Translate geometry to field
field_mapper = FieldMapper(Bounds=grid_boundary, Divisions=number_slider, Areas=geometry_pipeline_2, ZRange=0)

field_mapper_2 = FieldMapper(Bounds=grid_boundary, Divisions=number_slider, Areas=geometry_pipeline_3, ZRange=0)

field_mapper_3 = FieldMapper(Bounds=grid_boundary, Divisions=number_slider, Areas=geometry_pipeline, ZRange=0)

field_mapper_4 = FieldMapper(
    Bounds=grid_visualisation_boundary,
    Divisions=Slider(25, range=0..100),
    Areas=analysed_geometry,
    ZRange=Slider(2000, range=0..10000))

field_mapper_5 = FieldMapper(Bounds=grid_visualisation_boundary_2, Divisions=number_slider_2, Areas=analysed_geometry_2, ZRange=0)

# ---- group: Translate field to circular grid visualisation
field_visualisation_grid = FieldVisualisationGrid(
    Field=field_mapper_5,
    Bounds=grid_visualisation_boundary_2,
    DomainStart=desired_domain_start_2,
    DomainEnd=desired_domain_end_2)  # -> Points, Parameters
circle_cnr = CircleCNR(Center=field_visualisation_grid.Points, Normal=Vector(0, 0, 1), Radius=field_visualisation_grid.Parameters)
gradient = Gradient(
    LowerLimit=desired_domain_start_2,
    UpperLimit=desired_domain_end_2,
    Parameter=field_visualisation_grid.Parameters,
    stops=[0: RGB(255, 255, 255), 1: RGB(0, 0, 0)])
custom_preview = CustomPreview(Geometry=circle_cnr, Shader=gradient)

# ---- group: Translate field to square grid visualisation
field_visualisation_grid_2 = FieldVisualisationGrid(Field=field_mapper_2, Bounds=visualisation_boundary, DomainStart=desired_domain_start, DomainEnd=desired_domain_end)  # -> Points, Parameters
make_filled_squares = MakeFilledSquares(field_points=field_visualisation_grid_2.Points, field_parameters=field_visualisation_grid_2.Parameters)
custom_preview_2 = CustomPreview(Geometry=make_filled_squares, Shader=ColourSwatch(SwatchColor=RGB(247, 7, 255)))

field_visualisation_grid_3 = FieldVisualisationGrid(Field=field_mapper_3, Bounds=visualisation_boundary, DomainStart=desired_domain_start, DomainEnd=desired_domain_end)  # -> Points, Parameters
make_offset_squares = MakeOffsetSquares(field_points=field_visualisation_grid_3.Points, field_parameters=field_visualisation_grid_3.Parameters)
custom_preview_3 = CustomPreview(Geometry=make_offset_squares, Shader=ColourSwatch(SwatchColor=RGB(28, 145, 255)))

# ---- group: Translate field to vector style visualisation
field_visualisation_grid_4 = FieldVisualisationGrid(
    Field=field_mapper_4,
    Bounds=grid_visualisation_boundary,
    DomainStart=desired_domain_start_3,
    DomainEnd=desired_domain_end_3)  # -> Points, Parameters
crete_vectors = CreteVectors(surface=field_mapper_4, point=field_visualisation_grid_4.Points, parameters=field_visualisation_grid_4.Parameters)
gradient_2 = Gradient(
    LowerLimit=desired_domain_start_3,
    UpperLimit=desired_domain_end_3,
    Parameter=field_visualisation_grid_4.Parameters,
    stops=[0: RGB(234, 38, 0), 0.25: RGB(234, 126, 0), 0.5: RGB(254, 244, 84), 0.75: RGB(173, 203, 249), 1: RGB(75, 107, 169)])
vector_display_ex = VectorDisplayEx(Point=field_visualisation_grid_4.Points, Vector=crete_vectors, Colour=gradient_2, Width=2)

# ---- group: Translate field to square grid visualisation
field_visualisation_grid_5 = FieldVisualisationGrid(Field=field_mapper, Bounds=visualisation_boundary, DomainStart=desired_domain_start, DomainEnd=desired_domain_end)  # -> Points, Parameters

# ----
make_basic_squares = MakeBasicSquares(field_points=field_visualisation_grid_5.Points, field_parameters=field_visualisation_grid_5.Parameters)

# ---- group: Translate field to square grid visualisation (continued)
custom_preview_4 = CustomPreview(Geometry=make_basic_squares, Shader=ColourSwatch(SwatchColor=RGB(209, 242, 0)))

# ==== cluster MakeFilledSquares
field_parameters = ClusterInput()
field_points = ClusterInput()

# ---- group: Remove 0-values
field_points_2 = Data(field_points)
field_parameters_2 = Data(field_parameters)
equality = Equality(FirstNumber=field_parameters_2, SecondNumber="0")  # -> Equality, Inequality
cull_pattern = CullPattern(List=field_parameters_2, CullPattern=equality.Inequality)
cull_pattern_2 = CullPattern(List=field_points_2, CullPattern=equality.Inequality)

# ----
field_values = Number(cull_pattern)
field_points_3 = Point(cull_pattern_2)

# ---- group: Make the squares
vector_xyz = VectorXYZ(XComponent=field_values, YComponent=field_values, ZComponent=0)  # -> Vector, Length
reverse = Reverse(Vector=vector_xyz.Vector)
move = Move(Geometry=field_points_3, Motion=reverse)  # -> Geometry, Transform
move_2 = Move(Geometry=field_points_3, Motion=vector_xyz.Vector)  # -> Geometry, Transform
rectangle_2pt = Rectangle2Pt(Plane=field_points_3, PointA=move_2.Geometry, PointB=move.Geometry, Radius=0)  # -> Rectangle, Length

# ---- group: Make solid surfaces
boundary_surfaces = BoundarySurfaces(Edges=rectangle_2pt.Rectangle)
surfaces = ClusterOutput(boundary_surfaces)

# ==== cluster MakeOffsetSquares
field_parameters = ClusterInput()
field_points = ClusterInput()

# ---- group: Remove 0-values
field_points_2 = Data(field_points)
field_parameters_2 = Data(field_parameters)
equality = Equality(FirstNumber=field_parameters_2, SecondNumber="0")  # -> Equality, Inequality
cull_pattern = CullPattern(List=field_parameters_2, CullPattern=equality.Inequality)
cull_pattern_2 = CullPattern(List=field_points_2, CullPattern=equality.Inequality)

# ----
field_points_3 = Point(cull_pattern_2)
field_values = Number(cull_pattern)

# ---- group: Make the squares
vector_xyz = VectorXYZ(XComponent=field_values, YComponent=field_values, ZComponent=0)  # -> Vector, Length
reverse = Reverse(Vector=vector_xyz.Vector)
move = Move(Geometry=field_points_3, Motion=reverse)  # -> Geometry, Transform
move_2 = Move(Geometry=field_points_3, Motion=vector_xyz.Vector)  # -> Geometry, Transform
rectangle_2pt = Rectangle2Pt(Plane=field_points_3, PointA=move_2.Geometry, PointB=move.Geometry, Radius=0)  # -> Rectangle, Length

# ---- group: Make the offsets
construct_domain = ConstructDomain(DomainStart=Slider(10, range=0..100), DomainEnd=Slider(40, range=0..100))
bounds = Bounds(Numbers=field_values)
remap_numbers = RemapNumbers(Value=field_values, Source=bounds, Target=construct_domain)  # -> Mapped, Clipped
multiplication = Multiplication(A=remap_numbers.Mapped, B="-1")
offset = Offset(Curve=rectangle_2pt.Rectangle, Distance=multiplication, Plane=PlaneXY(0, 0, 0), Corners=1)

# ---- group: Make solid surfaces
data = Data(simplify(graft(rectangle_2pt.Rectangle)))
data_2 = Data(simplify(offset))
data_3 = Data([data, data_2])
boundary_surfaces = BoundarySurfaces(Edges=data_3)
surfaces = ClusterOutput(boundary_surfaces)

# ==== cluster MakeBasicSquares
field_parameters = ClusterInput()
field_points = ClusterInput()

# ---- group: Remove 0-values
field_points_2 = Data(field_points)
field_parameters_2 = Data(field_parameters)
equality = Equality(FirstNumber=field_parameters_2, SecondNumber="0")  # -> Equality, Inequality
cull_pattern = CullPattern(List=field_points_2, CullPattern=equality.Inequality)

# ----
field_points_3 = Point(cull_pattern)

# ---- group: Make the squares
number_slider = Slider(20, range=0..100)
vector_xyz = VectorXYZ(XComponent=number_slider, YComponent=number_slider, ZComponent=0)  # -> Vector, Length
multiplication = Multiplication(A=vector_xyz.Vector, B="-1")
move = Move(Geometry=field_points_3, Motion=vector_xyz.Vector)  # -> Geometry, Transform
move_2 = Move(Geometry=field_points_3, Motion=multiplication)  # -> Geometry, Transform
rectangle_2pt = Rectangle2Pt(Plane=field_points_3, PointA=move.Geometry, PointB=move_2.Geometry, Radius=0)  # -> Rectangle, Length

# ---- group: Make solid surfaces
boundary_surfaces = BoundarySurfaces(Edges=rectangle_2pt.Rectangle)
surfaces = ClusterOutput(boundary_surfaces)

# ==== cluster CreteVectors
surface = ClusterInput()
point = ClusterInput()
parameters = ClusterInput()
surface_2 = Surface(surface)
parameters_2 = Data(parameters)
surface_closest_point = SurfaceClosestPoint(Point=point, Surface=surface_2)  # -> Point, UVPoint, Distance
evaluate_surface = EvaluateSurface(Surface=surface_2, Point=surface_closest_point.UVPoint)  # -> Point, Normal, Frame
deconstruct = Deconstruct(Point=evaluate_surface.Normal)  # -> XComponent, YComponent, ZComponent
vector_xyz = VectorXYZ(XComponent=deconstruct.XComponent, YComponent=deconstruct.YComponent, ZComponent=0)  # -> Vector, Length
multiplication = Multiplication(A=vector_xyz.Vector, B=parameters_2)
reverse = Reverse(Vector=multiplication)
vector = ClusterOutput(reverse)
