# Grasshopper definition Groundhog - Flow Catchment Examples.ghx (Grasshopper 1.0.7)
# plug-ins: Groundhog

total_flow_volume_total = Slider(1000, range=100..1000)
proximity_threshold = Slider(97, range=0..200)
flow_step_size = Slider(25, range=0..100)
# Example 2 (Right)
grid_divisions = Slider(25, range=0..100)

flow_step_size_2 = Slider(25, range=0..100)
# Example 1 (Left)
u_count = Slider(20, range=0..50)
v_count = Slider(20, range=0..50)

# ---- group: Base Surface
# Groundhog Example File
# Definition prepared for Groundhog v0.13.0 and depends on components from that plugin. It is available for download at http://groundhog.philipbelesky.com/
# 
# Contact groundhog@philipbelesky.com for support or feedback.
# 
# This is an example file related to the plugin's documentation.
surface = Surface(<surface referenced from the Rhino model>)

# ---- group: Base Mesh
mesh = Mesh(<mesh referenced from the Rhino model>)

# ---- group: Create point grid for path starts
divide_surface = DivideSurface(Surface=surface, UCount=u_count, VCount=v_count)  # -> flatten(Points), Normals, Parameters

# ---- group: Distribute points across mesh using grid
cluster = Cluster(u_count=grid_divisions, v_count=grid_divisions, C=mesh)

# ---- group: Calculate the flow paths (for mesh)
flow_projection_mesh = FlowSimulationMesh(Mesh=mesh, Points=cluster, Fidelity=flow_step_size, Steps=0, Thread=False)  # -> FlowPoints, FlowPaths

# ---- group: Calculate the flow paths (for surface)
flow_projection_surface = FlowProjectionSurface(Surface=surface, Points=divide_surface.Points, Fidelity=0, Steps=flow_step_size_2, Thread=False)  # -> FlowPoints, FlowPaths

# ---- group: Calculate catchment bounds
flow_catchments = FlowCatchments(FlowPaths=flow_projection_surface.FlowPaths, ProximityThreshold=250)  # -> Catchments, FlowPaths, ColorCodes, Volumes

flow_catchments_2 = FlowCatchments(FlowPaths=flow_projection_mesh.FlowPaths, ProximityThreshold=proximity_threshold)  # -> Catchments, FlowPaths, ColorCodes, Volumes

# ----
flow_paths = Data(flow_catchments.FlowPaths)
catchments = Data(flow_catchments_2.Catchments)
flow_paths_2 = Curve(flow_catchments_2.FlowPaths)
colours = Data(flow_catchments_2.ColorCodes)

# ---- group: Find average endpoint within a catchment
flow_paths_3 = Curve(flow_catchments_2.FlowPaths)
end_points = EndPoints(Curve=flow_paths_3)  # -> Start, End
deconstruct = Deconstruct(Point=end_points.End)  # -> XComponent, YComponent, ZComponent
mass_addition = MassAddition(Input=deconstruct.YComponent)  # -> Result, PartialResults
mass_addition_2 = MassAddition(Input=deconstruct.XComponent)  # -> Result, PartialResults
list_length = ListLength(List=deconstruct.XComponent)
mass_addition_3 = MassAddition(Input=deconstruct.ZComponent)  # -> Result, PartialResults
division = Division(A=mass_addition_3.Result, B=list_length)
division_2 = Division(A=mass_addition_2.Result, B=list_length)
division_3 = Division(A=mass_addition.Result, B=list_length)
construct_point = ConstructPoint(XCoordinate=division_2, YCoordinate=division_3, ZCoordinate=division)

# ---- group: Label each catchment center by the volume of water collected
flow_volumes = Number(flow_catchments_2.Volumes)
flow_volumes_total = Number(total_flow_volume_total)
colours_2 = Data(flow_catchments_2.ColorCodes)
multiplication = Multiplication(A=flow_volumes, B=flow_volumes_total)
round = Round(Number=multiplication)  # -> Nearest, Floor, Ceiling
concatenate = Concatenate(FragmentA=round.Nearest, FragmentB=" litres")
label_szie = Slider(40, range=0..100)
label_color = ColourSwatch(SwatchColor=RGB(255, 255, 255))
text_tag_3d = TextTag3D(Location=construct_point, Text=concatenate, Size=label_szie, Colour=label_color, Justification=7)
custom_preview = CustomPreview(Geometry=construct_point, Material=colours_2)

# ---- group: Color code catchment boundaries
catchments_2 = Data(flow_catchments.Catchments)
catchment_alpha = Slider(0.5, range=0..1)
colours_3 = Data(flow_catchments.ColorCodes)
split_ahsl = SplitAHSL(Colour=colours_3)  # -> Alpha, Hue, Saturation, Luminance
colour_hsl = ColourHSL(Alpha=catchment_alpha, Hue=split_ahsl.Hue, Saturation=split_ahsl.Saturation, Luminance=split_ahsl.Luminance)
boundary_surfaces = BoundarySurfaces(Edges=catchments_2)
custom_preview_2 = CustomPreview(Geometry=boundary_surfaces, Shader=colour_hsl)

# ----
custom_preview_3 = CustomPreview(Geometry=flow_paths, Shader=ColourSwatch(SwatchColor=RGB(0, 0, 0)))

# ---- group: Color code flow paths by catchment
custom_preview_4 = CustomPreview(Geometry=flow_paths_2, Shader=colours)

# ---- group: Color code catchment boundaries
custom_preview_5 = CustomPreview(Geometry=catchments, Shader=colours)

# ==== cluster Cluster
C = ClusterInput()
bbox = BoundingBox(Content=C, Plane=PlaneXY(0, 0, 0))  # -> Box, Box_2
debrep = DeconstructBrep(Brep=bbox.Box)  # -> Faces, Edges, Vertices
u_count = ClusterInput()
v_count = ClusterInput()
item = ListItem(List=debrep.Faces, Index=Slider(5, range=0..10), Wrap=True)
divide_surface = DivideSurface(Surface=item, UCount=u_count, VCount=v_count)  # -> Points, Normals, Parameters
project = ProjectPoint(Point=flatten(divide_surface.Points), Direction=Vector(0, 0, -1), Geometry=C)  # -> Point, Index
clean_tree = CleanTree(RemoveNulls=True, RemoveInvalid=True, RemoveEmpty=False, Tree=project.Point)
tree = ClusterOutput(clean_tree)
