# Grasshopper definition Groundhog - Flow Saturation Examples.ghx (Grasshopper 1.0.7)
# plug-ins: Groundhog, Kangaroo2 Components

volume_lost_per_segment = Slider(0.05, range=0..0.1)
flow_volume_per_path = Slider(100, range=0..1000)
# Example 2 (Center)
u_count = Slider(20, range=0..50)
v_count = Slider(20, range=0..50)
grid_fidelity = Slider(25, range=0..100)
flow_fidelity = Slider(100, range=0..100)

volume_lost_per_segment_2 = Slider(0.16, range=0..0.5)
catchment_proximities = Slider(100, range=0..10000)
flow_volume_per_path_2 = Slider(100, range=0..1000)
# Example 3 (Lower-Right)
u_count_2 = Slider(30, range=0..50)
v_count_2 = Slider(30, range=0..50)
flow_fidelity_2 = Slider(50, range=0..100)
grid_fidelity_2 = Slider(20, range=0..100)

flow_fidelity_3 = Slider(100, range=0..100)
# Example 1 (Upper-Left)
u_count_3 = Slider(20, range=0..50)
v_count_3 = Slider(20, range=0..50)
grid_fidelity_3 = Slider(25, range=0..100)

# ---- group: Base Surface
# Groundhog Example File
# Definition prepared for Groundhog v0.13.0 and depends on components from that plugin. It is available for download at http://groundhog.philipbelesky.com/
# 
# Contact groundhog@philipbelesky.com for support or feedback.
# 
# This is an example file related to the plugin's documentation.
surface = Surface(<surface referenced from the Rhino model>)

surface_2 = Surface(<surface referenced from the Rhino model>)

surface_3 = Surface(<surface referenced from the Rhino model>)

# ---- group: Create point grid for path starts
divide_surface = DivideSurface(Surface=surface_3, UCount=u_count_2, VCount=v_count_2)  # -> flatten(Points), Normals, Parameters

# ---- group: Make surface into a quad mesh for more even analytic overlay
mesh_surface = MeshSurface(Surface=surface_3, UCount=grid_fidelity_2, VCount=grid_fidelity_2, Overhang=True, Equalize=False)

# ---- group: Create point grid for path starts
divide_surface_2 = DivideSurface(Surface=surface_2, UCount=u_count, VCount=v_count)  # -> flatten(Points), Normals, Parameters

# ---- group: Make surface into a quad mesh for more even analytic overlay
mesh_surface_2 = MeshSurface(Surface=surface, UCount=grid_fidelity_3, VCount=grid_fidelity_3, Overhang=True, Equalize=False)

# ---- group: Create point grid for path starts
divide_surface_3 = DivideSurface(Surface=surface, UCount=u_count_3, VCount=v_count_3)  # -> flatten(Points), Normals, Parameters

# ---- group: Make surface into a quad mesh for more even analytic overlay
mesh_surface_3 = MeshSurface(Surface=surface_2, UCount=grid_fidelity, VCount=grid_fidelity, Overhang=True, Equalize=False)

# ---- group: Calculate the flow paths (for surface)
flow_projection_surface = FlowProjectionSurface(Surface=surface_2, Points=divide_surface_2.Points, Fidelity=flow_fidelity, Steps=0, Thread=False)  # -> FlowPoints, FlowPaths

flow_projection_surface_2 = FlowProjectionSurface(Surface=surface_3, Points=divide_surface.Points, Fidelity=flow_fidelity_2, Steps=0, Thread=False)  # -> FlowPoints, FlowPaths

flow_projection_surface_3 = FlowProjectionSurface(Surface=surface, Points=divide_surface_3.Points, Fidelity=flow_fidelity_3, Steps=0, Thread=False)  # -> FlowPoints, FlowPaths

# ---- group: Calculate the flow path saturations
flow_saturation = FlowSaturation(
    Mesh=mesh_surface_3,
    FlowPaths=flow_projection_surface.FlowPaths,
    StartVolume=flow_volume_per_path,
    SegmentLoss=volume_lost_per_segment)  # -> FlowOverlaps, FlowVolumes, MeshFaces, FaceCenters, PathVolumes

flow_saturation_2 = FlowSaturation(Mesh=mesh_surface_2, FlowPaths=flow_projection_surface_3.FlowPaths)  # -> FlowOverlaps, FlowVolumes, MeshFaces, FaceCenters, PathVolumes

# ---- group: Find closest saturation volumes for each flow path point
flow_paths = Curve(flow_projection_surface_2.FlowPaths)
flow_saturation_3 = FlowSaturation(Mesh=mesh_surface, FlowPaths=flow_paths, StartVolume=flow_volume_per_path_2, SegmentLoss=volume_lost_per_segment_2)  # -> FlowOverlaps, FlowVolumes, MeshFaces, FaceCenters, PathVolumes
flow_volumes_across_mesh_faces = Number(flow_saturation_3.FlowVolumes)
mesh_faces = Mesh(flow_saturation_3.MeshFaces)

# ----
number_slider = Slider(2, range=0..10)

# ---- group: Determine catchments and cull catchments with few paths
flow_paths_2 = Curve(flow_projection_surface_2.FlowPaths)
catchment_proximities_2 = Number(catchment_proximities)
flow_catchments = FlowCatchments(FlowPaths=flow_paths_2, ProximityThreshold=catchment_proximities_2)  # -> Catchments, FlowPaths, ColorCodes, Volumes
prune_tree = PruneTree(Tree=flow_catchments.ColorCodes, Minimum=number_slider, Maximum=0)
prune_tree_2 = PruneTree(Tree=flow_catchments.FlowPaths, Minimum=number_slider, Maximum=0)
colours_by_catchment = Colour(prune_tree)
flow_paths_by_catchment = Curve(prune_tree_2)
custom_preview = CustomPreview(Geometry=flow_catchments.FlowPaths, Material=flow_catchments.ColorCodes)
custom_preview_2 = CustomPreview(Geometry=flow_catchments.Catchments, Material=flow_catchments.ColorCodes)

# ---- group: Color the surface with the flow volume result
upper_clamp = Slider(456, range=0..1000)
flow_paths_3 = Curve(flow_projection_surface_3.FlowPaths)
mesh_faces_2 = Mesh(mesh_surface_2)
flow_volumes = Number(flow_saturation_2.FlowVolumes)
unit_z = UnitZ(Factor=5)
bounds = Bounds(Numbers=flow_volumes)
gradient = Gradient(LowerLimit=0, UpperLimit=upper_clamp, Parameter=flow_volumes, stops=[0: RGB(255, 0, 255), 1: RGB(0, 169, 255)])
move = Move(Geometry=flow_paths_3, Motion=unit_z)  # -> Geometry, Transform
panel = Panel(bounds)
mesh_color_by_face = MeshColorByFace(Mesh=mesh_faces_2, Colors=gradient)
custom_preview_3 = CustomPreview(Geometry=move.Geometry, Material=ColourSwatch(SwatchColor=RGB(255, 255, 255)))

# ---- group: Label locations with volumes
offset = Slider(25, range=0..50)
flow_volumes_2 = Number(flow_saturation.FlowVolumes)
face_centers = Point(flow_saturation.FaceCenters)
concatenate = Concatenate(FragmentA=flow_volumes_2, FragmentB="L")
vector_xyz = VectorXYZ(XComponent=offset, YComponent=offset, ZComponent=0)  # -> Vector, Length
move_2 = Move(Geometry=face_centers, Motion=vector_xyz.Vector)  # -> Geometry, Transform
text_size = Slider(25, range=0..100)
text_tag_3d = TextTag3D(
    Location=move_2.Geometry,
    Text=concatenate,
    Size=text_size,
    Colour=ColourSwatch(SwatchColor=RGB(255, 255, 255)),
    Justification=7)

# ---- group: Show water volumes as cylinders of variable height
min_height = Slider(5, range=0..50)
max_height = Slider(1000, range=0..1000)
radius = Slider(25, range=0..50)
face_centers_2 = Point(flow_saturation.FaceCenters)
flow_volumes_3 = Number(flow_saturation.FlowVolumes)
bounds_2 = Bounds(Numbers=flow_volumes_3)
construct_domain = ConstructDomain(DomainStart=min_height, DomainEnd=max_height)
remap_numbers = RemapNumbers(Value=flow_volumes_3, Source=bounds_2, Target=construct_domain)  # -> Mapped, Clipped
cylinder = Cylinder(Base=face_centers_2, Radius=radius, Length=remap_numbers.Mapped)
custom_preview_4 = CustomPreview(Geometry=cylinder, Material=ColourSwatch(SwatchColor=RGB(0, 57, 255)))

# ----
remove_first_x_segments = Slider(5, range=0..10)
flow_paths_by_catchment_2 = Curve(flow_paths_by_catchment)
explode = Explode(Curve=flow_paths_by_catchment_2, Recursive=True)  # -> Segments, Vertices
shift_list = ShiftList(List=explode.Vertices, Shift=remove_first_x_segments, Wrap=False)  # -> simplify(List)
shift_list_2 = ShiftList(List=shift_list, Shift=-1, Wrap=False)
list_item = ListItem(List=shift_list_2, Index=-1, Wrap=True)
list_item_2 = ListItem(List=shift_list_2, Index=0, Wrap=True)
trim_tree = TrimTree(Tree=list_item, Depth=2)
trim_tree_2 = TrimTree(Tree=list_item_2, Depth=2)
points_but_not_end_points_per_flow_paths = Point(shift_list_2)
_2nd_to_last_flow_points_per_flow_paths = Point(trim_tree)
start_points_per_flow_paths = Point(trim_tree_2)

# ---- group: get average endpoint in catchment
# We go through all this trouble to create a 'fake' end point so that all the paths terminate in the same location. This is necessary for the shortest path calculation to then re-traverse the points (since merged when close) to create unified 'branches'
flow_paths_by_catchment_3 = Curve(flow_paths_by_catchment)
# TODO: skip the first X points of flow path (make like image)
end_points = EndPoints(Curve=flow_paths_by_catchment_3)  # -> Start, End
deconstruct = Deconstruct(Point=end_points.End)  # -> XComponent, YComponent, ZComponent
mass_addition = MassAddition(Input=deconstruct.XComponent)  # -> Result, PartialResults
mass_addition_2 = MassAddition(Input=deconstruct.YComponent)  # -> Result, PartialResults
list_length = ListLength(List=end_points.End)
division = Division(A=mass_addition.Result, B=list_length)
division_2 = Division(A=mass_addition_2.Result, B=list_length)
construct_point = ConstructPoint(XCoordinate=division, YCoordinate=division_2, ZCoordinate=0)
end_points_per_catcment = Point(construct_point)

# ---- group: Ccull points that are within a certain distance so the flow paths appear to unify
flow_volume_per_path_3 = Number(flow_volume_per_path_2)
points_but_not_end_points_per_flow_paths_2 = Point(points_but_not_end_points_per_flow_paths)
trim_tree_3 = TrimTree(Tree=points_but_not_end_points_per_flow_paths_2, Depth=2)
multiplication = Multiplication(A=flow_volume_per_path_3, B=Slider(0.2, range=0..1))
cull_duplicates = CullDuplicates(Points=trim_tree_3, Tolerance=multiplication, CullMode=1)  # -> Points, Indices, Valence

# ----
merge_radius = Number(Slider(100, range=0..100))

# ---- group: To unifiy the flow paths when the 'stream' together we rebuild a proximity network then find the shortest path from the flow origins to the shared end pts
merge_radius_2 = Number(merge_radius)
end_points_per_catcment_2 = Point(end_points_per_catcment)
start_points_per_flow_paths_2 = Point(start_points_per_flow_paths)
unique_flow_points_per_catchment = Point(cull_duplicates.Points)
_2nd_to_last_flow_points_per_flow_paths_2 = Point(_2nd_to_last_flow_points_per_flow_paths)
proximity_2d = Proximity2D(Points=unique_flow_points_per_catchment, Plane=PlaneXY(0, 0, 0), Group=5, MaxRadius=merge_radius_2)  # -> Links, Topology
line = Line(StartPoint=_2nd_to_last_flow_points_per_flow_paths_2, EndPoint=end_points_per_catcment_2)
trim_tree_4 = TrimTree(Tree=proximity_2d.Links, Depth=2)
removeduplicatelines = RemoveDuplicateLines(Lines=[trim_tree_4, line], Tolerance=0.01)
shortest_path = ShortestPath(Curves=removeduplicatelines, Starts=start_points_per_flow_paths_2, Ends=end_points_per_catcment_2)  # -> ShortestPath, Succession, Direction, Length
unified_flow_curves = Curve(shortest_path.ShortestPath)

# ---- group: Find closest flow volume at each point along the unified flow paths
mesh_faces_3 = Mesh(mesh_faces)
unified_flow_curves_2 = Curve(unified_flow_curves)
flow_volumes_across_mesh_faces_2 = Number(flow_volumes_across_mesh_faces)
face_normals = FaceNormals(Mesh=mesh_faces_3)  # -> Centers, Normals
project = Project(Geometry=unified_flow_curves_2, Plane=PlaneXY(0, 0, 0))  # -> Geometry, Transform
deconstruct_2 = Deconstruct(Point=face_normals.Centers)  # -> XComponent, YComponent, ZComponent
explode_2 = Explode(Curve=project.Geometry, Recursive=True)  # -> Segments, Vertices
construct_point_2 = ConstructPoint(XCoordinate=deconstruct_2.XComponent, YCoordinate=deconstruct_2.YComponent, ZCoordinate=0)
point_on_curve = PointOnCurve(explode_2.Segments, parameter=0.5)
closest_point = ClosestPoint(Point=point_on_curve, Cloud=flatten(construct_point_2))  # -> ClosestPoint, CPIndex, Distance
list_item_3 = ListItem(List=flow_volumes_across_mesh_faces_2, Index=closest_point.CPIndex, Wrap=True)
volumes_per_flow_path_point = Data(list_item_3)
flattened_flow_curves = Curve(project.Geometry)

# ---- group: Convert flow volumes at each point to the width of the flow segment within the path
min_offset_radius = Slider(1, range=0..10)
max_offset_radius = Slider(50, range=0..100)
flattened_flow_curves_2 = Curve(flattened_flow_curves)
volumes_per_flow_path_point_2 = Data(volumes_per_flow_path_point)
bounds_3 = Bounds(Numbers=flatten(volumes_per_flow_path_point_2))
construct_domain_2 = ConstructDomain(DomainStart=min_offset_radius, DomainEnd=max_offset_radius)
remap_numbers_2 = RemapNumbers(Value=volumes_per_flow_path_point_2, Source=bounds_3, Target=construct_domain_2)  # -> Mapped, Clipped
variable_offset = VariableOffset(curves=flattened_flow_curves_2, offsets=remap_numbers_2.Mapped, rounded=True)
curve = Curve(variable_offset)

# ---- group: Make paths into surfaces and color by catchment
curve_2 = Curve(curve)
colours_by_catchment_2 = Colour(colours_by_catchment)
boundary_surfaces = BoundarySurfaces(Edges=curve_2)
trim_tree_5 = TrimTree(Tree=boundary_surfaces, Depth=Slider(2, range=0..10))
custom_preview_5 = CustomPreview(Geometry=simplify(trim_tree_5), Material=simplify(colours_by_catchment_2))

# ==== cluster VariableOffset
rounded = ClusterInput()
curves = ClusterInput()
offsets = ClusterInput()
rounded_2 = Boolean(rounded)
curves_2 = Curve(curves)
offsets_2 = Number(offsets)
rounded_3 = Boolean(rounded_2)

# ---- group: Offset directions
explode = Explode(Curve=curves_2, Recursive=True)  # -> Segments, Vertices
end = EndPoints(Curve=explode.Segments)  # -> Start, End
Z = UnitZ(Factor=1)
vec2pt = Vector2Pt(PointA=end.Start, PointB=end.End, Unitize=True)  # -> Vector, Length
xprod = CrossProduct(VectorA=vec2pt.Vector, VectorB=Z, Unitize=False)  # -> Vector, Length

# ----
multiplication = Multiplication(A=xprod.Vector, B=offsets_2)
rev = Reverse(Vector=multiplication)
move = Move(Geometry=explode.Vertices, Motion=rev)  # -> Geometry, Transform
move_2 = Move(Geometry=explode.Vertices, Motion=multiplication)  # -> Geometry, Transform
pline = PolyLine(Vertices=move.Geometry, Closed=False)
pline_2 = PolyLine(Vertices=move_2.Geometry, Closed=False)
end_2 = EndPoints(Curve=pline)  # -> Start, End
end_3 = EndPoints(Curve=pline_2)  # -> Start, End

# ---- group: Make rounded ends
Z_2 = UnitZ(Factor=1)
Z_3 = UnitZ(Factor=1)
vec2pt_2 = Vector2Pt(PointA=end_2.Start, PointB=end_3.Start, Unitize=True)  # -> Vector, Length
vec2pt_3 = Vector2Pt(PointA=end_3.End, PointB=end_2.End, Unitize=True)  # -> Vector, Length
xprod_2 = CrossProduct(VectorA=vec2pt_2.Vector, VectorB=Z_2, Unitize=False)  # -> Vector, Length
xprod_3 = CrossProduct(VectorA=vec2pt_3.Vector, VectorB=Z_3, Unitize=False)  # -> Vector, Length
arc = ArcSED(Start=end_3.Start, End=end_2.Start, Direction=xprod_2.Vector)  # -> Arc, Plane, Radius
arc_2 = ArcSED(Start=end_3.End, End=end_2.End, Direction=xprod_3.Vector)  # -> Arc, Plane, Radius

# ---- group: Make flat ends
ln = Line(StartPoint=end_3.Start, EndPoint=end_2.Start)
ln_2 = Line(StartPoint=end_2.End, EndPoint=end_3.End)

# ----
p_n_c = PickNChoose(Pattern=[rounded_2, rounded_3], Stream0=[ln, ln_2], Stream1=[arc.Arc, arc_2.Arc])
join = JoinCurves(Curves=[pline_2, pline, p_n_c], Preserve=False)
C = ClusterOutput(join)
