# Grasshopper definition Groundhog - Flow Saturation by Branch.ghx (Grasshopper 1.0.7)
# plug-ins: Groundhog

volume_lost_per_segment = Slider(0.05, range=0..0.1)
flow_volume_per_path = Slider(100, range=0..1000)
# Example 2 (Center)
u_count = Slider(20, range=0..50)
v_count = Slider(20, range=0..50)
grid_fidelity = Slider(25, range=0..100)
flow_fidelity = Slider(100, range=0..100)

volume_lost_per_segment_2 = Slider(0.15, range=0..0.5)
flow_volume_per_path_2 = Slider(100, range=0..1000)
catchment_proximities = Slider(100, range=0..10000)
grid_fidelity_2 = Slider(20, range=0..100)
# Example 3 (Lower-Right)
u_count_2 = Slider(20, range=0..50)
v_count_2 = Slider(20, range=0..50)
flow_fidelity_2 = Slider(25, range=0..100)

flow_fidelity_3 = Slider(100, range=0..100)
# Example 1 (Upper-Left)
u_count_3 = Slider(20, range=0..50)
v_count_3 = Slider(20, range=0..50)
grid_fidelity_3 = Slider(25, range=0..100)

# ---- group: Base Surface
# Groundhog Example File
# Definition prepared for Groundhog v0.12.0b and depends on components from that plugin. It is available for download at http://groundhog.la/
# 
# Contact groundhog@philipbelesky.com for support or feedback.
# 
# This is an example file related to the plugin's documentation.
surface = Surface(<surface referenced from the Rhino model>)

surface_2 = Surface(<surface referenced from the Rhino model>)

surface_3 = Surface(<surface referenced from the Rhino model>)

# ---- group: Create point grid for path starts
divide_surface = DivideSurface(Surface=surface_3, UCount=u_count_2, VCount=v_count_2)  # -> flatten(Points), Normals, Parameters

# ---- group: Make surface into a quad mesh for more even analytic overlay
mesh_surface = MeshSurface(Surface=surface_3, UCount=grid_fidelity_2, VCount=grid_fidelity_2, Overhang=True, Equalize=False)

# ---- group: Create point grid for path starts
divide_surface_2 = DivideSurface(Surface=surface_2, UCount=u_count, VCount=v_count)  # -> flatten(Points), Normals, Parameters

# ---- group: Make surface into a quad mesh for more even analytic overlay
mesh_surface_2 = MeshSurface(Surface=surface, UCount=grid_fidelity_3, VCount=grid_fidelity_3, Overhang=True, Equalize=False)

# ---- group: Create point grid for path starts
divide_surface_3 = DivideSurface(Surface=surface, UCount=u_count_3, VCount=v_count_3)  # -> flatten(Points), Normals, Parameters

# ---- group: Make surface into a quad mesh for more even analytic overlay
mesh_surface_3 = MeshSurface(Surface=surface_2, UCount=grid_fidelity, VCount=grid_fidelity, Overhang=True, Equalize=False)

# ---- group: Calculate the flow paths (for surface)
flow_projection_surface = FlowProjectionSurface(Surface=surface_2, Points=divide_surface_2.Points, Fidelity=flow_fidelity, Steps=0, Thread=False)  # -> FlowPoints, FlowPaths

flow_projection_surface_2 = FlowProjectionSurface(Surface=surface_3, Points=divide_surface.Points, Fidelity=flow_fidelity_2, Steps=0, Thread=False)  # -> FlowPoints, FlowPaths

flow_projection_surface_3 = FlowProjectionSurface(Surface=surface, Points=divide_surface_3.Points, Fidelity=flow_fidelity_3, Steps=0, Thread=False)  # -> FlowPoints, FlowPaths

# ---- group: Find closest saturation volumes for each flow path point
flow_saturation = FlowSaturation(
    Mesh=mesh_surface,
    FlowPaths=flow_projection_surface_2.FlowPaths,
    StartVolume=flow_volume_per_path_2,
    SegmentLoss=volume_lost_per_segment_2)  # -> FlowOverlaps, FlowVolumes, MeshFaces, FaceCenters, PathVolumes
flow_volumes_per_point = Number(flow_saturation.PathVolumes)

# ---- group: Calculate the flow path saturations
flow_saturation_2 = FlowSaturation(
    Mesh=mesh_surface_3,
    FlowPaths=flow_projection_surface.FlowPaths,
    StartVolume=flow_volume_per_path,
    SegmentLoss=volume_lost_per_segment)  # -> FlowOverlaps, FlowVolumes, MeshFaces, FaceCenters, PathVolumes

flow_saturation_3 = FlowSaturation(Mesh=mesh_surface_2, FlowPaths=flow_projection_surface_3.FlowPaths)  # -> FlowOverlaps, FlowVolumes, MeshFaces, FaceCenters, PathVolumes

# ---- group: Work backwards from per-point loss volumes to calculate total volume remaining at that time
flow_volumes_per_point_2 = Number(flow_volumes_per_point)
flow_volume_per_path_3 = Number(flow_volume_per_path_2)
list_length = ListLength(List=flow_volumes_per_point_2)
series = Series(Start=0, Step=1, Count=list_length)
sub_list = SubList(List=flow_volumes_per_point_2, Domain=series, Wrap=True)  # -> List, Index
mass_addition = MassAddition(Input=sub_list.List)  # -> Result, PartialResults
subtraction = Subtraction(A=flow_volume_per_path_3, B=mass_addition.Result)
trim_tree = TrimTree(Tree=subtraction, Depth=1)
remaining_volumes_per_point = Data(trim_tree)

# ---- group: Color the surface with the flow volume result
flow_volumes = Number(flow_saturation_3.FlowVolumes)
mesh_faces = Mesh(flow_saturation_3.MeshFaces)
upper_clamp = Slider(456, range=0..1000)
flow_paths = Curve(flow_projection_surface_3.FlowPaths)
unit_z = UnitZ(Factor=5)
bounds = Bounds(Numbers=flow_volumes)
gradient = Gradient(LowerLimit=0, UpperLimit=upper_clamp, Parameter=flow_volumes, stops=[0: RGB(255, 0, 255), 1: RGB(0, 169, 255)])
move = Move(Geometry=flow_paths, Motion=unit_z)  # -> Geometry, Transform
panel = Panel(bounds)
mesh_colours = MeshColours(Mesh=simplify(graft(mesh_faces)), Colours=simplify(graft(gradient)))
custom_preview = CustomPreview(Geometry=move.Geometry, Material=ColourSwatch(SwatchColor=RGB(255, 255, 255)))

# ---- group: Label locations with volumes
flow_volumes_2 = Number(flow_saturation_2.FlowVolumes)
offset = Slider(25, range=0..50)
face_centers = Point(flow_saturation_2.FaceCenters)
concatenate = Concatenate(FragmentA=flow_volumes_2, FragmentB="L")
vector_xyz = VectorXYZ(XComponent=offset, YComponent=offset, ZComponent=0)  # -> Vector, Length
move_2 = Move(Geometry=face_centers, Motion=vector_xyz.Vector)  # -> Geometry, Transform
text_size = Slider(25, range=0..100)
text_tag_3d = TextTag3D(
    Location=move_2.Geometry,
    Text=concatenate,
    Size=text_size,
    Colour=ColourSwatch(SwatchColor=RGB(255, 255, 255)),
    Justification=7)

# ---- group: Show water volumes as cylinders of variable height
min_height = Slider(5, range=0..50)
max_height = Slider(1000, range=0..1000)
radius = Slider(25, range=0..50)
flow_volumes_3 = Number(flow_saturation_2.FlowVolumes)
face_centers_2 = Point(flow_saturation_2.FaceCenters)
bounds_2 = Bounds(Numbers=flow_volumes_3)
construct_domain = ConstructDomain(DomainStart=min_height, DomainEnd=max_height)
remap_numbers = RemapNumbers(Value=flow_volumes_3, Source=bounds_2, Target=construct_domain)  # -> Mapped, Clipped
cylinder = Cylinder(Base=face_centers_2, Radius=radius, Length=remap_numbers.Mapped)
custom_preview_2 = CustomPreview(Geometry=cylinder, Material=ColourSwatch(SwatchColor=RGB(0, 57, 255)))

# ---- group: Map volume Ranges to Sensible Radii Values
remaining_volumes_per_point_2 = Data(remaining_volumes_per_point)
largest_offset_radius = Slider(33, range=0..100)
smallest_offset_radius = Slider(0, range=0..10)
construct_domain_2 = ConstructDomain(DomainStart=smallest_offset_radius, DomainEnd=largest_offset_radius)
bnd = Bounds(Numbers=flatten(remaining_volumes_per_point_2))
remap_numbers_2 = RemapNumbers(Value=remaining_volumes_per_point_2, Source=bnd, Target=construct_domain_2)  # -> Mapped, Clipped

# ---- group: Offset either side of the flow paths to create a path that widens as it grows
flow_paths_2 = Data(flow_projection_surface_2.FlowPaths)
offsets_per_segment = Number(remap_numbers_2.Mapped)
variable_offset = VariableOffset(curves=flow_paths_2, offsets=offsets_per_segment, rounded=Toggle(True))
project = Project(Geometry=variable_offset, Plane=PlaneXY(0, 0, 0))  # -> Geometry, Transform
boundary_surfaces = BoundarySurfaces(Edges=project.Geometry)
custom_preview_3 = CustomPreview(Geometry=flow_paths_2, Material=ColourSwatch(SwatchColor=RGB(117, 117, 117)))
custom_preview_4 = CustomPreview(Geometry=boundary_surfaces, Material=ColourSwatch(SwatchColor=RGB(0, 195, 255)))

# ==== cluster VariableOffset
rounded = ClusterInput()
curves = ClusterInput()
offsets = ClusterInput()
rounded_2 = Boolean(rounded)
curves_2 = Curve(curves)
offsets_2 = Number(offsets)
rounded_3 = Boolean(rounded_2)

# ---- group: Offset directions
explode = Explode(Curve=curves_2, Recursive=True)  # -> Segments, Vertices
end = EndPoints(Curve=explode.Segments)  # -> Start, End
Z = UnitZ(Factor=1)
vec2pt = Vector2Pt(PointA=end.Start, PointB=end.End, Unitize=True)  # -> Vector, Length
xprod = CrossProduct(VectorA=vec2pt.Vector, VectorB=Z, Unitize=False)  # -> Vector, Length

# ----
multiplication = Multiplication(A=xprod.Vector, B=offsets_2)
rev = Reverse(Vector=multiplication)
move = Move(Geometry=explode.Vertices, Motion=rev)  # -> Geometry, Transform
move_2 = Move(Geometry=explode.Vertices, Motion=multiplication)  # -> Geometry, Transform
pline = PolyLine(Vertices=move.Geometry, Closed=False)
pline_2 = PolyLine(Vertices=move_2.Geometry, Closed=False)
end_2 = EndPoints(Curve=pline)  # -> Start, End
end_3 = EndPoints(Curve=pline_2)  # -> Start, End

# ---- group: Make rounded ends
Z_2 = UnitZ(Factor=1)
Z_3 = UnitZ(Factor=1)
vec2pt_2 = Vector2Pt(PointA=end_2.Start, PointB=end_3.Start, Unitize=True)  # -> Vector, Length
vec2pt_3 = Vector2Pt(PointA=end_3.End, PointB=end_2.End, Unitize=True)  # -> Vector, Length
xprod_2 = CrossProduct(VectorA=vec2pt_2.Vector, VectorB=Z_2, Unitize=False)  # -> Vector, Length
xprod_3 = CrossProduct(VectorA=vec2pt_3.Vector, VectorB=Z_3, Unitize=False)  # -> Vector, Length
arc = ArcSED(Start=end_3.Start, End=end_2.Start, Direction=xprod_2.Vector)  # -> Arc, Plane, Radius
arc_2 = ArcSED(Start=end_3.End, End=end_2.End, Direction=xprod_3.Vector)  # -> Arc, Plane, Radius

# ---- group: Make flat ends
ln = Line(StartPoint=end_3.Start, EndPoint=end_2.Start)
ln_2 = Line(StartPoint=end_2.End, EndPoint=end_3.End)

# ----
p_n_c = PickNChoose(Pattern=[rounded_2, rounded_3], Stream0=[ln, ln_2], Stream1=[arc.Arc, arc_2.Arc])
join = JoinCurves(Curves=[pline_2, pline, p_n_c], Preserve=False)
C = ClusterOutput(join)
