# Grasshopper definition Groundhog - Flow Saturation Examples.ghx (Grasshopper 1.0.7)
# plug-ins: Groundhog

# ----
# Example 1 (Lower-Left)
u_count = Slider(25, range=0..50)
v_count = Slider(25, range=0..50)

# ---- group: Base Surface
# Groundhog Example File
# Definition prepared for Groundhog v0.11.1b and depends on components from that plugin. It is available for download at http://groundhog.la/
# 
# Contact groundhog@philipbelesky.com for support or feedback.
# 
# This is an example file related to the plugin's documentation.
surface = Surface(<surface referenced from the Rhino model>)

# ----
number_slider = Slider(50, range=0..100)

# ---- group: Create point grid for path starts
divide_surface = DivideSurface(Surface=surface, UCount=u_count, VCount=v_count)  # -> flatten(Points), Normals, Parameters

# ----
point = Point([<point referenced from the Rhino model> x3])
mesh_surface = MeshSurface(Surface=surface, UCount=number_slider, VCount=number_slider, Overhang=True, Equalize=False)

# ---- group: Calculate the flow paths (for surface)
flow_projection_surface = FlowProjectionSurface(Surface=surface, Points=point, Fidelity=Slider(71, range=0..100), Steps=0, Thread=False)  # -> FlowPoints, FlowPaths

# ----
point_list = PointList(Points=flow_projection_surface.FlowPoints, Size=Slider(25, range=0..100))
mesh = Mesh(mesh_surface)
flow_saturation = FlowSaturation(
    Mesh=mesh,
    FlowPaths=flow_projection_surface.FlowPaths,
    StartVolume=Slider(100, range=0..1000),
    SegmentLoss=Slider(0.05, range=0..0.1))  # -> FlowOverlaps, FlowVolumes, MeshFaces, FaceCenters
bounds = Bounds(Numbers=flow_saturation.FlowVolumes)
face_normals = FaceNormals(Mesh=mesh)  # -> Centers, Normals
number_slider_2 = Slider(50, range=0..10000)
unit_z = UnitZ(Factor=Slider(10, range=0..10))
panel = Panel(flow_saturation.FlowOverlaps)
move = Move(Geometry=flow_projection_surface.FlowPaths, Motion=unit_z)  # -> Geometry, Transform
move_2 = Move(Geometry=flow_saturation.FaceCenters, Motion=unit_z)  # -> Geometry, Transform
panel_2 = Panel(bounds)
gradient = Gradient(
    LowerLimit=0,
    UpperLimit=number_slider_2,
    Parameter=flow_saturation.FlowVolumes,
    stops=[0: RGB(234, 38, 0), 0.25: RGB(234, 126, 0), 0.5: RGB(254, 244, 84), 0.75: RGB(173, 203, 249), 1: RGB(75, 107, 169)])
gradient_2 = Gradient(
    LowerLimit=0,
    UpperLimit=number_slider_2,
    Parameter=flow_saturation.FlowVolumes,
    stops=[0: RGB(234, 38, 0), 0.25: RGB(234, 126, 0), 0.5: RGB(254, 244, 84), 0.75: RGB(173, 203, 249), 1: RGB(75, 107, 169)])
panel_3 = Panel(flow_saturation.FlowVolumes)
sort_list = SortList(Keys=flow_saturation.FlowVolumes)  # -> Keys, ValuesA
mesh_colours = MeshColours(Mesh=graft(flow_saturation.MeshFaces), Colours=graft(gradient))
custom_preview = CustomPreview(Geometry=move.Geometry, Material=ColourSwatch(SwatchColor=RGB(255, 255, 255)))
custom_preview_2 = CustomPreview(Geometry=move_2.Geometry, Material=gradient_2)
panel_4 = Panel(sort_list.Keys)
larger_than = LargerThan(FirstNumber=flow_saturation.FlowVolumes, SecondNumber=Slider(0, range=0..100))  # -> LargerThan, OrEqualTo
construct_domain = ConstructDomain(DomainStart=Slider(10, range=0..10), DomainEnd=Slider(100, range=0..100))
cull_pattern = CullPattern(List=flow_saturation.FlowVolumes, CullPattern=larger_than.LargerThan)
bounds_2 = Bounds(Numbers=cull_pattern)
cull_pattern_2 = CullPattern(List=flow_saturation.FaceCenters, CullPattern=larger_than.LargerThan)
remap_numbers = RemapNumbers(Value=cull_pattern, Source=bounds_2, Target=construct_domain)  # -> Mapped, Clipped
text_tag_3d = TextTag3D(Location=cull_pattern_2, Text=cull_pattern, Size=Slider(25, range=0..100), Justification=7)
cylinder = Cylinder(Base=cull_pattern_2, Radius=Slider(10, range=0..10), Length=remap_numbers.Mapped)
