# Grasshopper definition Groundhog - Random Path Examples.ghx (Grasshopper 0.9.76)
# plug-ins: Groundhog

# ---- group: Restrict to orthogonal angles but not backwards
angle_start = Slider(0, range=-360..100)
angle_increment = Slider(90, range=0..100)
angle_steps = Slider(3, range=0..10)
series = Series(Start=angle_start, Step=angle_increment, Count=angle_steps)

# ---- group: Create random series of step sizes
largest_distance = Slider(5000, range=1..10000)
distances = Slider(50, range=0..100)
random = Random(Range=largest_distance, Number=distances, Seed=2)

# ----
number_of_starts = Slider(8, range=1..100)
number_of_steps = Slider(42, range=1..100)
surface = Surface(<surface referenced from the Rhino model>)

steps = Slider(100, range=1..100)
distance = Slider(1319, range=1..10000)
seed = Slider(5, range=1..100)
starting_points = Point([<point referenced from the Rhino model> x4])
boundary = Curve(<curve referenced from the Rhino model>)
mesh = Mesh(<mesh referenced from the Rhino model>)

distance_2 = Slider(3119, range=1..10000)
steps_2 = Slider(42, range=1..100)
# Groundhog Example File
# Definition prepared for Groundhog v0.10.1b and depends on components from that plugin. It is available for download at http://groundhog.la/
# 
# Contact groundhog@philipbelesky.com for support or feedback.
# 
# This is an example file related to the plugin's documentation.
# 
# This definition is licensed under the terms of the GPL v3 https://opensource.org/licenses/GPL-3.0
starting_points_2 = Point(<point referenced from the Rhino model>)

# ---- group: Get surface's bounds and add random points
planar_srf_edges = PlanarSrfEdges(brep=surface)
populate_2d = Populate2D(Region=planar_srf_edges, Count=number_of_starts, Seed=1)

# ----
random_path = RandomPath(Start=populate_2d, StepSize=random, StepCount=number_of_steps, Boundary=planar_srf_edges)
random_path_2 = RandomPath(Start=starting_points, StepSize=distance, StepCount=steps, RandomSeed=seed, Directions=series, Boundary=boundary)
random_path_3 = RandomPath(Start=starting_points_2, StepSize=distance_2, StepCount=steps_2)

# ---- group: Project to surface and reform
explode = Explode(Curve=random_path, Recursive=True)  # -> Segments, Vertices
unit_z = UnitZ(Factor=1)
project_point = ProjectPoint(Point=explode.Vertices, Direction=unit_z, Geometry=surface)  # -> Point, Index
polyline = PolyLine(Vertices=project_point.Point, Closed=False)

# ---- group: Project to mesh and reform
explode_2 = Explode(Curve=random_path_2, Recursive=True)  # -> Segments, Vertices
unit_z_2 = UnitZ(Factor=1)
project_point_2 = ProjectPoint(Point=explode_2.Vertices, Direction=unit_z_2, Geometry=mesh)  # -> Point, Index
polyline_2 = PolyLine(Vertices=project_point_2.Point, Closed=False)

# ----
curve = Curve(flatten([polyline_2, polyline, random_path_3]))
custom_preview = CustomPreview(Geometry=curve, Material=ColourSwatch(SwatchColor=RGB(0, 255, 179)))

# ==== cluster PlanarSrfEdges
brep = ClusterInput()
brep_edges = BrepEdges(Brep=brep)  # -> Naked, Interior, NonManifold
join_curves = JoinCurves(Curves=brep_edges.Naked, Preserve=False)
explode = Explode(Curve=join_curves, Recursive=True)  # -> Segments, Vertices
deconstruct = Deconstruct(Point=explode.Vertices)  # -> XComponent, YComponent, ZComponent
construct_point = ConstructPoint(XCoordinate=deconstruct.XComponent, YCoordinate=deconstruct.YComponent, ZCoordinate=0)
polyline = PolyLine(Vertices=construct_point, Closed=True)
polyline_2 = ClusterOutput(polyline)
