# Grasshopper definition Groundhog - Shortest Path Examples.ghx (Grasshopper 0.9.76)
# plug-ins: Groundhog

U = Slider(10, range=0..100)
V = Slider(1, range=0..100)

grade_penalty = Slider(8.963, range=1..10)
end_point = Slider(5, range=0..10)
U_2 = Slider(10, range=0..100)
V_2 = Slider(5, range=0..100)

start_index = Slider(62, range=0..73)
end_index = Slider(27, range=0..73)
terrain = Surface(<surface referenced from the Rhino model>)
trails = Curve([<curve referenced from the Rhino model> x20])

# ----
# Groundhog Example File
# Definition prepared for Groundhog v0.10.2b and depends on components from that plugin. It is available for download at http://groundhog.la/
# 
# Contact groundhog@philipbelesky.com for support or feedback.
# 
# This is an example file related to the plugin's documentation.
# 
# This definition is licensed under the terms of the GPL v3 https://opensource.org/licenses/GPL-3.0
starting_points = Point(<point referenced from the Rhino model>)
end_points = Point(<point referenced from the Rhino model>)
mesh = Mesh(<mesh referenced from the Rhino model>)

start_point = Point([<point referenced from the Rhino model> x4])
end_points_2 = Point(<point referenced from the Rhino model>)
streets = Curve([<curve referenced from the Rhino model> x406])

surface = Surface(<surface referenced from the Rhino model>)

# ---- group: Split all curves and project on to the terrain
intersect_all = IntersectAll(crv=trails)
project = Project(Curve=intersect_all, Brep=terrain, Direction=Vector(0, 0, 1))  # -> flatten(Curve)

# ---- group: Convert Surface to Mesh + get start/end points within a grid
divide_surface = DivideSurface(Surface=surface, UCount=U, VCount=V)  # -> Points, Normals, Parameters
mesh_edges = MeshEdges(Mesh=surface)  # -> NakedEdges, InteriorEdges, NonManifoldEdges
list_item = ListItem(List=divide_surface.Points, Index=0, Wrap=True)  # -> flatten(Item)
list_item_2 = ListItem(List=divide_surface.Points, Index=-1, Wrap=True)  # -> flatten(Item)

# ---- group: Use Mesh's face edges as the path network
mesh_edges_2 = MeshEdges(Mesh=mesh)  # -> NakedEdges, InteriorEdges, NonManifoldEdges

# ---- group: Use grid on surface as curves; get start/end point within a grid
# By default the curve's physical distances are calculated to identify what paths are shortest. We can however override that calculation and provide our own length, such as to favour flatter terrain (by increasing distance with grade) or perhaps to try and avoid certain areas within the terrain.
divide_surface_2 = DivideSurface(Surface=surface, UCount=U_2, VCount=V_2)  # -> Points, Normals, Parameters
srf_grid = SrfGrid(surface=surface)
penalise_grade = PenaliseGrade(curve=srf_grid, grade_penalty=grade_penalty)
list_item_3 = ListItem(List=divide_surface_2.Points, Index=1, Wrap=True)  # -> flatten(Item)
list_item_4 = ListItem(List=divide_surface_2.Points, Index=-1, Wrap=True)  # -> flatten(Item)
list_item_5 = ListItem(List=list_item_3, Index=end_point, Wrap=True)  # -> flatten(Item)

# ---- group: All curves within the network need to be split at their intersections
intersect_all_2 = IntersectAll(crv=streets)

# ---- group: Specify start/ends within projected curves
end_points_3 = EndPoints(Curve=project)  # -> Start, End
list_item_6 = ListItem(List=end_points_3.Start, Index=start_index, Wrap=True)
list_item_7 = ListItem(List=end_points_3.Start, Index=end_index, Wrap=True)

# ----
shortest_path = ShortestPath(Curves=project, Starts=list_item_6, Ends=list_item_7)  # -> ShortestPath, Succession, Direction, Length
shortest_path_2 = ShortestPath(Curves=intersect_all_2, Starts=start_point, Ends=end_points_2)  # -> ShortestPath, Succession, Direction, Length

# ---- group: Multiple starts to single end
shortest_path_3 = ShortestPath(Curves=srf_grid, Starts=list_item_4, Ends=list_item_5, Lengths=penalise_grade)  # -> ShortestPath, Succession, Direction, Length

# ---- group: Single start to single end
shortest_path_4 = ShortestPath(Curves=mesh_edges_2.InteriorEdges, Starts=starting_points, Ends=end_points)  # -> ShortestPath, Succession, Direction, Length

# ---- group: Multiple starts to multiple ends
shortest_path_5 = ShortestPath(Curves=mesh_edges.InteriorEdges, Starts=list_item_2, Ends=list_item)  # -> ShortestPath, Succession, Direction, Length

# ----
curve = Curve(flatten([shortest_path_2.ShortestPath, shortest_path_4.ShortestPath, shortest_path_5.ShortestPath, shortest_path_3.ShortestPath, shortest_path.ShortestPath]))

# ---- group: Show Start/Ends
colour_swatch = ColourSwatch(SwatchColor=RGB(0, 242, 255))
length = Length(Curve=curve)
end_points_4 = EndPoints(Curve=curve)  # -> Start, End
round = Round(Number=length)  # -> Nearest, Floor, Ceiling
text_tag = TextTag(Location=end_points_4.End, Text="End", Colour=colour_swatch)
text_tag_2 = TextTag(Location=end_points_4.Start, Text=round.Nearest, Colour=colour_swatch)

# ----
custom_preview = CustomPreview(Geometry=curve, Material=ColourSwatch(SwatchColor=RGB(0, 178, 255)))

# ==== cluster SrfGrid
surface = ClusterInput()
# Divide Domain > Isotrim was acting extremely slow for some reason. This should be replaced with that approach once the cause has been identified
divide_surface = DivideSurface(Surface=surface, UCount=Slider(50, range=0..100), VCount=Slider(25, range=0..100))  # -> Points, Normals, Parameters
flip_matrix = FlipMatrix(Data=divide_surface.Points)
polyline = PolyLine(Vertices=flip_matrix, Closed=False)
polyline_2 = PolyLine(Vertices=divide_surface.Points, Closed=False)
explode = Explode(Curve=flatten(polyline_2), Recursive=True)  # -> Segments, Vertices
explode_2 = Explode(Curve=flatten(polyline), Recursive=True)  # -> Segments, Vertices
curve = Curve(flatten([explode_2.Segments, explode.Segments]))
curve_2 = ClusterOutput(curve)

# ==== cluster PenaliseGrade
curve = ClusterInput()
curve_2 = Curve(curve)
length = Length(Curve=curve_2)
end_points = EndPoints(Curve=curve_2)  # -> Start, End
deconstruct = Deconstruct(Point=end_points.Start)  # -> XComponent, YComponent, ZComponent
deconstruct_2 = Deconstruct(Point=end_points.End)  # -> XComponent, YComponent, ZComponent
construct_point = ConstructPoint(XCoordinate=deconstruct_2.XComponent, YCoordinate=deconstruct_2.YComponent, ZCoordinate=deconstruct.ZComponent)
vector_2pt = Vector2Pt(PointA=end_points.Start, PointB=end_points.End, Unitize=False)  # -> Vector, Length
vector_2pt_2 = Vector2Pt(PointA=end_points.Start, PointB=construct_point, Unitize=False)  # -> Vector, Length
grade_penalty = ClusterInput()
angle = Angle(VectorA=vector_2pt.Vector, VectorB=vector_2pt_2.Vector)  # -> Angle, Reflex
grade_penalty_2 = Number(grade_penalty)
multiplication = Multiplication(A=angle.Angle, B=grade_penalty_2)
multiplication_2 = Multiplication(A=length, B=multiplication)
addition = Addition(A=length, B=multiplication_2)
result = ClusterOutput(addition)

# ==== cluster IntersectAll
crv = ClusterInput()
# Thanks to user Systemiq on the (old) Grasshopper forums http://www.grasshopper3d.com/forum/topics/split-curve-s-by-intersection-with-other-curve-s
crv_2 = Curve(reparameterize(flatten(crv)))
lng = ListLength(List=crv_2)
mcx = MultipleCurves(Curves=crv_2)  # -> Points, IndexA, IndexB, ParamA, ParamB
series = Series(Start=0, Step=1, Count=lng)
int = Integer(series)
mindex = MemberIndex(Set=[mcx.IndexA, mcx.IndexB], Member=int)  # -> Index, Count
pshift = ShiftPaths(Data=mindex.Index, Offset=-1)
number_slider = Slider(0.0001, range=1e-05..0.1)
item = ListItem(List=[mcx.ParamA, mcx.ParamB], Index=pshift, Wrap=True)
unflatten = UnflattenTree(Tree=item, Guide=mindex.Index)
cset = CreateSet(List=unflatten)  # -> Set, Map
larger = LargerThan(FirstNumber=cset.Set, SecondNumber=expr("1-x", number_slider))  # -> LargerThan, OrEqualTo
smaller = SmallerThan(FirstNumber=cset.Set, SecondNumber=number_slider)  # -> SmallerThan, OrEqualTo
or = GateOr(A=smaller.SmallerThan, B=larger.LargerThan)
cull = CullPattern(List=cset.Set, CullPattern=invert(or))
vb = VBScript(x=cull)  # -> out, A
# ---------- vb: VB ----------
    If x Is Nothing Then
      a = nothing
    Else
      a = x
    End If
# ---------- end vb ----------
shatter = Shatter(Curve=graft(crv_2), Parameters=vb.A)  # -> simplify(Segments)
curve = Curve(flatten(shatter))
curve_2 = ClusterOutput(curve)
