# Grasshopper definition Groundhog - Plants Examples.ghx (Grasshopper 1.0.7)
# plug-ins: Groundhog

# ---- group: File import option (for windows)
file_path = FilePath("C:\Users\philip\Code\groundhog\docs\plants\Groundhog - Plants Examples.csv")
read_file = ReadFile(File=file_path, PerLineParse=True)
species_importer = SpeciesAttributeImporter(CSVFile=read_file)
species = Data(species_importer)

# ---- group: Normally you would import the a CSV but on OSX file importing does not work in the current Rhino WIP
species_attributes = Panel("""Species Name,Common Name,Indigenous Name,Time to Maturity,Spacing Radius,Initial Crown Radius,Mature Crown Radius,Crown Variance,Initial Trunk Radius,Mature Trunk Radius,Trunk Variance, Initial Height,Mature Height, Height Variance, Initial Root Radius,Mature Root Radius, Root Variance,Display R,Display G,Display B
Rhopalostylis sapida,Nikau,Nikau,25,750,500,3000,15,75,200,15,500,12500,15,150,2500,15,16,148,59
Cordyline australis,Cabbage Tree,Ti Kouka,50,750,500,1500,25,100,250,25,1000,16000,25,200,1750,25,26,171,23
Phorium Tenax,NZ Flax,Harakeke,20,450,300,2000,20,50,175,20,300,3000,20,100,1500,20,110,171,23
Kunzea ericoides,White tea-tree,Kanuka,12,750,500,3000,30,100,250,20,500,6000,20,200,1850,20,130,201,54
Metrosideros excelsa,Pohutukawa,Pohutukawa,40,750,500,1500,20,75,350,20,500,20000,20,150,1100,20,17,198,98
Podocarpus totara,Totara,Totara,30,800,800,1600,33,110,350,30,500,22000,30,220,1200,30,17,198,43""")
# Groundhog Example File
# Definition prepared for Groundhog v0.10.2b and depends on components from that plugin. It is available for download at http://groundhog.la/
# 
# Contact groundhog@philipbelesky.com for support or feedback.
# 
# This 3dm/gha files are a part of that plugin's documentation.
# 
# This definition is licensed under the terms of the GPL v3 https://opensource.org/licenses/GPL-3.0
species_importer_2 = SpeciesAttributeImporter(CSVFile=species_attributes)
species_2 = Data(species_importer_2)

# ---- group: Area(s) to be Planted (imported from layers)
geometry_pipeline = GeometryPipeline(
    GroupByLayer=False,
    GroupByType=False,
    IncludeHidden=True,
    IncludeLocked=True,
    LayerFilter="Visual Area",
    NameFilter="*",
    SublayerFiltering=False,
    TypeFilter=4)
geometry_pipeline_2 = GeometryPipeline(
    GroupByLayer=False,
    GroupByType=False,
    IncludeHidden=True,
    IncludeLocked=True,
    LayerFilter="Field Inflow",
    NameFilter="*",
    SublayerFiltering=False,
    TypeFilter=4)
visual_area = Curve(geometry_pipeline)
field_inflow = Curve(geometry_pipeline_2)

# ----
x_years = Slider(10, range=-10..50)
global_time = Number(x_years)

# ---- group: Generic Species types
generic_species = GenericSpeciesAttributes()  # -> ShrubP, GrassP, TreeP
species_3 = Data(generic_species.TreeP)
species_4 = Data(generic_species.ShrubP)
species_5 = Data(generic_species.GrassP)

# ---- group: Create grid based placement
plant_spacing_per_vm = Slider(0.1, range=0..10)
plant_spacing_per_um = Slider(0.2, range=0..2)
curve = Curve(field_inflow)
cluster = Cluster(C=curve, B_2=plant_spacing_per_um, B=plant_spacing_per_vm)
point = Point(flatten(cluster))

# ---- group: Create random based distribution
plant_per_1m2 = Slider(1.498, range=0..10)
curve_2 = Curve(visual_area)
cluster_2 = Cluster_2(C=curve_2, B=plant_per_1m2)
point_2 = Point(flatten(cluster_2))

# ---- group: Repeat data to match planted points (match 50/50)
list_length = ListLength(List=point)
division = Division(A=list_length, B=2)
repeat_data = RepeatData(Data=species_5, Length=division)
repeat_data_2 = RepeatData(Data=species_3, Length=division)
data = Data([repeat_data, repeat_data_2])
jitter = Jitter(List=data, Jitter=1, Seed=2)  # -> Values, Indices

# ---- group: Project Points to Terrain
unit_z = UnitZ(Factor=1)
terrain_mesh = Mesh(<mesh referenced from the Rhino model>)
mesh_ray = MeshRay(Mesh=terrain_mesh, Point=point, Direction=unit_z)  # -> Point, Hit
point_3 = Point(mesh_ray.Point)

# ---- group: Repeat data to match planted points
list_length_2 = ListLength(List=point_2)
repeat_data_3 = RepeatData(Data=species_4, Length=list_length_2)

# ----
number_slider = Slider(4, range=0..10)
point_4 = Point(point_2)
plant_appearance_discs = PlantAppearanceDiscs(Species=repeat_data_3, Locations=point_4, Times=global_time)  # -> Trunk, Root, Crown, Spacing, Color, Label
plant_appearance_canopy_mesh = PlantAppearanceCanopyMesh(Species=jitter.Values, Locations=point_3, Times=global_time, Sides=number_slider)  # -> Canopies, Color, Label
plant_appearance_root_mesh = PlantAppearanceRootMesh(Species=jitter.Values, Locations=point_3, Times=global_time, Sides=number_slider)  # -> Roots, Color, Label

# ---- group: Visualise crowns + tag species
deconstruct_arc = DeconstructArc(Arc=plant_appearance_discs.Crown)  # -> BasePlane, Radius, Angle
custom_preview = CustomPreview(Geometry=plant_appearance_discs.Crown, Shader=plant_appearance_discs.Color)
text_tag = TextTag(Location=deconstruct_arc.BasePlane, Text=plant_appearance_discs.Label, Colour=plant_appearance_discs.Color)

# ---- group: Species proportions
text = Text(flatten([plant_appearance_canopy_mesh.Label, plant_appearance_root_mesh.Label, plant_appearance_discs.Label]))
pie_chart = PieChart(text)

# ---- group: Color meshes
custom_preview_2 = CustomPreview(Geometry=plant_appearance_canopy_mesh.Canopies, Shader=plant_appearance_canopy_mesh.Color)
custom_preview_3 = CustomPreview(Geometry=plant_appearance_root_mesh.Roots, Shader=ColourSwatch(SwatchColor=RGB(79, 0, 0)))

# ==== cluster Cluster
B = ClusterInput()
B_2 = ClusterInput()
C = ClusterInput()
bbox = BoundingBox(Content=C, Plane=PlaneXY(0, 0, 0))  # -> Box, Box_2
debrep = DeconstructBrep(Brep=bbox.Box)  # -> Faces, Edges, Vertices
item = ListItem(List=debrep.Edges, Index=0, Wrap=True)
item_2 = ListItem(List=debrep.Edges, Index=Slider(1, range=0..1), Wrap=True)
len = Length(Curve=item)
len_2 = Length(Curve=item_2)
item_3 = ListItem(List=debrep.Faces, Index=0, Wrap=True)  # -> simplify(Item)
division = Division(A=len, B=1000)
division_2 = Division(A=len_2, B=1000)
multiplication = Multiplication(A=division, B=B_2)
panel = Panel(multiplication)
multiplication_2 = Multiplication(A=division_2, B=B)
panel_2 = Panel(multiplication_2)
sdivide = DivideSurface(Surface=item_3, UCount=multiplication, VCount=multiplication_2)  # -> Points, Normals, Parameters
join = JoinCurves(Curves=C, Preserve=False)
trim = TrimTree(Tree=sdivide.Points, Depth=1)  # -> simplify(Tree)
incurve = PointInCurve(Point=trim, Curve=graft(join))  # -> Relationship, Point
equals = Equality(FirstNumber=incurve.Relationship, SecondNumber=Slider(2, range=0..10))  # -> Equality, Inequality
cull = CullPattern(List=trim, CullPattern=equals.Equality)
L = ClusterOutput(cull)

# ==== cluster Cluster_2
C = ClusterInput()
B = ClusterInput()
bbox = BoundingBox(Content=C, Plane=PlaneXY(0, 0, 0))  # -> Box, Box_2
join = JoinCurves(Curves=C, Preserve=False)
debrep = DeconstructBrep(Brep=bbox.Box)  # -> Faces, Edges, Vertices
join_2 = JoinCurves(Curves=debrep.Edges, Preserve=False)
panel = Panel("-1")
area = Area(Geometry=join_2)  # -> Area, Centroid
sqrt = SquareRoot(Value=area.Area)
division = Division(A=sqrt, B=1000)
multiplication = Multiplication(A=division, B=B)
pop2d = Populate2D(Region=join_2, Count=multiplication, Seed=1)
incurve = PointInCurve(Point=pop2d, Curve=graft(join))  # -> Relationship, Point
equals = Equality(FirstNumber=incurve.Relationship, SecondNumber=Slider(2, range=0..10))  # -> Equality, Inequality
cull = CullPattern(List=pop2d, CullPattern=equals.Equality)

# ---- group: Remove points that are too close together
cullpt = CullDuplicates(Points=cull, Tolerance=Slider(2000, range=0..10000), CullMode=3)  # -> Points, Indices, Valence

# ----
P = ClusterOutput(cullpt.Points)
