# Grasshopper definition Groundhog - Terrain Examples.ghx (Grasshopper 1.0.4)
# plug-ins: Groundhog

# Groundhog Example File
# Definition prepared for Groundhog v0.6.1a and depends on components from that plugin. It is available for download at http://groundhog.la/
# 
# Contact groundhog@philipbelesky.com for support or feedback.
# 
# This is an example file related to the plugin's documentation.
# 
# This definition is licensed under the terms of the GPL v3 https://opensource.org/licenses/GPL-3.0
curve = Curve([<curve referenced from the Rhino model> x69])

# ---- group: Convert contours to a mesh
control_points = ControlPoints(Curve=curve)  # -> Points, Weights, Knots
remove_overlapping = RemoveOverlapping(pt=flatten(control_points.Points))
delaunay_mesh = DelaunayMesh(Points=remove_overlapping, Plane=PlaneXY(0, 0, 0))

# ---- group: Calculate grade from mesh faces
mesh_slope = MeshSlope(Mesh=delaunay_mesh)  # -> M, FaceCenters, FaceSlopeVectors, FaceSlopeAngles

# ---- group: Visualise grade
text_size = Slider(500, range=0..1000)
swatch = ColourSwatch(SwatchColor=RGB(255, 255, 255))
gradient = Gradient(
    LowerLimit=0,
    UpperLimit=90,
    Parameter=mesh_slope.FaceSlopeAngles,
    stops=[0: RGB(0, 128, 0), 0.404: RGB(255, 255, 0), 0.799: RGB(255, 0, 0), 1: RGB(0, 0, 0)])
int = Integer(mesh_slope.FaceSlopeAngles)
mcol = MeshColours(Mesh=simplify(graft(mesh_slope.M)), Colours=simplify(graft(gradient)))
angles_labels = TextTag3D(Location=mesh_slope.FaceCenters, Text=int, Size=text_size, Colour=swatch, Justification=5)
angles_vectors = VectorDisplayEx(Point=mesh_slope.FaceCenters, Vector=mesh_slope.FaceSlopeVectors, Colour=swatch, Width=1)

# ==== cluster RemoveOverlapping
pt = ClusterInput()
pt_2 = Point(pt)
sort_pt = SortPoints(Points=pt_2)  # -> Points, Indices
shift = ShiftList(List=sort_pt.Points, Shift=1, Wrap=True)
pdecon = Deconstruct(Point=sort_pt.Points)  # -> XComponent, YComponent, ZComponent
pdecon_2 = Deconstruct(Point=shift)  # -> XComponent, YComponent, ZComponent
equals = Equality(FirstNumber=pdecon.YComponent, SecondNumber=pdecon_2.YComponent)  # -> Equality, Inequality
equals_2 = Equality(FirstNumber=pdecon.XComponent, SecondNumber=pdecon_2.XComponent)  # -> Equality, Inequality
and = GateAnd(A=equals_2.Equality, B=equals.Equality)
equals_3 = Equality(FirstNumber=and, SecondNumber=0)  # -> Equality, Inequality
cull = CullPattern(List=sort_pt.Points, CullPattern=equals_3.Equality)
pt_3 = Point(cull)
pt_4 = ClusterOutput(pt_3)
