# Grasshopper definition Contour Examples.gh (Grasshopper 0.9.76)
# plug-ins: Groundhog

gap_bridging_tolerance = Slider(7, range=0..10)
createplanes_can_be_slow = BooleanToggle(False)
sitebounds = Curve(<curve referenced from the Rhino model>)
# Groundhog Example File
# Definition prepared for Groundhog v0.5a
# www.groundhog.la
# 
# Prepared by Philip Belesky
# www.philipbelesky.com
# 
# Contact groundhog@philipbelesky.com for support or feedback
contours = Curve([<curve referenced from the Rhino model> x94])

# ---- group: Check and make all contours planar
contour_planarity_fix = ContourPlanarityFix(ContourCurves=contours)  # -> AllContours, FixedContours

# ---- group: Attempt to bridge gaps between disjointed contours
contour_gap_fix = ContourGapFix(ContourCurves=contour_planarity_fix.AllContours, Boundary=sitebounds, MaximumDistance=Slider(2000, range=0..10000))  # -> Contours, Joins

# ----
custom_preview = CustomPreview(Geometry=contour_planarity_fix.FixedContours, Shader=ColourSwatch(SwatchColor=RGB(0, 255, 190)))

# ---- group: Clip contours to a given boundary
contour_clip = ContourClip(ContourCurves=contour_gap_fix.Contours, Boundary=sitebounds, CreatePlanarSrfs=createplanes_can_be_slow)  # -> Contours, EdgedContours, PlanarSurfaces

# ----
custom_preview_2 = CustomPreview(Geometry=contour_gap_fix.Joins, Shader=ColourSwatch(SwatchColor=RGB(239, 255, 10)))
fixed_contours_to_and_around_bounds = Curve(contour_clip.EdgedContours)
fixed_contours_in_bounds = Curve(contour_clip.Contours)
