# Grasshopper definition Fields Examples.gh (Grasshopper 0.9.76)
# plug-ins: Groundhog

desired_domain_start = Slider(11, range=0..100)
desired_domain_end = Slider(27, range=0..100)
visualisation_grid = Slider(50, range=0..100)
# Groundhog Example File
# Definition prepared for Groundhog v0.5a
# www.groundhog.la
# 
# Prepared by Philip Belesky
# www.philipbelesky.com
# 
# Contact groundhog@philipbelesky.com for support or feedback
number_slider = Slider(25, range=0..100)
curve = Curve(<curve referenced from the Rhino model>)
curve_2 = Curve([<curve referenced from the Rhino model> x9])

# ---- group: Translate geometry to surface/field
field_mapper = FieldMapper(Bounds=curve, Divisions=number_slider, Areas=curve_2, ZRange=0)

# ---- group: Visualise surface gradient as a circular grid
cluster = Cluster_2(
    curve=curve,
    surface=field_mapper,
    u_count=visualisation_grid,
    v_count=visualisation_grid,
    domain_start=desired_domain_start,
    domain_end=desired_domain_end)  # -> circle, colour

# ----
custom_preview = CustomPreview(Geometry=cluster.circle, Shader=cluster.colour)

# ==== cluster Cluster_2
surface = ClusterInput()
u_count = ClusterInput()
v_count = ClusterInput()
divide_surface = DivideSurface(Surface=surface, UCount=u_count, VCount=v_count)  # -> flatten(Points), Normals, Parameters
curve = ClusterInput()
remove_outside_bounds = RemoveOutsideBounds(point=divide_surface.Points, curve=curve, list=divide_surface.Points)
deconstruct = Deconstruct(Point=remove_outside_bounds)  # -> XComponent, YComponent, ZComponent
domain_start = ClusterInput()
domain_end = ClusterInput()
cluster = Cluster(data_to_remap=deconstruct.ZComponent, domain_start=domain_start, domain_end=domain_end)
cluster_2 = Cluster(data_to_remap=deconstruct.ZComponent, domain_start=1, domain_end=0)
gradient = Gradient(
    LowerLimit=0,
    UpperLimit=1,
    Parameter=cluster_2,
    stops=[0.119: RGB(0, 128, 0), 0.648: RGB(255, 255, 0), 1: RGB(255, 0, 0)])
circle_cnr = CircleCNR(Center=remove_outside_bounds, Normal=Vector(0, 0, 1), Radius=cluster)
circle = ClusterOutput(circle_cnr)
colour = ClusterOutput(gradient)

# ==== cluster Cluster
data_to_remap = ClusterInput()
data_to_remap_2 = Data(data_to_remap)
domain_start = ClusterInput()
domain_end = ClusterInput()
construct_domain = ConstructDomain(DomainStart=domain_start, DomainEnd=domain_end)
bounds = Bounds(Numbers=data_to_remap_2)
remap_numbers = RemapNumbers(Value=data_to_remap_2, Source=bounds, Target=construct_domain)  # -> Mapped, Clipped
mapped = ClusterOutput(remap_numbers.Mapped)

# ==== cluster RemoveOutsideBounds
point = ClusterInput()
curve = ClusterInput()
point_in_curve = PointInCurve(Point=point, Curve=curve)  # -> Relationship, Point
equality = Equality(FirstNumber=point_in_curve.Relationship, SecondNumber=2)  # -> Equality, Inequality
list = ClusterInput()
cull_pattern = CullPattern(List=list, CullPattern=equality.Equality)
list_2 = ClusterOutput(cull_pattern)
