# Grasshopper definition Groundhog - Floods Examples.ghx (Grasshopper 1.0.4)
# plug-ins: Groundhog

colour = ColourPicker(PickedColour=RGBA(255, 0, 255, 106))
colour_2 = ColourPicker(PickedColour=RGBA(0, 255, 255, 105))
colour_3 = ColourPicker(PickedColour=RGBA(0, 119, 255, 107))
panel = Panel("Colours")
colour_4 = ColourPicker(PickedColour=RGBA(67, 117, 255, 105))

number_slider = Slider(10000, range=0..100000)
panel_2 = Panel("Testing Area")
coast = Curve(<curve referenced from the Rhino model>)
construct_point = ConstructPoint(XCoordinate=Slider(0, range=-100000..0), YCoordinate=Slider(0, range=-1000..10000), ZCoordinate=0)
frontline = Curve(coast)
y_size = Number(number_slider)
x_size = Number(number_slider)
origin = Point(construct_point)

panel_3 = Panel("High Tide Data")
mean_high_water_springs = Slider(1000, range=0..5000)
mean_high_water_neaps = Slider(1450, range=0..5000)
mean_low_water_springs = Slider(430, range=0..5000)
mean_low_water_neaps = Slider(700, range=0..5000)
mean_sea_level = Slider(0, range=0..5000)

# ----
# Groundhog Example File
# Definition prepared for Groundhog v0.6.1a and depends on components from that plugin. It is available for download at http://groundhog.la/
# 
# Contact groundhog@philipbelesky.com for support or feedback.
# 
# This is an example file related to the plugin's documentation.
# 
# This definition is licensed under the terms of the GPL v3 https://opensource.org/licenses/GPL-3.0
panel_4 = Panel("Site Data")
sea_level_rise_year = Slider(1.6, range=0..5)
storm_surge_height = Slider(500, range=0..5000)
sea_datum_z = Slider(0, range=-3000..3000)
year = Slider(2068, range=2015..2115)

terrain = Brep(<brep referenced from the Rhino model>)
terrain_2 = Brep(terrain)
river_floods = RiverFloodSimulator(Datum=0, Year=2016, Rise=3, Surge=500, HighNeap=1400, LowNeap=700, HighSpring=1000, LowSpring=400)  # -> SeaLevel, StormSurgeLevel, HighNeap, LowNeap, HighSpring, LowSpring
terrain_3 = Brep(terrain_2)
frontline_2 = Curve(coast)

num = Number(sea_datum_z)
y_size_2 = Number(y_size)
num_2 = Number(year)
origin_2 = Point(origin)
num_3 = Number(mean_low_water_springs)
num_4 = Number(sea_level_rise_year)
num_5 = Number(mean_low_water_neaps)
num_6 = Number(mean_high_water_springs)
x_size_2 = Number(x_size)
num_7 = Number(mean_sea_level)
num_8 = Number(mean_high_water_neaps)
num_9 = Number(storm_surge_height)

sea_floods = SeaFloodSimulator(Datum=num, Year=num_2, Rise=num_4, Surge=num_9, HighNeap=num_8, LowNeap=num_5, HighSpring=num_6, LowSpring=num_3)  # -> SeaLevel, StormSurgeLevel, HighNeap, LowNeap, HighSpring, LowSpring

mean_high_water_spring = Geometry(sea_floods.HighSpring)
mean_low_water_spring = Geometry(sea_floods.LowSpring)
mean_high_water_neap = Geometry(sea_floods.HighNeap)
mean_low_water_neap = Geometry(sea_floods.LowNeap)
storm_surge_level = Geometry(sea_floods.StormSurgeLevel)
mean_sea_level_2 = Geometry(sea_floods.SeaLevel)

scale = Scale(Center=Point(0, 0, 0), Factor=storm_surge_level)  # -> Geometry, Transform
storm_surge_level_2 = Geometry(storm_surge_level)
mean_sea_level_3 = Geometry(mean_sea_level_2)
mean_low_water_neap_2 = Geometry(mean_low_water_neap)
mean_high_water_neap_2 = Geometry(mean_high_water_neap)
mean_high_water_spring_2 = Geometry(mean_high_water_spring)
mean_low_water_spring_2 = Geometry(mean_low_water_spring)
cluster = Cluster(level=mean_sea_level_3, frontline=frontline_2, terrain=terrain_3)  # -> curve_3, list
cluster_2 = Cluster(level=mean_low_water_neap_2, frontline=frontline_2, terrain=terrain_3)  # -> curve_3, list
cluster_3 = Cluster(level=storm_surge_level_2, frontline=frontline_2, terrain=terrain_3)  # -> curve_3, list
cluster_4 = Cluster(level=mean_high_water_neap_2, frontline=frontline_2, terrain=terrain_3)  # -> curve_3, list
cluster_5 = Cluster(level=mean_low_water_spring_2, frontline=frontline_2, terrain=terrain_3)  # -> curve_3, list
cluster_6 = Cluster(level=mean_high_water_spring_2, frontline=frontline_2, terrain=terrain_3)  # -> curve_3, list
mean_sea_level_srf = CustomPreview(Geometry=cluster.list, Shader=colour_3)
mean_sea_level_srf_2 = CustomPreview(Geometry=cluster_2.list, Shader=colour_3)
mean_sea_level_srf_3 = CustomPreview(Geometry=cluster_4.list, Shader=colour_3)
mean_sea_level_srf_4 = CustomPreview(Geometry=cluster_5.list, Shader=colour_3)
mean_sea_level_srf_5 = CustomPreview(Geometry=cluster_6.list, Shader=colour_3)
mean_sea_level_srf_6 = CustomPreview(Geometry=cluster_3.list, Shader=colour_3)
mean_sea_level_crv = CustomPreview(Geometry=cluster.curve_3, Shader=colour_3)
mean_sea_level_crv_2 = CustomPreview(Geometry=cluster_2.curve_3, Shader=colour_3)
mean_sea_level_crv_3 = CustomPreview(Geometry=cluster_4.curve_3, Shader=colour_3)
mean_sea_level_crv_4 = CustomPreview(Geometry=cluster_5.curve_3, Shader=colour_3)
mean_sea_level_crv_5 = CustomPreview(Geometry=cluster_6.curve_3, Shader=colour_3)
mean_sea_level_crv_6 = CustomPreview(Geometry=cluster_3.curve_3, Shader=colour_3)

# ==== cluster Cluster
level = ClusterInput()
frontline = ClusterInput()
terrain = ClusterInput()
level_2 = Brep(level)
terrain_2 = Brep(terrain)
bbx = BrepBrep(BrepA=terrain_2, BrepB=level_2)  # -> Curves, Points
find_closest = FindClosest(curve=bbx.Curves, curve_2=frontline)
split_with_brep = SplitWithBrep(Curve=level_2, Brep=terrain_2)  # -> Curve, Points
curve = Curve(find_closest)
find_closest_2 = FindClosest(curve=split_with_brep.Curve, curve_2=frontline)
list_item = ListItem(List=find_closest_2, Index=1, Wrap=True)
join_curves = JoinCurves(Curves=[curve, list_item], Preserve=False)
list_length = ListLength(List=bbx.Curves)
boundary_surfaces = BoundarySurfaces(Edges=join_curves)
larger_than = LargerThan(FirstNumber=list_length, SecondNumber=0)  # -> LargerThan, OrEqualTo
cull_pattern = CullPattern(List=boundary_surfaces, CullPattern=larger_than.LargerThan)
curve_2 = Curve(find_closest)
curve_3 = ClusterOutput(curve_2)
list = ClusterOutput(cull_pattern)

# ==== cluster FindClosest
curve = ClusterInput()
curve_2 = ClusterInput()
divide_curve = DivideCurve(Curve=curve_2, Count=2, Kinks=False)  # -> Points, Tangents, Parameters
divide_curve_2 = DivideCurve(Curve=curve, Count=2, Kinks=False)  # -> Points, Tangents, Parameters
list_item = ListItem(List=divide_curve_2.Points, Index=1, Wrap=True)  # -> flatten(Item)
list_item_2 = ListItem(List=divide_curve.Points, Index=1, Wrap=True)
distance = Distance(PointA=list_item, PointB=list_item_2)
sort_list = SortList(Keys=distance)  # -> Keys, ValuesValuesA
list_item_3 = ListItem(List=sort_list.Keys, Index=0, Wrap=True)
member_index = MemberIndex(Set=distance, Member=list_item_3)  # -> Index, Count
list_item_4 = ListItem(List=curve, Index=member_index.Index, Wrap=True)
i = ClusterOutput(list_item_4)
