# Grasshopper definition Groundhog - Flows Examples.ghx (Grasshopper 1.0.4)
# plug-ins: Groundhog

number_slider = Slider(50, range=0..100)
multithread = BooleanToggle(False)

# ---- group: Base Surface
# Groundhog Example File
# Definition prepared for Groundhog v0.6.1a and depends on components from that plugin. It is available for download at http://groundhog.la/
# 
# Contact groundhog@philipbelesky.com for support or feedback.
# 
# This is an example file related to the plugin's documentation.
# 
# This definition is licensed under the terms of the GPL v3 https://opensource.org/licenses/GPL-3.0
srf = Surface(<surface referenced from the Rhino model>)

# ---- group: Base Mesh
mesh = Mesh(<mesh referenced from the Rhino model>)

# ---- group: Create point grid for path starts
sdivide = DivideSurface(Surface=srf, UCount=Slider(20, range=0..50), VCount=Slider(20, range=0..50))  # -> flatten(Points), Normals, Parameters

# ---- group: Distribute points randomly on mesh
cluster = Cluster(C=mesh, N=Slider(200, range=0..1000))

# ---- group: Calculate the flow paths
srf_flows = FlowSimulationSurface(Surface=srf, Points=sdivide.Points, Fidelity=Slider(25, range=0..100), Thread=multithread)  # -> FlowPoints, FlowPaths

mesh_flows = FlowSimulationMesh(Mesh=mesh, Points=cluster, Fidelity=100, Thread=False)  # -> FlowPoints, FlowPaths

# ---- group: Calculate catchment bounds
catchments = FlowCatchments(FlowPaths=srf_flows.FlowPaths, ProximtyThreshold=number_slider)  # -> Catchments, FlowPaths, ColorCodes

catchments_2 = FlowCatchments(FlowPaths=mesh_flows.FlowPaths, ProximtyThreshold=number_slider)  # -> Catchments, FlowPaths, ColorCodes

# ---- group: Color flow paths by length from source
minimum_luminance = Slider(0.7, range=0..1)
luminance_step = Slider(-0.02, range=-1..0.1)
explode = Explode(Curve=catchments.FlowPaths, Recursive=True)  # -> Segments, Vertices
lng = ListLength(List=explode.Segments)
series = Series(Start=1, Step=luminance_step, Count=lng)
max = Maximum(A=series, B=minimum_luminance)
hsl = ColourHSL(Alpha=1, Hue=0, Saturation=0, Luminance=max)
preview = CustomPreview(Geometry=explode.Segments, Shader=hsl)

# ---- group: Color code catchment boundaries
preview_2 = CustomPreview(Geometry=catchments.Catchments, Shader=catchments.ColorCodes)

# ---- group: Color code flow paths by catchment
preview_3 = CustomPreview(Geometry=catchments_2.FlowPaths, Shader=catchments_2.ColorCodes)

# ==== cluster Cluster
N = ClusterInput()
C = ClusterInput()
bbox = BoundingBox(Content=C, Plane=PlaneXY(0, 0, 0))  # -> Box, Box_2
debrep = DeconstructBrep(Brep=bbox.Box)  # -> Faces, Edges, Vertices
item = ListItem(List=debrep.Faces, Index=Slider(5, range=0..10), Wrap=True)
pop2d = Populate2D(Region=item, Count=N, Seed=1)
project = ProjectPoint(Point=pop2d, Direction=Vector(0, 0, -1), Geometry=C)  # -> Point, Index
P = ClusterOutput(project.Point)
