# Grasshopper definition Keio University Roof Garden.gh (Grasshopper 0.9.76)
# plug-ins: Groundhog

# ---- group: Use bounds and paver size to create grid dimensions
number_slider = Slider(500, range=0..1000)
# To confirm panel spans; need to find a plan
size_y = Slider(500, range=0..1000)

# ----
# NOTE: need to credit generative landscapes; just realised they already did this https://generativelandscapes.wordpress.com/2014/11/17/keio-university-roof-garden-michel-desvigne-case-study-02/
bounds_for_geometry = Curve(<curve referenced from the Rhino model>)
create_grid = CreateGrid(C=bounds_for_geometry, sx=number_slider, sy=size_y)
trim_grid = TrimGrid(cells=create_grid, bounds=bounds_for_geometry)  # -> cells_4, centers_2

# ---- group: Create random slabs
slab_2_circumference = Slider(300, range=0..1000)
slab_1_circumference = Slider(375, range=0..1000)
slab_4_circumference = Slider(150, range=0..1000)
slab_5 = Slider(0, range=0..100)
slab_3_circumference = Slider(200, range=0..1000)
lng = ListLength(List=trim_grid.cells_4)
random = Random(Range=Slider(4, range=0..10), Number=lng, Seed=2)
round = Round(Number=random)  # -> Nearest, Floor, Ceiling
p_n_c = PickNChoose(
    Pattern=graft(round.Nearest),
    Stream0=slab_1_circumference,
    Stream1=slab_2_circumference,
    Stream2=slab_3_circumference,
    Stream3=slab_4_circumference,
    Stream4=slab_5)  # -> flatten(Result)
division = Division(A=p_n_c, B=2)

# ---- group: Create slab width
cells = Curve(graft(trim_grid.cells_4))
centers = Point(trim_grid.centers_2)
slab_thickness = Slider(75, range=0..100)
circle = CircleCNR(Center=centers, Normal=Vector(0, 0, 1), Radius=division)  # -> graft(Circle)
Z = UnitZ(Factor=slab_thickness)
boundary = BoundarySurfaces(Edges=[cells, circle])

# ----
centers_2 = Point(trim_grid.centers_2)
list_length = ListLength(List=centers_2)
of_trees = Slider(0.19, range=0..1)
list_length_2 = ListLength(List=centers_2)
generic_species_attributes = GenericSpeciesAttributes()  # -> Shrub, Grass, Tree
random_2 = Random(Range=Domain(0, 1), Number=list_length, Seed=2)
larger_than = LargerThan(FirstNumber=of_trees, SecondNumber=random_2)  # -> LargerThan, OrEqualTo
repeat_data = RepeatData(Data=generic_species_attributes.Grass, Length=list_length_2)
repeat_data_2 = RepeatData(Data=generic_species_attributes.Tree, Length=list_length_2)
cull_pattern = CullPattern(List=repeat_data, CullPattern=invert(larger_than.LargerThan))
cull_pattern_2 = CullPattern(List=repeat_data_2, CullPattern=larger_than.LargerThan)
cull_pattern_3 = CullPattern(List=centers_2, CullPattern=invert(larger_than.LargerThan))
cull_pattern_4 = CullPattern(List=centers_2, CullPattern=larger_than.LargerThan)
plant_appearance_simulator = PlantAppearanceSimulator(Plants=[cull_pattern_2, cull_pattern], Locations=[cull_pattern_4, cull_pattern_3], Times=Slider(5, range=0..10))  # -> Trunk, Root, Crown, Spacing, Color, Label
custom_preview = CustomPreview(Geometry=plant_appearance_simulator.Crown, Shader=plant_appearance_simulator.Color)

# ==== cluster CreateGrid
C = ClusterInput()
sx = ClusterInput()
sy = ClusterInput()

# ---- group: Create bounds around roof
explode = Explode(Curve=C, Recursive=True)  # -> Segments, Vertices
bnd = Bounds2D(Coordinates=explode.Vertices)
dedom2num = DeconstructDomain²(Domain=bnd)  # -> UMin, UMax, VMin, VMax
pt = ConstructPoint(XCoordinate=dedom2num.UMin, YCoordinate=dedom2num.VMin, ZCoordinate=0)

# ----
subtraction = Subtraction(A=dedom2num.UMax, B=dedom2num.UMin)
subtraction_2 = Subtraction(A=dedom2num.VMax, B=dedom2num.VMin)
division = Division(A=subtraction, B=sx)
division_2 = Division(A=subtraction_2, B=sy)
recgrid = Rectangular(Plane=pt, SizeX=sx, SizeY=sy, ExtentX=division, ExtentY=division_2)  # -> flatten(Cells), Points
C_2 = ClusterOutput(recgrid.Cells)

# ==== cluster TrimGrid
bounds = ClusterInput()
cells = ClusterInput()
cells_2 = Curve(cells)
bounds_2 = Curve(bounds)

# ---- group: Get Cell centers (faster than by using area)
curvepoint = PointOnCurve(cells_2, parameter=0.5)
curvepoint_2 = PointOnCurve(cells_2, parameter=0)
vec2pt = Vector2Pt(PointA=curvepoint_2, PointB=curvepoint, Unitize=False)  # -> Vector, Length
multiplication = Multiplication(A=vec2pt.Vector, B=0.5)
move = Move(Geometry=curvepoint_2, Motion=multiplication)  # -> Geometry, Transform

# ---- group: Cull cells outside bounds
incurve = PointInCurve(Point=move.Geometry, Curve=bounds_2)  # -> Relationship, Point
equals = Equality(FirstNumber=incurve.Relationship, SecondNumber=2)  # -> Equality, Inequality
cull = CullPattern(List=cells_2, CullPattern=equals.Equality)
cull_2 = CullPattern(List=move.Geometry, CullPattern=equals.Equality)

# ----
cells_3 = Rectangle(cull)
centers = Point(cull_2)
centers_2 = ClusterOutput(centers)
cells_4 = ClusterOutput(cells_3)
