# Grasshopper definition Keio.gh (Grasshopper 1.0.4)

# To confirm panel spans; need to find a plan
number_slider = Slider(10, range=0..100)
slab_1 = Slider(375, range=0..1000)
slab_2 = Slider(300, range=0..1000)
slab_3 = Slider(200, range=0..1000)
slab_4 = Slider(150, range=0..1000)
slab_5 = Slider(0, range=0..100)
recgrid = Rectangular(
    Plane=PlaneXY(0, 0, 0),
    SizeX=Slider(500, range=0..1000),
    SizeY=Slider(500, range=0..1000),
    ExtentX=number_slider,
    ExtentY=Slider(10, range=0..100))  # -> flatten(Cells), Points
random = Random(Range=Domain(0, 1), Number=1, Seed=2)
division = Division(A=slab_1, B=2)
crv = Curve(graft(recgrid.Cells))
area = Area(Geometry=recgrid.Cells)  # -> Area, Centroid
Z = UnitZ(Factor=Slider(75, range=0..100))
circle = CircleCNR(Center=area.Centroid, Normal=Vector(0, 0, 1), Radius=division)  # -> graft(Circle)
boundary = BoundarySurfaces(Edges=[crv, circle])
extr = Extrude(Base=boundary, Direction=Z)
