# Grasshopper definition Barcelona Botanic Gardens.gh (Grasshopper 1.0.4)
# plug-ins: Groundhog

# ----
# Groundhog Example File
# Definition prepared for Groundhog v0.7.1b and depends on components from that plugin. It is available for download at http://groundhog.la/
# 
# Contact groundhog@philipbelesky.com for support or feedback.
# 
# This is an example file related to the plugin's documentation.
# 
# This definition is licensed under the terms of the GPL v3 https://opensource.org/licenses/GPL-3.0
geometry_pipeline = GeometryPipeline(
    GroupByLayer=False,
    GroupByType=False,
    IncludeHidden=True,
    IncludeLocked=True,
    LayerFilter="*",
    NameFilter="*",
    TypeFilter=1)
base_points = Point(geometry_pipeline)

growth_projection_years = Slider(20, range=0..100)
plant_boundary_offset = Slider(5000, range=0..5000)
area_mm2_per_plant = Slider(3000, range=0..10000)
path_offset = Slider(1731, range=0..5000)

delaunay_mesh = DelaunayMesh(Points=base_points, Plane=PlaneXY(0, 0, 0))
delaunay_edges = DelaunayEdges(Points=base_points, Plane=PlaneXY(0, 0, 0))  # -> Connectivity, Edges
mesh_aspect = MeshAspect(Mesh=delaunay_mesh, Aspect=Vector(0, 1, 0))  # -> MeshFaces, FaceCenters, FaceAspectAngles
mesh_slope = MeshSlope(Mesh=delaunay_mesh)  # -> MeshFaces, FaceCenters, FaceSlopeVectors, FaceSlopeAngles

# ---- group: Label aspects within specified range
text_size = Slider(200, range=0..1000)
text_vector_color = ColourSwatch(SwatchColor=RGB(255, 255, 255))
face_aspect = Integer(mesh_aspect.FaceAspectAngles)
face_centers = Point(mesh_slope.FaceCenters)
face_slope = Integer(mesh_slope.FaceSlopeAngles)
concatenate = Concatenate(Fragment_A=face_slope, Fragment_B="° slope,", A=face_aspect, B="° aspect ")
angles_labels = TextTag3D(Location=face_centers, Text=concatenate, Size=text_size, Colour=text_vector_color, Justification=5)

# ---- group: Visualise aspect on mesh faces
mesh = Mesh(mesh_slope.MeshFaces)
angles = Integer(mesh_slope.FaceSlopeAngles)
bnd = Bounds(Numbers=angles)
gradient = Gradient(
    LowerLimit=0,
    UpperLimit=bnd,
    Parameter=angles,
    stops=[0: RGB(90, 70, 162), 0.00483: RGB(0, 255, 0), 0.248: RGB(255, 255, 0), 0.5: RGB(255, 0, 0), 0.745: RGB(255, 255, 0), 1: RGB(0, 255, 0)])
mcol = MeshColours(Mesh=simplify(graft(mesh)), Colours=simplify(graft(gradient)))

# ---- group: Visualise grade on mesh faces
mesh_2 = Mesh(mesh_aspect.MeshFaces)
angles_2 = Integer(mesh_aspect.FaceAspectAngles)
bnd_2 = Bounds(Numbers=angles_2)
gradient_2 = Gradient(LowerLimit=0, UpperLimit=bnd_2, Parameter=angles_2, stops=[0: RGB(230, 230, 230), 1: RGB(128, 128, 128)])
mcol_2 = MeshColours(Mesh=simplify(graft(mesh_2)), Colours=simplify(graft(gradient_2)))

# ---- group: Create offset edges
face_boundaries = FaceBoundaries(Mesh=delaunay_mesh)
division = Division(A=path_offset, B=-2)
division_2 = Division(A=plant_boundary_offset, B=-2)
offset_loose = OffsetLoose(Curve=face_boundaries, Distance=division)
offset_loose_2 = OffsetLoose(Curve=face_boundaries, Distance=division_2)
boundary_surfaces = BoundarySurfaces(Edges=offset_loose)  # -> flatten(Surfaces)
boundary_surfaces_2 = BoundarySurfaces(Edges=offset_loose_2)  # -> flatten(Surfaces)

# ----
construct_domain = ConstructDomain(DomainStart=Slider(0, range=0..100), DomainEnd=Slider(17, range=0..100))
construct_domain_2 = ConstructDomain(DomainStart=Slider(90, range=0..360), DomainEnd=Slider(211, range=0..360))
includes = Includes(Value=mesh_slope.FaceSlopeAngles, Domain=construct_domain)  # -> Includes, Deviation
includes_2 = Includes(Value=mesh_aspect.FaceAspectAngles, Domain=construct_domain_2)  # -> Includes, Deviation

# ---- group: Visualise Microclimate types
split_ahsl = SplitAHSL(Colour=gradient)  # -> Alpha, Hue, Saturation, Luminance
split_ahsl_2 = SplitAHSL(Colour=gradient_2)  # -> Alpha, Hue, Saturation, Luminance
colour_hsl = ColourHSL(Alpha=1, Hue=split_ahsl.Hue, Saturation=1, Luminance=split_ahsl_2.Luminance)
brep_edges = BrepEdges(Brep=boundary_surfaces)  # -> Naked, Interior, NonManifold
custom_preview = CustomPreview(Geometry=brep_edges.Naked, Shader=colour_hsl)
custom_preview_2 = CustomPreview(Geometry=boundary_surfaces, Shader=colour_hsl)

# ---- group: First False; Second True
gate_and = GateAnd(A=invert(includes.Includes), B=includes_2.Includes)

# ---- group: Both False
gate_and_2 = GateAnd(A=invert(includes.Includes), B=invert(includes_2.Includes))

# ---- group: First True; Second False
gate_and_3 = GateAnd(A=includes.Includes, B=invert(includes_2.Includes))

# ---- group: Both True
gate_and_4 = GateAnd(A=includes.Includes, B=includes_2.Includes)

# ----
surface = Surface(boundary_surfaces_2)

# ---- group: Steep slope; non-northern aspect
cull_pattern = CullPattern(List=surface, CullPattern=gate_and)

# ---- group: Gradual slope; northern aspect
cull_pattern_2 = CullPattern(List=surface, CullPattern=gate_and_3)

# ---- group: Gradual slope; non-northern aspect
cull_pattern_3 = CullPattern(List=surface, CullPattern=gate_and_4)

# ---- group: Steep slope; northern aspect
cull_pattern_4 = CullPattern(List=surface, CullPattern=gate_and_2)

# ----
species_attributes = Panel("""Species Name,Common Name,Indigenous Name,Time to Maturity,Spacing Radius,Initial Crown Radius,Mature Crown Radius,Crown Variance,Initial Trunk Radius,Mature Trunk Radius,Trunk Variance, Initial Height,Mature Height, Height Variance, Initial Root Radius,Mature Root Radius, Root Variance,Display R,Display G,Display B
Fake 1,Fake 1,Fake 1,15,250,250,800,15,25,25,15,500,12500,15,150,2500,15,176,184,172
Fake 2,Fake 2,Fake 2,20,300,300,600,25,25,25,25,1000,16000,25,200,1750,25,209,209,163
Fake 3,Fake 3,Fake 3,20,200,200,400,20,25,25,20,300,3000,20,100,1500,20,160,161,167
Fake 4,Fake 4,Fake 4,12,250,250,500,30,25,25,20,500,6000,20,200,1850,20,250,250,250""")
ppm = Number(area_mm2_per_plant)
surfaces = Surface(cull_pattern_3)
year = Number(growth_projection_years)
distribute_species = DistributeSpecies(csv_file=species_attributes, ppmm2=ppm, surfaces=surfaces)  # -> species_2, locations_2
plant_appearance_simulator = PlantAppearanceSimulator(Plants=flatten(distribute_species.species_2), Locations=flatten(distribute_species.locations_2), Times=year)  # -> Trunk, Root, Crown, Spacing, Color, Label
custom_preview_3 = CustomPreview(Geometry=plant_appearance_simulator.Crown, Shader=plant_appearance_simulator.Color)

species_attributes_2 = Panel("""Species Name,Common Name,Indigenous Name,Time to Maturity,Spacing Radius,Initial Crown Radius,Mature Crown Radius,Crown Variance,Initial Trunk Radius,Mature Trunk Radius,Trunk Variance, Initial Height,Mature Height, Height Variance, Initial Root Radius,Mature Root Radius, Root Variance,Display R,Display G,Display B
Fake 1,Fake 1,Fake 1,25,750,500,1600,15,75,200,15,500,12500,15,150,2500,15,210,255,2
Fake 2,Fake 2,Fake 2,50,750,500,1200,25,100,250,25,1000,16000,25,200,1750,25,252,255,2
Fake 3,Fake 3,Fake 3,20,450,300,1400,20,50,175,20,300,3000,20,100,1500,20,255,222,2
Fake 4,Fake 4,Fake 4,12,750,500,1800,30,100,250,20,500,6000,20,200,1850,20,211,217,54""")
ppm_2 = Number(area_mm2_per_plant)
surfaces_2 = Surface(cull_pattern_2)
year_2 = Number(growth_projection_years)
distribute_species_2 = DistributeSpecies(csv_file=species_attributes_2, ppmm2=ppm_2, surfaces=surfaces_2)  # -> species_2, locations_2
plant_appearance_simulator_2 = PlantAppearanceSimulator(Plants=flatten(distribute_species_2.species_2), Locations=flatten(distribute_species_2.locations_2), Times=year_2)  # -> Trunk, Root, Crown, Spacing, Color, Label
custom_preview_4 = CustomPreview(Geometry=plant_appearance_simulator_2.Crown, Shader=plant_appearance_simulator_2.Color)

species_attributes_3 = Panel("""Species Name,Common Name,Indigenous Name,Time to Maturity,Spacing Radius,Initial Crown Radius,Mature Crown Radius,Crown Variance,Initial Trunk Radius,Mature Trunk Radius,Trunk Variance, Initial Height,Mature Height, Height Variance, Initial Root Radius,Mature Root Radius, Root Variance,Display R,Display G,Display B
Fake 1,Fake 1,Fake 1,25,750,500,3000,15,75,200,15,500,12500,15,150,2500,15,11,210,165
Fake 2,Fake 2,Fake 2,50,750,500,1500,25,100,250,25,1000,16000,25,200,1750,25,11,210,203
Fake 3,Fake 3,Fake 3,20,450,300,2000,20,50,175,20,300,3000,20,100,1500,20,11,170,210
Fake 4,Fake 4,Fake 4,12,750,500,3000,30,100,250,20,500,6000,20,200,1850,20,26,163,148""")
ppm_3 = Number(area_mm2_per_plant)
surfaces_3 = Surface(cull_pattern)
year_3 = Number(growth_projection_years)
distribute_species_3 = DistributeSpecies(csv_file=species_attributes_3, ppmm2=ppm_3, surfaces=surfaces_3)  # -> species_2, locations_2
plant_appearance_simulator_3 = PlantAppearanceSimulator(Plants=flatten(distribute_species_3.species_2), Locations=flatten(distribute_species_3.locations_2), Times=year_3)  # -> Trunk, Root, Crown, Spacing, Color, Label
custom_preview_5 = CustomPreview(Geometry=plant_appearance_simulator_3.Crown, Shader=plant_appearance_simulator_3.Color)

species_attributes_4 = Panel("""Species Name,Common Name,Indigenous Name,Time to Maturity,Spacing Radius,Initial Crown Radius,Mature Crown Radius,Crown Variance,Initial Trunk Radius,Mature Trunk Radius,Trunk Variance, Initial Height,Mature Height, Height Variance, Initial Root Radius,Mature Root Radius, Root Variance,Display R,Display G,Display B
Fake 1,Fake 1,Fake 1,25,750,500,3000,15,75,200,15,500,12500,15,150,2500,15,221,29,78
Fake 2,Fake 2,Fake 2,50,750,500,1500,25,100,250,25,1000,16000,25,200,1750,25,194,33,166
Fake 3,Fake 3,Fake 3,20,450,300,2000,20,50,175,20,300,3000,20,100,1500,20,245,83,83
Fake 4,Fake 4,Fake 4,12,750,500,3000,30,100,250,20,500,6000,20,200,1850,20,136,25,69""")
ppm_4 = Number(area_mm2_per_plant)
surfaces_4 = Surface(cull_pattern_4)
year_4 = Number(growth_projection_years)
distribute_species_4 = DistributeSpecies(csv_file=species_attributes_4, ppmm2=ppm_4, surfaces=surfaces_4)  # -> species_2, locations_2
plant_appearance_simulator_4 = PlantAppearanceSimulator(Plants=flatten(distribute_species_4.species_2), Locations=flatten(distribute_species_4.locations_2), Times=year_4)  # -> Trunk, Root, Crown, Spacing, Color, Label
custom_preview_6 = CustomPreview(Geometry=plant_appearance_simulator_4.Crown, Shader=plant_appearance_simulator_4.Color)

custom_preview_7 = CustomPreview(Geometry=plant_appearance_simulator.Trunk, Shader=plant_appearance_simulator.Color)
custom_preview_8 = CustomPreview(Geometry=plant_appearance_simulator_2.Trunk, Shader=plant_appearance_simulator_2.Color)
custom_preview_9 = CustomPreview(Geometry=plant_appearance_simulator_3.Trunk, Shader=plant_appearance_simulator_3.Color)
custom_preview_10 = CustomPreview(Geometry=plant_appearance_simulator_4.Trunk, Shader=plant_appearance_simulator_4.Color)

# ==== cluster DistributeSpecies
surfaces = ClusterInput()
ppmm2 = ClusterInput()
surfaces_2 = Surface(surfaces)
ppmm2_2 = Number(ppmm2)
area = Area(Geometry=surfaces_2)  # -> Area, Centroid
square = Square(Value=ppmm2_2)
csv_file = ClusterInput()
division = Division(A=area.Area, B=square)
populate_geometry = PopulateGeometry(Geometry=surfaces_2, Count=division, Seed=1)
list_length = ListLength(List=csv_file)
list_length_2 = ListLength(List=populate_geometry)
random = Random(Range=list_length, Number=list_length_2, Seed=2)
species_attribute_importer = SpeciesAttributeImporter(CSVFile=csv_file)
locations = Point(populate_geometry)
list_item = ListItem(List=species_attribute_importer, Index=random, Wrap=True)
species = Data(list_item)
locations_2 = ClusterOutput(locations)
species_2 = ClusterOutput(species)
