# Grasshopper definition Groundhog - Busan Cinema Complex.ghx (Grasshopper 1.0.7)
# plug-ins: Groundhog

# ---- group: Create landform surface from the elevated contour curves in Rhinoceros
geometry_pipeline = GeometryPipeline(
    GroupByLayer=False,
    GroupByType=False,
    IncludeHidden=True,
    IncludeLocked=True,
    LayerFilter="Contours",
    NameFilter="*",
    SublayerFiltering=False,
    TypeFilter=4)
patch = Patch(Curves=geometry_pipeline, Spans=20, Flexibility=1, Trim=False)
landform = Surface(patch)

# ---- group: Set tiled area and tile grid size
# Groundhog Project File
# This Grasshopper definition and its corresponding Rhinoceros model were developed by Albert Rex and Philip Belesky as part of the Groundhog project.
# 
# The definition and model are provided as speculative reverse-engineerings of how this landscape project could have been (partly) designed using computational methods. More information available at https://groundhog.philipbelesky.com/projects/busan-cinema-complex/
# 
# This definition depends on components from version v0.13.0 of the Groundhog plugin. It is available for download at http://groundhog.philipbelesky.com/plugin/
paver_x_grid_spacing = Slider(2100, range=0..10000)
paver_y_grid_spacing = Slider(5550, range=0..10000)
tile_boundary = Curve([<curve referenced from the Rhino model> x2])
x_grid_spacing = Number(paver_x_grid_spacing)
y_grid_spacing = Number(paver_y_grid_spacing)

# ---- group: Define the base geometry of the tiles
# Jump to parameters
# for first 1st tile shape
# Jump to parameters
# for 2nd tile shape
base_tile_rotation = Slider(0.785, range=0..1)
base_tile_width = Slider(283, range=0..4000)
base_tile_sides = Slider(4, range=0..10)
base_tile_rotation_2 = Number(base_tile_rotation)
base_tile_width_2 = Number(base_tile_width)
base_tile_sides_2 = Number(base_tile_sides)

# ---- group: Get maximum x/y dimensions of the landform surface; use those to determine the paving grid size
landform_2 = Surface(landform)
bounding_box = BoundingBox(Content=landform_2, Plane=PlaneXY(0, 0, 0))  # -> Box, Box_2
deconstruct_box = DeconstructBox(Box=bounding_box.Box)  # -> Plane, X, Y, Z
deconstruct_domain = DeconstructDomain(Domain=deconstruct_box.X)  # -> Start, End
deconstruct_domain_2 = DeconstructDomain(Domain=deconstruct_box.Y)  # -> Start, End
subtraction = Subtraction(A=deconstruct_domain_2.End, B=deconstruct_domain_2.Start)
subtraction_2 = Subtraction(A=deconstruct_domain.End, B=deconstruct_domain.Start)
z_domain_of_landform = Domain(deconstruct_box.Z)
maximum_y = Number(subtraction)
maximum_x = Number(subtraction_2)

# ---- group: Divide up surface using the predefined grid distance (won't be perfectly square; but good enough)
landform_3 = Surface(landform)
maximum_y_2 = Number(maximum_y)
maximum_x_2 = Number(maximum_x)
x_grid_spacing_2 = Number(x_grid_spacing)
y_grid_spacing_2 = Number(y_grid_spacing)
division = Division(A=maximum_x_2, B=x_grid_spacing_2)
division_2 = Division(A=maximum_y_2, B=y_grid_spacing_2)
divide_surface = DivideSurface(Surface=landform_3, UCount=division, VCount=division_2)  # -> flatten(Points), Normals, Parameters
null_item = NullItem(Item=divide_surface.Points)  # -> NullFlags, InvalidFlags, Description
cull_pattern = CullPattern(List=divide_surface.Points, CullPattern=invert(null_item.InvalidFlags))
paving_origins = Point(cull_pattern)

# ---- group: Remove out of bounds points
# Using projection and then checking for null results would also work for this task; however it is slower when there are large number of points to check.
paving_origins_2 = Point(paving_origins)
paving_boundary = Curve(tile_boundary)
point_in_curves = PointInCurves(Point=paving_origins_2, Curves=paving_boundary)  # -> Relationship, Index, Point
equality = Equality(FirstNumber=point_in_curves.Relationship, SecondNumber=2)  # -> Equality, Inequality
cull_pattern_2 = CullPattern(List=paving_origins_2, CullPattern=equality.Equality)
paving_origins_3 = Point(cull_pattern_2)

# ---- group: Create base tile object (that will then be individually manipulated in response to the topography)
base_tile_sides_3 = Number(base_tile_sides_2)
paving_origins_4 = Point(paving_origins_3)
base_tile_width_3 = Number(base_tile_width_2)
base_tile_rotation_3 = Number(base_tile_rotation_2)
xy_plane = XYPlane(Origin=paving_origins_4)
rotate_plane = RotatePlane(Plane=xy_plane, Angle=base_tile_rotation_3)
polygon = Polygon(Plane=rotate_plane, Radius=base_tile_width_3, Segments=base_tile_sides_3, FilletRadius=0)  # -> Polygon, Length
base_planes = Plane(xy_plane)
base_tiles = Geometry(polygon.Polygon)

# ----
z_domain_of_landform_2 = Domain(z_domain_of_landform)
z_domain_of_landform_3 = Domain(z_domain_of_landform)

# ---- group: Calculate flow paths
number_slider = Slider(25, range=0..50)  # disabled
number_slider_2 = Slider(25, range=0..50)  # disabled
landform_4 = Surface(landform)  # disabled
divide_surface_2 = DivideSurface(Surface=landform_4, UCount=number_slider_2, VCount=number_slider)  # -> flatten(Points), Normals, Parameters; disabled
flow_projection_surface = FlowProjectionSurface(Surface=landform_4, Points=divide_surface_2.Points, Jump=0, Steps=0, Thread=True)  # -> FlowPoints, FlowPaths; disabled
colour_swatch = ColourSwatch(SwatchColor=RGB(65, 0, 245))  # disabled
custom_preview = CustomPreview(Geometry=flow_projection_surface.FlowPaths, Shader=colour_swatch)  # disabled

# ---- group: Manipulate top tile rotation/scale according to the Z-height of each tile
paving_origins_5 = Point(paving_origins_3)
min_length = Slider(14, range=0..20)
min_width = Slider(3, range=0..10)
max_rotation = Slider(1.606, range=0..3.14)
max_length = Slider(4, range=0..10)
min_rotation = Slider(0.49, range=0..3.14)
max_width = Slider(1, range=0..10)
z_domain = Domain(z_domain_of_landform_2)
z_domain_2 = Domain(z_domain_of_landform_2)
z_domain_3 = Domain(z_domain_of_landform_2)
deconstruct = Deconstruct(Point=paving_origins_5)  # -> XComponent, YComponent, ZComponent
construct_domain = ConstructDomain(DomainStart=min_rotation, DomainEnd=max_rotation)
construct_domain_2 = ConstructDomain(DomainStart=min_width, DomainEnd=max_width)
construct_domain_3 = ConstructDomain(DomainStart=min_length, DomainEnd=max_length)

# ---- group: Manipulate top tile rotation/scale according to the Z-height of each tile / Rotation Target
remap_numbers = RemapNumbers(Value=deconstruct.ZComponent, Source=z_domain, Target=construct_domain)  # -> Mapped, Clipped

# ---- group: Manipulate top tile rotation/scale according to the Z-height of each tile / X Size Target
remap_numbers_2 = RemapNumbers(Value=deconstruct.ZComponent, Source=z_domain_3, Target=construct_domain_3)  # -> Mapped, Clipped

# ---- group: Manipulate top tile rotation/scale according to the Z-height of each tile / Y Size Target
remap_numbers_3 = RemapNumbers(Value=deconstruct.ZComponent, Source=z_domain_2, Target=construct_domain_2)  # -> Mapped, Clipped

# ---- group: Manipulate top tile rotation/scale according to the Z-height of each tile (continued)
rotations = Number(remap_numbers.Mapped)
x_scales = Number(remap_numbers_2.Mapped)
y_scales = Number(remap_numbers_3.Mapped)

# ---- group: Manipulate bottom tile rotation/scale according to the Z-height of each tile
max_length_2 = Slider(4, range=0..10)
max_width_2 = Slider(0, range=0..10)
min_rotation_2 = Slider(2.791, range=0..3.14)
max_rotation_2 = Slider(0.557, range=0..3.5)
min_length_2 = Slider(11, range=0..20)
min_width_2 = Slider(2, range=0..10)
z_domain_4 = Domain(z_domain_of_landform_3)
z_domain_5 = Domain(z_domain_of_landform_3)
z_domain_6 = Domain(z_domain_of_landform_3)
paving_origins_6 = Point(paving_origins_3)
deconstruct_2 = Deconstruct(Point=paving_origins_6)  # -> XComponent, YComponent, ZComponent
construct_domain_4 = ConstructDomain(DomainStart=min_rotation_2, DomainEnd=max_rotation_2)
construct_domain_5 = ConstructDomain(DomainStart=min_width_2, DomainEnd=max_width_2)
construct_domain_6 = ConstructDomain(DomainStart=min_length_2, DomainEnd=max_length_2)

# ---- group: Manipulate bottom tile rotation/scale according to the Z-height of each tile / Rotation Target
remap_numbers_4 = RemapNumbers(Value=deconstruct_2.ZComponent, Source=z_domain_4, Target=construct_domain_4)  # -> Mapped, Clipped

# ---- group: Manipulate bottom tile rotation/scale according to the Z-height of each tile / Y Size Target
remap_numbers_5 = RemapNumbers(Value=deconstruct_2.ZComponent, Source=z_domain_6, Target=construct_domain_5)  # -> Mapped, Clipped

# ---- group: Manipulate bottom tile rotation/scale according to the Z-height of each tile / X Size Target
remap_numbers_6 = RemapNumbers(Value=deconstruct_2.ZComponent, Source=z_domain_5, Target=construct_domain_6)  # -> Mapped, Clipped

# ---- group: Manipulate bottom tile rotation/scale according to the Z-height of each tile (continued)
rotations_2 = Number(remap_numbers_4.Mapped)
y_scales_2 = Number(remap_numbers_5.Mapped)
x_scales_2 = Number(remap_numbers_6.Mapped)

# ---- group: Use the individual scale/rotational values to modify the base tile (note: each tile is transformed twice)
x_scales_3 = Number(x_scales_2)
y_scales_3 = Number(y_scales_2)
x_scales_4 = Number(x_scales)
y_scales_4 = Number(y_scales)
rotations_3 = Number(rotations_2)
rotations_4 = Number(rotations)
base_tiles_2 = Geometry(base_tiles)
base_planes_2 = Plane(base_planes)
scale_nu = ScaleNU(Geometry=base_tiles_2, Plane=base_planes_2, ScaleX=x_scales_3, ScaleY=y_scales_3, ScaleZ=1)  # -> Geometry, Transform
scale_nu_2 = ScaleNU(Geometry=base_tiles_2, Plane=base_planes_2, ScaleX=x_scales_4, ScaleY=y_scales_4, ScaleZ=1)  # -> Geometry, Transform
rotate = Rotate(Geometry=scale_nu.Geometry, Angle=rotations_3, Plane=base_planes_2)  # -> Geometry, Transform
rotate_2 = Rotate(Geometry=scale_nu_2.Geometry, Angle=rotations_4, Plane=base_planes_2)  # -> Geometry, Transform
rotated_tiles_a = Curve(rotate_2.Geometry)
rotated_tiles_b = Curve(rotate.Geometry)

# ---- group: Quick and Simple Preview of Tile Outlines
rotated_tiles_a_2 = Curve(rotated_tiles_a)
rotated_tiles_b_2 = Curve(rotated_tiles_b)
custom_preview_2 = CustomPreview(Geometry=rotated_tiles_a_2, Material=ColourSwatch(SwatchColor=RGB(255, 255, 255)))
custom_preview_3 = CustomPreview(Geometry=rotated_tiles_b_2, Material=ColourSwatch(SwatchColor=RGB(0, 0, 0)))

# ---- group: Slow and Fancy Preview of Solid Tiles (disabled for speed) / Intersect the two rotations to make a single outline curve
rotated_tiles_a_3 = Curve(rotated_tiles_a)  # disabled
rotated_tiles_b_3 = Curve(rotated_tiles_b)  # disabled
trim_with_region = TrimWithRegion(Curve=rotated_tiles_b_3, Region=rotated_tiles_a_3)  # -> Inside, Outside; disabled
trim_with_region_2 = TrimWithRegion(Curve=rotated_tiles_a_3, Region=rotated_tiles_b_3)  # -> Inside, Outside; disabled
join_curves = JoinCurves(Curves=[trim_with_region_2.Outside, trim_with_region.Outside], Preserve=False)  # disabled

# ---- group: Slow and Fancy Preview of Solid Tiles (disabled for speed)
boundary_surfaces = BoundarySurfaces(Edges=join_curves)  # disabled
colour_swatch_2 = ColourSwatch(SwatchColor=RGB(255, 255, 255))  # disabled
custom_preview_4 = CustomPreview(Geometry=boundary_surfaces, Material=colour_swatch_2)  # disabled
