# Grasshopper definition Groundhog - Keio University Roof Garden.ghx (Grasshopper 1.0.7)
# plug-ins: Groundhog

# ---- group: Planting design
random_seed_for_trees_vs_grasses = Slider(6, range=0..10)
time_years_post_planting = Slider(10, range=0..10)
of_trees_vs_grasses = Slider(0.1, range=0..1)
simulated_time = Integer(time_years_post_planting)
random_seed = Number(random_seed_for_trees_vs_grasses)
of_trees = Number(of_trees_vs_grasses)

# ---- group: Seat elements
seat_height = Slider(500, range=0..1000)
seat_radius = Slider(160, range=0..1000)
seat_height_2 = Number(seat_height)
seat_radius_2 = Number(seat_radius)

# ---- group: Sizes of the holes in each tile type
type_5_diameter = Slider(0, range=0..100)
type_2_diameter = Slider(300, range=0..1000)
type_1_diameter = Slider(375, range=0..1000)
type_4_diameter = Slider(150, range=0..1000)
type_3_diameter = Slider(200, range=0..1000)

# ---- group: Tile dimensions (used for grid spacing)
tile_s_y_dimension = Slider(500, range=250..1000)
tile_s_x_dimension = Slider(500, range=250..1000)

# ---- group: Roof Perimeter
# Groundhog Project File
# This Grasshopper definition and its corresponding Rhinoceros model were developed by Philip Belesky as part of the Groundhog project.
# 
# The definition and model are provided as speculative reverse-engineerings of how this landscape project could have been (partly) designed using computational methods. More information available at https://www.groundhog.la/projects/keio-university-roof-garden/
# 
# This definition depends on components from version v0.10.2b of the Groundhog plugin. It is available for download at http://groundhog.la/plugin/
# 
# After creating this I realised the generative landscapes page had also done a tutorial on this project, checkout this link for their approach: https://generativelandscapes.wordpress.com/2014/11/17/keio-university-roof-garden-michel-desvigne-case-study-02/
bounds_for_geometry = Curve(<curve referenced from the Rhino model>)

# ----
create_grid = CreateGrid(C=bounds_for_geometry, sx=tile_s_y_dimension, sy=tile_s_x_dimension)  # -> C_2, x_2, y_2

# ---- group: Use an image map to assign each type of tile module across the paving grid
# Note: you may need to re-reference this image to the "Keio Billboard" you downloaded along with this definition. Note also that this image was made as a very loose approximation of what is constructed. There is a source image for the sampling provided in Intermediary Natures but it does not seem to correlate to the built design directly.
tile_2_diameter = Integer(type_2_diameter)
tile_5_diameter = Integer(type_5_diameter)
tile_4_diameter = Integer(type_4_diameter)
tile_3_diameter = Integer(type_3_diameter)
tile_1_diameter = Integer(type_1_diameter)
x_tile_count = Integer(create_grid.x_2)
y_tile_count = Integer(create_grid.y_2)
cluster = Cluster(x_pavers_count=x_tile_count, y_pavers_count=y_tile_count)
image_sampler = ImageSampler(
    cluster,
    FilePath="C:\Users\philip\Code\groundhog\projects\keio-university-roof-garden\Keio Billboard.png",
    Filter="Value",
    Interpolate=True,
    Umax=1,
    Umin=0,
    Vmax=1,
    Vmin=0,
    Wrap=1)
list_length = ListLength(List=[tile_5_diameter, tile_4_diameter, tile_3_diameter, tile_2_diameter, tile_1_diameter])
subtraction = Subtraction(A=list_length, B=1)
remap_numbers = RemapNumbers(Value=image_sampler, Source=Domain(0, 1), Target=subtraction)  # -> Mapped, Clipped
round = Round(Number=remap_numbers.Mapped)  # -> Nearest, Floor, Ceiling
pick_n_choose = PickNChoose(
    Pattern=graft(round.Nearest),
    Stream0=tile_5_diameter,
    Stream1=tile_4_diameter,
    Stream2=tile_3_diameter,
    Stream3=tile_2_diameter,
    Stream4=tile_1_diameter)  # -> flatten(Result)
division = Division(A=pick_n_choose, B=2)
tile_radii = Integer(division)

# ---- group: Remove tiles located outside the specified boundary curve
tile_outlines = Geometry(create_grid.C_2)
tiling_boundary = Curve(bounds_for_geometry)
get_centers = GetCenters(cells=tile_outlines)
point_in_curve = PointInCurve(Point=get_centers, Curve=tiling_boundary)  # -> Relationship, Point
equality = Equality(FirstNumber=point_in_curve.Relationship, SecondNumber=2)  # -> Equality, Inequality
cull_pattern = CullPattern(List=tile_radii, CullPattern=equality.Equality)
cull_pattern_2 = CullPattern(List=tile_outlines, CullPattern=equality.Equality)
cull_pattern_3 = CullPattern(List=get_centers, CullPattern=equality.Equality)
tile_outlines_2 = Rectangle(cull_pattern_2)
tile_centers = Point(cull_pattern_3)
tile_radii_2 = Integer(cull_pattern)

# ---- group: Remove tiles to be used for seating
geometry_pipeline = GeometryPipeline(
    GroupByLayer=False,
    GroupByType=False,
    IncludeHidden=True,
    IncludeLocked=True,
    LayerFilter="*Seating Lines",
    NameFilter="*",
    SublayerFiltering=True,
    TypeFilter=4)
tile_outlines_3 = Geometry(tile_outlines_2)
tile_centers_2 = Point(tile_centers)
tile_radii_3 = Integer(tile_radii_2)
list_length_2 = ListLength(List=tile_outlines_3)
explode = Explode(Curve=geometry_pipeline, Recursive=True)  # -> Segments, flatten(Vertices)
series = Series(Start=0, Step=1, Count=list_length_2)
closest_point = ClosestPoint(Point=explode.Vertices, Cloud=tile_centers_2)  # -> ClosestPoint, CPIndex, Distance
list_item = ListItem(List=tile_centers_2, Index=closest_point.CPIndex, Wrap=True)
list_item_2 = ListItem(List=tile_outlines_3, Index=closest_point.CPIndex, Wrap=True)
seated_tile_centers = Point(list_item)
seated_tile_outlines = Geometry(list_item_2)

# ----
number = Number(closest_point.CPIndex)

# ---- group: Remove tiles to be used for seating (continued)
set_difference = SetDifference(SetA=series, SetB=number)
list_item_3 = ListItem(List=tile_outlines_3, Index=set_difference, Wrap=True)
list_item_4 = ListItem(List=tile_radii_3, Index=set_difference, Wrap=True)
list_item_5 = ListItem(List=tile_centers_2, Index=set_difference, Wrap=True)
tile_outlines_4 = Geometry(list_item_3)
tile_radii_4 = Integer(list_item_4)
tile_centers_3 = Point(list_item_5)

# ---- group: Group the tiles into punctured vs normal tiles and create the circle geometry for the punctures
tile_centers_4 = Point(tile_centers_3)
tile_radii_5 = Integer(tile_radii_4)
tile_outlines_5 = Geometry(tile_outlines_4)
equality_2 = Equality(FirstNumber=tile_radii_5, SecondNumber=0)  # -> Equality, Inequality
cull_pattern_4 = CullPattern(List=tile_outlines_5, CullPattern=invert(equality_2.Inequality))
cull_pattern_5 = CullPattern(List=tile_centers_4, CullPattern=equality_2.Inequality)
cull_pattern_6 = CullPattern(List=tile_centers_4, CullPattern=equality_2.Inequality)
cull_pattern_7 = CullPattern(List=tile_outlines_5, CullPattern=equality_2.Inequality)
cull_pattern_8 = CullPattern(List=tile_radii_5, CullPattern=equality_2.Inequality)
circle_cnr = CircleCNR(Center=cull_pattern_6, Normal=Vector(0, 0, 1), Radius=cull_pattern_8)
non_punctured_tile_outlines = Geometry(cull_pattern_4)
punctured_tile_outlines = Geometry(cull_pattern_7)
puncture_centers = Point(cull_pattern_5)
tile_punctures = Geometry(circle_cnr)

# ---- group: Make surface for the punctured tiles
tile_punctures_2 = Geometry(graft(tile_punctures))
punctured_tile_outlines_2 = Geometry(graft(punctured_tile_outlines))
boundary_surfaces = BoundarySurfaces(Edges=[punctured_tile_outlines_2, tile_punctures_2])
custom_preview = CustomPreview(Geometry=boundary_surfaces, Shader=ColourSwatch(SwatchColor=RGB(112, 112, 112)))

# ---- group: Make surface for the normal tiles
# While we could use the more simple Boundary Surface here to make the non-puncuted tiles, it is much slower than making a simple loft between the two parallel edges
non_punctured_tile_outlines_2 = Geometry(non_punctured_tile_outlines)
explode_2 = Explode(Curve=non_punctured_tile_outlines_2, Recursive=True)  # -> Segments, Vertices
list_item_6 = ListItem(List=explode_2.Segments, Index=0, Wrap=True)
list_item_7 = ListItem(List=explode_2.Segments, Index=2, Wrap=True)
flip_curve = FlipCurve(Curve=list_item_7)  # -> Curve, Flag
loft = Loft(
    Curves=[flip_curve.Curve, list_item_6],
    Options={Adjust=False, Closed=False, LoftEnds=0, LoftSimp=0, LoftType=3, Rebuild=10, Refit=0.01})
custom_preview_2 = CustomPreview(Geometry=loft, Shader=ColourSwatch(SwatchColor=RGB(145, 145, 145)))

# ---- group: Assign plant species according to specified proportion and visualise their basic geometry
# Note: the plant types presented here are not accurate to the as-built design/site — they are just used as rough indicators.
puncture_centers_2 = Point(puncture_centers)
of_trees_2 = Number(of_trees)
tree_random_seed = Number(random_seed)
generic_species_attributes = GenericSpeciesAttributes()  # -> Shrub, Grass, Tree
list_length_3 = ListLength(List=puncture_centers_2)
random = Random(Range=Domain(0, 1), Number=list_length_3, Seed=tree_random_seed)
repeat_data = RepeatData(Data=generic_species_attributes.Grass, Length=list_length_3)
repeat_data_2 = RepeatData(Data=generic_species_attributes.Tree, Length=list_length_3)
larger_than = LargerThan(FirstNumber=of_trees_2, SecondNumber=random)  # -> LargerThan, OrEqualTo
cull_pattern_9 = CullPattern(List=repeat_data, CullPattern=invert(larger_than.LargerThan))
cull_pattern_10 = CullPattern(List=repeat_data_2, CullPattern=larger_than.LargerThan)

# ----
jitter = Jitter(List=[cull_pattern_10, cull_pattern_9], Jitter=1, Seed=2)  # -> Values, Indices

# ---- group: Assign plant species according to specified proportion and visualise their basic geometry (continued)
plant_appearance_canopy_mesh = PlantAppearanceCanopyMesh(Species=jitter.Values, Locations=puncture_centers_2, Times=simulated_time, Sides=8)  # -> Canopies, Color, Label
pie_chart = PieChart(plant_appearance_canopy_mesh.Label)
custom_preview_3 = CustomPreview(Geometry=plant_appearance_canopy_mesh.Canopies, Material=plant_appearance_canopy_mesh.Color)

# ---- group: Make solids for the tiles with seats
seat_centers = Point(seated_tile_centers)
seat_radius_3 = Number(seat_radius_2)
seated_tile_outlines_2 = Geometry(graft(seated_tile_outlines))
seat_height_3 = Number(seat_height_2)
circle_cnr_2 = CircleCNR(Center=seat_centers, Normal=Vector(0, 0, 1), Radius=seat_radius_3)
geometry = Geometry(graft(circle_cnr_2))
boundary_surfaces_2 = BoundarySurfaces(Edges=[seated_tile_outlines_2, geometry])

# ----
unit_z = UnitZ(Factor=seat_height_3)
extrude = Extrude(Base=circle_cnr_2, Direction=unit_z)
cap_holes = CapHoles(Brep=extrude)

# ---- group: Make solids for the tiles with seats (continued)
custom_preview_4 = CustomPreview(Geometry=[boundary_surfaces_2, cap_holes], Shader=ColourSwatch(SwatchColor=RGB(158, 157, 157)))

# ==== cluster CreateGrid
C = ClusterInput()
sx = ClusterInput()
sy = ClusterInput()

# ---- group: Create bounds around roof
explode = Explode(Curve=C, Recursive=True)  # -> Segments, Vertices
bnd = Bounds2D(Coordinates=explode.Vertices)
dedom2num = DeconstructDomain²(Domain=bnd)  # -> UMin, UMax, VMin, VMax
pt = ConstructPoint(XCoordinate=dedom2num.UMin, YCoordinate=dedom2num.VMin, ZCoordinate=0)

# ----
subtraction = Subtraction(A=dedom2num.UMax, B=dedom2num.UMin)
subtraction_2 = Subtraction(A=dedom2num.VMax, B=dedom2num.VMin)
division = Division(A=subtraction, B=sx)
division_2 = Division(A=subtraction_2, B=sy)
recgrid = Rectangular(Plane=pt, SizeX=sx, SizeY=sy, ExtentX=division, ExtentY=division_2)  # -> flatten(Cells), Points
y = Integer(division_2)
x = Integer(division)
C_2 = ClusterOutput(recgrid.Cells)
x_2 = ClusterOutput(x)
y_2 = ClusterOutput(y)

# ==== cluster GetCenters
cells = ClusterInput()

# ---- group: Get Cell centers (faster than by using area)
cells_2 = Curve(cells)
point_on_curve = PointOnCurve(cells_2, parameter=0.5)
point_on_curve_2 = PointOnCurve(cells_2, parameter=0)
vector_2pt = Vector2Pt(PointA=point_on_curve_2, PointB=point_on_curve, Unitize=False)  # -> Vector, Length
multiplication = Multiplication(A=vector_2pt.Vector, B=0.5)
move = Move(Geometry=point_on_curve_2, Motion=multiplication)  # -> Geometry, Transform

# ----
geometry = ClusterOutput(move.Geometry)

# ==== cluster Cluster
y_pavers_count = ClusterInput()
x_pavers_count = ClusterInput()
y_pavers_count_2 = Integer(y_pavers_count)
x_pavers_count_2 = Integer(x_pavers_count)
series = Series(Start=0, Step=1, Count=x_pavers_count_2)
series_2 = Series(Start=0, Step=1, Count=y_pavers_count_2)
remap_numbers = RemapNumbers(Value=series_2, Source=y_pavers_count_2, Target=Domain(0, 1))  # -> Mapped, Clipped
remap_numbers_2 = RemapNumbers(Value=series, Source=x_pavers_count_2, Target=Domain(0, 1))  # -> Mapped, Clipped
construct_point = ConstructPoint(XCoordinate=graft(remap_numbers_2.Mapped), YCoordinate=remap_numbers.Mapped, ZCoordinate=0)  # -> flatten(Point)
point = ClusterOutput(construct_point)
