# Grasshopper definition Groundhog - Max IV Laboratory.ghx (Grasshopper 0.9.76)

# ----
# Groundhog Project File
# Definition prepared for Groundhog v0.7.1b and depends on components from that plugin. It is available for download at http://groundhog.la/
# 
# Contact groundhog@philipbelesky.com for support or feedback
# 
# This definition is hosted, along with reference materials, at http://groundhog.la/projects/max-iv-laboratory
# 
# This definition is licensed under the terms of the GPL v3 https://opensource.org/licenses/GPL-3.0
center_point = Point(<point referenced from the Rhino model>)

circle_cnr = CircleCNR(Center=center_point, Normal=Vector(0, 0, 1), Radius=Slider(110000, range=0..1000000))

# ---- group: Rotate the ring slightly to precisely align other tangents
building_façade = Circle(circle_cnr)
rotation = Slider(0.3, range=0..1)
deconstruct_arc = DeconstructArc(Arc=building_façade)  # -> BasePlane, Radius, Angle
rotate = Rotate(Geometry=building_façade, Angle=rotation, Plane=deconstruct_arc.BasePlane)  # -> Geometry, Transform

# ----
curve_count = Slider(64, range=0..100)
curve_length = Slider(413569, range=0..1000000)
curve_points = Slider(38, range=0..100)

# ---- group: Straight tangents
# count of 40 matches basemap
# angle of 221 matches basemap
tangent_extension = Slider(336103, range=100000..400000)
tangent_count = Slider(80, range=0..100)
tangent_rotation = Slider(221, range=0..360)
building_façade_2 = Circle(circle_cnr)
radians = Radians(Degrees=tangent_rotation)
divide_curve = DivideCurve(Curve=building_façade_2, Count=tangent_count, Kinks=False)  # -> Points, Tangents, Parameters
xy_plane = XYPlane(Origin=Point(0, 0, 0))
rotate_2 = Rotate(Vector=divide_curve.Tangents, Axis=xy_plane, Angle=radians)
multiplication = Multiplication(A=rotate_2, B=tangent_extension)
move = Move(Geometry=divide_curve.Points, Motion=multiplication)  # -> Geometry, Transform
line = Line(StartPoint=divide_curve.Points, EndPoint=move.Geometry)

# ---- group: Create tangents
divide_curve_2 = DivideCurve(Curve=rotate.Geometry, Count=curve_count, Kinks=False)  # -> Points, Tangents, Parameters
xy_plane_2 = XYPlane(Origin=Point(0, 0, 0))
multiplication_2 = Multiplication(A=divide_curve_2.Tangents, B=curve_length)
rotate_3 = Rotate(Vector=multiplication_2, Axis=xy_plane_2, Angle=Slider(5.8, range=0..6.2))
move_2 = Move(Geometry=divide_curve_2.Points, Motion=rotate_3)  # -> Geometry, Transform
line_2 = Line(StartPoint=divide_curve_2.Points, EndPoint=move_2.Geometry)

# ---- group: Create Spirals
exagerration = Slider(575137, range=0..1000000)
curve_points_2 = Number(curve_points)
divide_curve_3 = DivideCurve(Curve=line_2, Count=curve_points_2, Kinks=False)  # -> Points, Tangents, Parameters
range = Range(Domain=Domain(0, 1), Steps=curve_points_2)
xy_plane_3 = XYPlane(Origin=Point(0, 0, 0))
curve_arc = GraphMapper(
    range,
    x0=0,
    x1=1,
    y0=0,
    y1=1,
    container_name="Bezier",
    cpx=[0, 0.3315213323, 0.746117115, 1],
    cpy=[0, 0, 0.3666873574, 0.6447191238])
cross_product = CrossProduct(VectorA=xy_plane_3, VectorB=divide_curve_3.Tangents, Unitize=False)  # -> simplify(Vector), Length
curve_arc_2 = GraphMapper(
    range,
    x0=0,
    x1=1,
    y0=0,
    y1=1,
    container_name="Bezier",
    cpx=[0, 0.3315213323, 0.746117115, 1],
    cpy=[0, 0, 0.3666873574, 0.6447191238])  # disabled
multiplication_3 = Multiplication(A=curve_arc, B=exagerration)
multiplication_4 = Multiplication(A=multiplication_3, B=cross_product.Vector)
move_3 = Move(Geometry=simplify(divide_curve_3.Points), Motion=multiplication_4)  # -> Geometry, Transform
interpolate = Interpolate(Vertices=move_3.Geometry, Degree=3, Periodic=False, KnotStyle=1)  # -> Curve, Length, Domain

# ---- group: Trim to Boundary
straight_tangents = Curve(line)  # disabled
site_bounds = Curve(<curve referenced from the Rhino model>)  # disabled
curved_tangents = Curve()  # disabled
curve_curve = CurveCurve(CurveA=site_bounds, CurveB=curved_tangents)  # -> Points, ParamsA, ParamsB; disabled
curve_curve_2 = CurveCurve(CurveA=site_bounds, CurveB=straight_tangents)  # -> Points, ParamsA, ParamsB; disabled
sub_curve = SubCurve(BaseCurve=graft(straight_tangents), Domain=curve_curve_2.ParamsB)  # disabled
sub_curve_2 = SubCurve(BaseCurve=graft(curved_tangents), Domain=curve_curve.ParamsB)  # disabled
straight_tangents_2 = Curve(sub_curve)  # disabled
curved_tangents_2 = Curve(sub_curve_2)  # disabled

straight_tangents_3 = Curve(flatten(line))
curved_tangents_3 = Curve(flatten(interpolate.Curve))
site_bounds_2 = Curve(<curve referenced from the Rhino model>)
curved_tangents_4 = Curve(curved_tangents_3)
straight_tangents_4 = Curve(straight_tangents_3)

# ----
dispatch = Dispatch(List=curved_tangents_4, DispatchPattern=invert([True, False]))  # -> ListA, ListB
dispatch_2 = Dispatch(List=straight_tangents_4, DispatchPattern=[True, False])  # -> ListA, ListB

number_slider = Slider(4500, range=0..10000)  # disabled
number_slider_2 = Slider(22, range=0..100)  # disabled
number_slider_3 = Slider(0, range=0..1000)  # disabled
divide_curve_4 = DivideCurve(Curve=straight_tangents_2, Count=number_slider_2, Kinks=False)  # -> Points, Tangents, Parameters; disabled
deconstruct = Deconstruct(Point=divide_curve_4.Points)  # -> XComponent, YComponent, ZComponent; disabled
repeat_data = RepeatData(Data=[number_slider_3, number_slider], Length=number_slider_2)  # disabled
construct_point = ConstructPoint(XCoordinate=deconstruct.XComponent, YCoordinate=deconstruct.YComponent, ZCoordinate=repeat_data)  # disabled
# This part of the definition is still to be completed. The different tangent curves need to be assembled into a surface and then draining simulations and planting distribution performed. Kangaroo-based simulations of the acoustic spread may also be added.
nurbs_curve = NurbsCurve(Vertices=construct_point, Degree=3, Periodic=False)  # -> Curve, Length, Domain; disabled

number_slider_4 = Slider(4500, range=0..10000)  # disabled
number_slider_5 = Slider(22, range=0..100)  # disabled
number_slider_6 = Slider(0, range=0..1000)  # disabled
divide_curve_5 = DivideCurve(Curve=curved_tangents_2, Count=number_slider_5, Kinks=False)  # -> Points, Tangents, Parameters; disabled
deconstruct_2 = Deconstruct(Point=divide_curve_5.Points)  # -> XComponent, YComponent, ZComponent; disabled
repeat_data_2 = RepeatData(Data=[number_slider_6, number_slider_4], Length=number_slider_5)  # disabled
construct_point_2 = ConstructPoint(XCoordinate=deconstruct_2.XComponent, YCoordinate=deconstruct_2.YComponent, ZCoordinate=repeat_data_2)  # disabled
nurbs_curve_2 = NurbsCurve(Vertices=construct_point_2, Degree=3, Periodic=False)  # -> Curve, Length, Domain; disabled

custom_preview = CustomPreview(Geometry=dispatch_2.ListA, Shader=ColourSwatch(SwatchColor=RGB(59, 255, 255)))
custom_preview_2 = CustomPreview(Geometry=dispatch_2.ListB, Shader=ColourSwatch(SwatchColor=RGB(250, 141, 255)))
custom_preview_3 = CustomPreview(Geometry=dispatch.ListA, Shader=ColourSwatch(SwatchColor=RGB(59, 255, 255)))
custom_preview_4 = CustomPreview(Geometry=dispatch.ListB, Shader=ColourSwatch(SwatchColor=RGB(250, 141, 255)))

# ---- group: Find intersections
curve = Curve(dispatch.ListB)
curve_2 = Curve(dispatch_2.ListB)
curve_3 = Curve(dispatch_2.ListA)
custom_preview_5 = CustomPreview(
    Geometry=[dispatch_2.ListA, dispatch.ListA],
    Shader={ambient=RGB(0, 0, 0), diffuse=RGB(255, 105, 180), emission=RGB(76, 32, 54), shine=0.5, specular=RGB(255, 255, 255), transparency=0})
curve_4 = Curve(dispatch.ListA)
custom_preview_6 = CustomPreview(
    Geometry=[dispatch_2.ListB, dispatch.ListB],
    Shader={ambient=RGB(0, 0, 0), diffuse=RGB(255, 105, 180), emission=RGB(76, 32, 54), shine=0.5, specular=RGB(255, 255, 255), transparency=0})
curve_curve_3 = CurveCurve(CurveA=graft(curve_4), CurveB=curve_3)  # -> Points, ParamsA, ParamsB
curve_curve_4 = CurveCurve(CurveA=graft(curve), CurveB=curve_2)  # -> Points, ParamsA, ParamsB
trim_tree = TrimTree(Tree=curve_curve_3.Points, Depth=1)  # -> simplify(Tree)
trim_tree_2 = TrimTree(Tree=curve_curve_4.Points, Depth=1)  # -> simplify(Tree)

# ----
tree_branch = TreeBranch(Tree=trim_tree, Path=Slider(26, range=0..100), MaintainPaths=True)

# ---- group: Rebuild the curves to have a precise order that matches the original (CCX messes this up)
polyline = PolyLine(Vertices=trim_tree_2, Closed=True)
explode = Explode(Curve=polyline, Recursive=True)  # -> Segments, Vertices
length = Length(Curve=explode.Segments)
list_length = ListLength(List=explode.Segments)
sort_list = SortList(Keys=length, ValuesValuesA=explode.Segments)  # -> Keys, ValuesValuesA
subtraction = Subtraction(A=list_length, B=1)
split_list = SplitList(List=sort_list.ValuesValuesA, Index=subtraction)  # -> ListA, ListB
join_curves = JoinCurves(Curves=split_list.ListA, Preserve=False)
explode_2 = Explode(Curve=join_curves, Recursive=True)  # -> Segments, Vertices

# ----
number_slider_7 = Slider(4500, range=0..10000)  # disabled
number_slider_8 = Slider(22, range=0..100)  # disabled
number_slider_9 = Slider(0, range=0..1000)  # disabled
divide_curve_6 = DivideCurve(Curve=straight_tangents_4, Count=number_slider_8, Kinks=False)  # -> Points, Tangents, Parameters; disabled
deconstruct_3 = Deconstruct(Point=divide_curve_6.Points)  # -> XComponent, YComponent, ZComponent; disabled
repeat_data_3 = RepeatData(Data=[number_slider_9, number_slider_7], Length=number_slider_8)  # disabled
construct_point_3 = ConstructPoint(XCoordinate=deconstruct_3.XComponent, YCoordinate=deconstruct_3.YComponent, ZCoordinate=repeat_data_3)  # disabled
polyline_2 = PolyLine(Vertices=construct_point_3, Closed=False)  # disabled

# ---- group: Rebuild the curves to have a precise order that matches the original (CCX messes this up)
polyline_3 = PolyLine(Vertices=trim_tree, Closed=True)
explode_3 = Explode(Curve=polyline_3, Recursive=True)  # -> Segments, Vertices
length_2 = Length(Curve=explode_3.Segments)
list_length_2 = ListLength(List=explode_3.Segments)
sort_list_2 = SortList(Keys=length_2, ValuesValuesA=explode_3.Segments)  # -> Keys, ValuesValuesA
subtraction_2 = Subtraction(A=list_length_2, B=1)
split_list_2 = SplitList(List=sort_list_2.ValuesValuesA, Index=subtraction_2)  # -> ListA, ListB
join_curves_2 = JoinCurves(Curves=split_list_2.ListA, Preserve=False)

# ----
curved_tangents_5 = Curve(curved_tangents_4)  # disabled

number_slider_10 = Slider(0, range=0..1000)  # disabled
height_of_mounds = Slider(25000, range=0..100000)  # disabled
number_slider_11 = Slider(22, range=0..100)  # disabled
divide_curve_7 = DivideCurve(Curve=curved_tangents_5, Count=number_slider_11, Kinks=False)  # -> Points, Tangents, Parameters; disabled
deconstruct_4 = Deconstruct(Point=divide_curve_7.Points)  # -> XComponent, YComponent, ZComponent; disabled
repeat_data_4 = RepeatData(Data=[number_slider_10, height_of_mounds], Length=number_slider_11)  # disabled
construct_point_4 = ConstructPoint(XCoordinate=deconstruct_4.XComponent, YCoordinate=deconstruct_4.YComponent, ZCoordinate=repeat_data_4)  # disabled

polyline_4 = PolyLine(Vertices=construct_point_4, Closed=False)  # disabled
explode_4 = Explode(Curve=polyline_4, Recursive=True)  # -> Segments, simplify(Vertices); disabled

# ---- group: Create Mount Heights
curve_5 = Curve(explode_2.Segments)
point_on_curve = PointOnCurve(curve_5, parameter=0.5)
point_on_curve_2 = PointOnCurve(curve_5, parameter=0)
mount_height_increase = Slider(500, range=0..1000)
list_length_3 = ListLength(List=point_on_curve_2)
series = Series(Start=0, Step=mount_height_increase, Count=list_length_3)
panel = Panel(series)
unit_z = UnitZ(Factor=series)
move_4 = Move(Geometry=point_on_curve_2, Motion=unit_z)  # -> Geometry, Transform
weave = Weave(Pattern=[0, 1], Stream0=move_4.Geometry, Stream1=point_on_curve, NullGaps=False)  # -> simplify(Weave)

# ----
surface_from_points = SurfaceFromPoints(Points=flatten(explode_4.Vertices), UCount=curve_count, Interpolate=True)  # disabled
explode_5 = Explode(Curve=join_curves_2, Recursive=True)  # -> Segments, Vertices
curve_6 = Curve(explode_5.Segments)
point_on_curve_3 = PointOnCurve(curve_6, parameter=0.5)
point_on_curve_4 = PointOnCurve(curve_6, parameter=0)
weave_2 = Weave(Pattern=[0, 1], Stream0=point_on_curve_4, Stream1=point_on_curve_3, NullGaps=False)  # -> simplify(Weave)
trim_tree_3 = TrimTree(Tree=curve_curve_3.Points, Depth=1)  # disabled
panel_2 = Panel(trim_tree_3)  # disabled
point_list = PointList(Points=flatten([trim_tree_3, trim_tree_2]), Size=Slider(7120, range=0..100000))  # disabled

# ---- group: Assemble curves for loft
end_points = EndPoints(Curve=curve)  # -> simplify(graft(Start)), simplify(graft(End))
end_points_2 = EndPoints(Curve=curve_4)  # -> simplify(graft(Start)), simplify(graft(End))
merge = Merge(Data1=end_points.Start, Data2=weave, Data3=end_points.End)
merge_2 = Merge(Data1=end_points_2.Start, Data2=weave_2, Data3=end_points_2.End)
interpolate_2 = Interpolate(Vertices=merge_2, Degree=3, Periodic=False, KnotStyle=1)  # -> Curve, Length, Domain
interpolate_3 = Interpolate(Vertices=merge, Degree=3, Periodic=False, KnotStyle=1)  # -> Curve, Length, Domain
weave_3 = Weave(Pattern=[0, 1], Stream0=flatten(interpolate_3.Curve), Stream1=flatten(interpolate_2.Curve), NullGaps=False)
loft = Loft(Curves=flatten(weave_3), Options={Adjust=False, Closed=True, LoftEnds=0, LoftSimp=0, LoftType=0, Rebuild=10, Refit=0.01})

# ----
polyline_5 = PolyLine(Vertices=trim_tree_2, Closed=False)  # -> flatten(Polyline); disabled
polyline_6 = PolyLine(Vertices=trim_tree_3, Closed=False)  # -> flatten(Polyline); disabled
number_slider_12 = Slider(39584, range=0..100000)  # disabled
polyline_7 = PolyLine(Vertices=trim_tree_2, Closed=False)  # -> flatten(Polyline); disabled
polyline_8 = PolyLine(Vertices=trim_tree_3, Closed=False)  # -> flatten(Polyline); disabled
number_slider_13 = Slider(10, range=0..10)  # disabled
number_slider_14 = Slider(22, range=0..100)  # disabled
weave_4 = Weave(Pattern=[0, 1], Stream0=polyline_8, Stream1=polyline_7, NullGaps=False)  # disabled
divide_length = DivideLength(Curve=weave_4, Length=number_slider_12)  # -> Points, Tangents, Parameters; disabled
list_item = ListItem(List=weave_4, Index=number_slider_14, Wrap=True)  # disabled
number_slider_15 = Slider(79, range=0..100)  # disabled
explode_6 = Explode(Curve=list_item, Recursive=True)  # -> Segments, Vertices; disabled
number_slider_16 = Slider(5, range=0..10)  # disabled
number_slider_17 = Slider(2000, range=0..10000)
number_slider_18 = Slider(20, range=0..100)
flip_matrix = FlipMatrix(Data=explode_6.Vertices)  # disabled
sub_list = SubList(List=explode_6.Vertices, Domain=number_slider_16, Wrap=False)  # -> List, Index
surface_from_points_2 = SurfaceFromPoints(Points=flatten(explode_6.Vertices), UCount=number_slider_15, Interpolate=True)
divide_surface = DivideSurface(Surface=loft, UCount=number_slider_18, VCount=number_slider_18)  # -> Points, Normals, Parameters
panel_3 = Panel(explode_6.Vertices)
iso_curve = IsoCurve(Surface=loft, UVPoint=divide_surface.Parameters)  # -> UIsocurve, VIsocurve
