# Grasshopper definition Max IV Laboratory.gh (Grasshopper 1.0.4)

panel = Panel("40 straight lines; 32 curvesd lines")
center_point = Point(<point referenced from the Rhino model>)
circle = CircleCNR(Center=center_point, Normal=Vector(0, 0, 1), Radius=Slider(110000, range=0..1000000))

# ---- group: Curved Segments
curve_length = Slider(10, range=0..100)
curve_points = Slider(20, range=0..100)
dom = ConstructDomain(DomainStart=0, DomainEnd=curve_length)
divide = DivideCurve(Curve=circle, Count=Slider(32, range=0..100), Kinks=False)  # -> Points, Tangents, Parameters
range = Range(Domain=dom, Steps=curve_points)
graph = GraphMapper(
    range,
    x0=0,
    x1=10,
    y0=0,
    y1=2,
    container_name="Bezier",
    cpx=[0, 0.1810597032, 0.5611973405, 1],
    cpy=[0, 0.8286336064, 0.8465806842, 0.5773736835])
multiplication = Multiplication(A=graph, B=-1)
origin = Point(graft(divide.Points))
vec = Vector(graft(divide.Tangents))
vec_2 = VectorXYZ(XComponent=range, YComponent=multiplication, ZComponent=0)  # -> Vector, Length
scaling = Slider(46241, range=0..100000)
xy = XYPlane(Origin=origin)
align = AlignPlane(Plane=xy, Direction=vec)  # -> Plane, Angle
multiplication_2 = Multiplication(A=vec_2.Vector, B=scaling)
move = Move(Geometry=origin, Motion=multiplication_2)  # -> Geometry, Transform
subtraction = Subtraction(A=align.Angle, B=Slider(5.8, range=0..10))
intcrv = Interpolate(Vertices=move.Geometry, Degree=3, Periodic=False, KnotStyle=1)  # -> Curve, Length, Domain
rotate = Rotate(Geometry=intcrv.Curve, Angle=subtraction, Plane=align.Plane)  # -> Geometry, Transform

# ---- group: Straight tangents
xy_2 = XYPlane(Origin=Point(0, 0, 0))
divide_2 = DivideCurve(Curve=circle, Count=Slider(40, range=0..100), Kinks=False)  # -> Points, Tangents, Parameters
rad = Radians(Degrees=Slider(194, range=0..360))
vrot = Rotate(Vector=divide_2.Tangents, Axis=xy_2, Angle=rad)
multiplication_3 = Multiplication(A=vrot, B=Slider(400000, range=100000..400000))
move_2 = Move(Geometry=divide_2.Points, Motion=multiplication_3)  # -> Geometry, Transform
ln = Line(StartPoint=divide_2.Points, EndPoint=move_2.Geometry)
