# Grasshopper definition Groundhog - Sony Forest.ghx (Grasshopper 1.0.7)
# plug-ins: Groundhog

# ---- group: Paver sizes determine the overall paving grid
paver_y_grid_spacing = Slider(3000, range=0..10000)
paver_x_grid_spacing = Slider(3000, range=0..10000)
paver_y_grid_spacing_2 = Integer(paver_y_grid_spacing)
paver_x_grid_spacing_2 = Integer(paver_x_grid_spacing)

# ---- group: Planting parameter determine plant density and shown state
simulated_time = Slider(17, range=0..30)
# Jump to parameters
# for plant clustering
seed_count = Slider(5000, range=0..10000)
simulated_time_2 = Number(simulated_time)
seed_count_2 = Number(seed_count)

# ---- group: Controls how much the planting attractors manipulate the random seed placement
minimum_distance = Slider(5409, range=0..20000)
attractor_force = Slider(0.17, range=0..1)
minimum_distance_2 = Number(minimum_distance)
attractor_force_2 = Number(attractor_force)

# ----
geometry_pipeline = GeometryPipeline(
    GroupByLayer=False,
    GroupByType=False,
    IncludeHidden=True,
    IncludeLocked=True,
    LayerFilter="*Planting Attractors",
    NameFilter="*",
    SublayerFiltering=True,
    TypeFilter=1)
# Groundhog Project File
# This Grasshopper definition and its corresponding Rhinoceros model were developed by Albert Rex and Philip Belesky as part of the Groundhog project.
# 
# The definition and model are provided as speculative reverse-engineerings of how this landscape project could have been (partly) designed using computational methods. More information available at https://groundhog.philipbelesky.com/projects/sony-forest/
# 
# This definition depends on components from version v0.13.0 of the Groundhog plugin. It is available for download at http://groundhog.philipbelesky.com/plugin/
# 
# It also uses components from Ladybug. That plugin is available for download at http://ladybug.tools
base_terrain_surface = Surface(<surface referenced from the Rhino model>)
base_terrain_surface_2 = Surface(base_terrain_surface)
base_terrain_mesh = Mesh(base_terrain_surface)
planting_attractors = Point(geometry_pipeline)

# ---- group: Buildings in and around site inform solar analysis
geometry_pipeline_2 = GeometryPipeline(
    GroupByLayer=False,
    GroupByType=False,
    IncludeHidden=True,
    IncludeLocked=True,
    LayerFilter="*Building Volumes",
    NameFilter="*",
    SublayerFiltering=True,
    TypeFilter=1073741848)
geometry_pipeline_3 = GeometryPipeline(
    GroupByLayer=False,
    GroupByType=False,
    IncludeHidden=True,
    IncludeLocked=True,
    LayerFilter="*Other Buildings",
    NameFilter="*",
    SublayerFiltering=True,
    TypeFilter=1073741848)
building_volumes = Geometry(geometry_pipeline_2)
building_volumes_context = Geometry(geometry_pipeline_3)

# ---- group: Project Attractor Points onto Mesh
unit_z = UnitZ(Factor=1)
base_terrain_mesh_2 = Mesh(base_terrain_mesh)
planting_attractors_2 = Point(planting_attractors)
reverse = Reverse(Vector=unit_z)
mesh_ray = MeshRay(Mesh=base_terrain_mesh_2, Point=planting_attractors_2, Direction=unit_z)  # -> Point, Hit
mesh_ray_2 = MeshRay(Mesh=base_terrain_mesh_2, Point=planting_attractors_2, Direction=reverse)  # -> Point, Hit
cull_pattern = CullPattern(List=mesh_ray_2.Point, CullPattern=mesh_ray_2.Hit)
cull_pattern_2 = CullPattern(List=mesh_ray.Point, CullPattern=mesh_ray.Hit)
planting_attractors_on_terrain = Point([cull_pattern_2, cull_pattern])

# ---- group: Scatter seeds over landform
seed_count_3 = Number(seed_count_2)
base_terrain_mesh_3 = Mesh(base_terrain_mesh)
populate_geometry = PopulateGeometry(Geometry=base_terrain_mesh_3, Count=seed_count_3, Seed=1)
seed_points = Point(populate_geometry)

# ---- group: Produce shading analysis of the site area
# This is a very crude approximation of the "Environmental Analysis" stage described by ANS studio, which included further analysis of wind and soil suitability alongside various urban conditions.
# 
# Note also that this analysis has been limited to a very short term period and a very coarse grid size so the definition is quick to load.
# 
# Location data for the Tokyo site has been internalised into the sunPath component.
# To ensure the definition doesn't freeze on opening the full year-long shading analysis has been precalculated and internalised. To generate the analysis from scratch you'll Meed to Enable all the components to the left, change the date/time range, and rewire the results/mesh outputs.
building_volumes_onsite = Geometry(building_volumes)
building_volumes_context_2 = Geometry(building_volumes_context)
base_terrain_surface_3 = Geometry(base_terrain_surface_2)
panel = Panel("1")  # disabled
panel_2 = Panel("1")  # disabled
panel_3 = Panel("1")  # disabled
panel_4 = Panel("12")  # disabled
panel_5 = Panel("31")  # disabled
panel_6 = Panel("23")  # disabled
analysisperiod = Ladybug_AnalysisPeriod(fromMonth=panel, fromDay=panel_2, fromHour=panel_3, toMonth=panel_4, toDay=panel_5, toHour=panel_6)  # -> out, analysisPeriod; disabled; plug-in component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
ladybug = Ladybug_Ladybug()  # -> out; disabled; plug-in component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
sunpath = Ladybug_SunPath(
    location="""Site:Location,
Tokyo_Tokyo_JPN,
35.70000,      !Latitude
139.8000,     !Longitude
9.0,     !Time Zone
5.0;       !Elevation""",
    hour=12,
    day=21,
    month=12,
    timeStep=1,
    analysisPeriod=analysisperiod.analysisPeriod,
    dailyOrAnnualSunPath=True)  # -> out, sunVectors, sunAltitudes, sunAzimuths, port, sunSpheresMesh, sunPathCrvs, compassCrvs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; disabled; plug-in component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
sunlighthoursanalysis = Ladybug_SunlightHoursAnalysis(
    geometry=flatten(base_terrain_surface_3),
    context=flatten([building_volumes_onsite, building_volumes_context_2]),
    gridSize=Slider(3000, range=0..10000),
    disFromBase=Slider(1000, range=0..1000),
    sunVectors=flatten(sunpath.sunVectors),
    timeStep=1,
    parallel=Toggle(True),
    runIt=Toggle(True))  # -> out, contextMesh, analysisMesh, testPts, testVec, port, sunlightHoursResult, sunlightHoursMesh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; disabled; plug-in component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
sunlight_hours_precalculated = Number([1591, 1577, 1590, 1589, 1593, 1587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])
analysis_mesh_precalculated = Mesh(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)
sunlight_hours = Number(sunlight_hours_precalculated)
analysis_mesh = Mesh(analysis_mesh_precalculated)

# ---- group: Remove seeds too far from attractor points and pull points to attractors
seed_points_2 = Point(seed_points)
attractor_force_3 = Number(attractor_force_2)
planting_attractors_3 = Point(planting_attractors_on_terrain)
minimum_distance_3 = Number(minimum_distance_2)
closest_point = ClosestPoint(Point=seed_points_2, Cloud=planting_attractors_3)  # -> ClosestPoint, CPIndex, Distance
larger_than = LargerThan(FirstNumber=minimum_distance_3, SecondNumber=closest_point.Distance)  # -> LargerThan, OrEqualTo
cull_pattern_3 = CullPattern(List=closest_point.ClosestPoint, CullPattern=larger_than.LargerThan)
cull_pattern_4 = CullPattern(List=seed_points_2, CullPattern=larger_than.LargerThan)
vector_2pt = Vector2Pt(PointA=cull_pattern_4, PointB=cull_pattern_3, Unitize=False)  # -> Vector, Length
multiplication = Multiplication(A=vector_2pt.Vector, B=attractor_force_3)
move = Move(Geometry=cull_pattern_4, Motion=multiplication)  # -> Geometry, Transform
seed_points_3 = Point(move.Geometry)

# ---- group: Divide up surface using the predefined grid distance (won't be perfectly square; but good enough)
base_terrain_surface_4 = Surface(base_terrain_surface_2)
paver_x_grid_spacing_3 = Integer(paver_x_grid_spacing_2)
paver_y_grid_spacing_3 = Integer(paver_y_grid_spacing_2)
dimensions = Dimensions(Surface=base_terrain_surface_4)  # -> UDimension, VDimension
division = Division(A=dimensions.VDimension, B=paver_x_grid_spacing_3)
division_2 = Division(A=dimensions.UDimension, B=paver_y_grid_spacing_3)
mesh_surface = MeshSurface(Surface=base_terrain_surface_4, UCount=division_2, VCount=division, Overhang=True, Equalize=False)
flip_mesh = FlipMesh(Mesh=mesh_surface, VertexNormals=True, FaceNormals=True, FaceOrientation=True)
face_normals = FaceNormals(Mesh=flip_mesh)  # -> Centers, Normals
paving_origins = Point(face_normals.Centers)

# ---- group: Remove seeds from inside buildings
seed_points_4 = Point(seed_points_3)
building_volumes_2 = Geometry(building_volumes)
point_in_breps = PointInBreps(Brep=building_volumes_2, Point=seed_points_4, Strict=False)  # -> Inside, Index
cull_pattern_5 = CullPattern(List=seed_points_4, CullPattern=invert(point_in_breps.Inside))
seed_points_5 = Point(cull_pattern_5)

# ---- group: Cluster the groups of seeds and allocate tree seeds to areas in the center
# The data tree manipulation here allows us to classify the seeds by microclimate but later on separate them back out to canopy vs subcanopy types
trees_per_m2_in_cluster = Slider(2000, range=0..10000)
of_cluster_for_trees = Slider(0.6, range=0..1)
minimum_cluster_size = Slider(2060, range=1000..4000)
seed_points_6 = Point(seed_points_5)
point_groups = PointGroups(Points=seed_points_6, Distance=minimum_cluster_size)  # -> Groups, Indices
prune_tree = PruneTree(Tree=point_groups.Groups, Minimum="3", Maximum=0)
convex_hull = ConvexHull(Points=prune_tree, Plane=PlaneXY(0, 0, 0))  # -> Hull, HullZ, Indices
area = Area(Geometry=convex_hull.Hull)  # -> Area, Centroid
square_root = SquareRoot(Value=area.Area)
division_3 = Division(A=square_root, B=trees_per_m2_in_cluster)
scale = Scale(Geometry=convex_hull.Hull, Center=area.Centroid, Factor=of_cluster_for_trees)  # -> Geometry, Transform
round = Round(Number=division_3)  # -> Nearest, Floor, Ceiling
populate_2d = Populate2D(Region=scale.Geometry, Count=round.Floor, Seed=1)
sub_canopy_seeds = Point(prune_tree)
canopy_seeds = Point(populate_2d)
entwine = Entwine(Branch00=canopy_seeds, Branch01=sub_canopy_seeds, FlattenInputs=True)
cluster_borders = Geometry([scale.Geometry, convex_hull.Hull])
all_seeds = Point(entwine)

# ---- group: Make Tiles
seed_points_7 = Point(seed_points_5)
paving_origins_2 = Point(paving_origins)
base_terrain_surface_5 = Surface(base_terrain_surface_2)
bounding_box = BoundingBox(Content=base_terrain_surface_5, Plane=PlaneXY(0, 0, 0), UnionBox=True)  # -> Box, Box_2
voronoi = Voronoi(Points=flatten([paving_origins_2, seed_points_7]), Boundary=bounding_box.Box, BruteForceOverride=False)
list_length = ListLength(List=paving_origins_2)
split_list = SplitList(List=voronoi, Index=list_length)  # -> ListA, ListB
unplanted_tiles = Geometry(split_list.ListA)
planted_tiles = Geometry(split_list.ListB)

# ----
building_volumes_3 = Geometry(building_volumes)

# ---- group: Match Seeds with Sunlight hours
analysis_mesh_2 = Mesh(analysis_mesh)
sunlight_hours_2 = Number(sunlight_hours)
seed_points_8 = Point(all_seeds)
face_normals_2 = FaceNormals(Mesh=analysis_mesh_2)  # -> Centers, Normals
closest_point_2 = ClosestPoint(Point=seed_points_8, Cloud=face_normals_2.Centers)  # -> ClosestPoint, CPIndex, Distance
list_item = ListItem(List=sunlight_hours_2, Index=closest_point_2.CPIndex, Wrap=True)
light_hours_per_seed_point = Integer(list_item)

# ---- group: Classify seeds according to microclimate
light_hours_per_seed_point_2 = Integer(light_hours_per_seed_point)
seed_points_9 = Point(all_seeds)
sort_list = SortList(Keys=light_hours_per_seed_point_2, ValuesValuesA=seed_points_9)  # -> Keys, ValuesValuesA
list_length_2 = ListLength(List=seed_points_9)
multiplication_2 = Multiplication(A=list_length_2, B="0.5")
split_list_2 = SplitList(List=sort_list.ValuesValuesA, Index=multiplication_2)  # -> ListA, ListB
bottom_50_light_conditions = Point(split_list_2.ListA)
top_50_light_conditions = Point(split_list_2.ListB)

# ---- group: Allocate the palette according to light % and canopy vs subcanopy layers
tree = ControlKnob(Decimals=0, Limit=True, Maximum=100, Minimum=0, Range=100, Value=21)
tree_2 = ControlKnob(Decimals=0, Limit=True, Maximum=100, Minimum=0, Range=100, Value=100)
shrub = ControlKnob(Decimals=0, Limit=True, Maximum=100, Minimum=0, Range=100, Value=84)
grass = ControlKnob(Decimals=0, Limit=True, Maximum=100, Minimum=0, Range=100, Value=21)
shrub_2 = ControlKnob(Decimals=0, Limit=True, Maximum=100, Minimum=0, Range=100, Value=33)
grass_2 = ControlKnob(Decimals=0, Limit=True, Maximum=100, Minimum=0, Range=100, Value=68)
top_33_light_conditions = Point(top_50_light_conditions)
bottom_33_light_conditions = Point(bottom_50_light_conditions)
explode_tree = ExplodeTree(Data=bottom_33_light_conditions)  # -> Branch0, Branch1
explode_tree_2 = ExplodeTree(Data=top_33_light_conditions)  # -> Branch0, Branch1
sub_canopy_seeds_2 = Point(explode_tree.Branch1)
sub_canopy_seeds_3 = Point(explode_tree_2.Branch1)
canopy_seeds_2 = Point(explode_tree.Branch0)
canopy_seeds_3 = Point(explode_tree_2.Branch0)
species_proportions = SpeciesProportions(list=canopy_seeds_2, tree_ratio=tree)  # -> locations_per_plant_2, species_per_plant_2
species_proportions_2 = SpeciesProportions(list=sub_canopy_seeds_2, shrub_ratio=shrub_2, grass_ratio=grass_2)  # -> locations_per_plant_2, species_per_plant_2
species_proportions_3 = SpeciesProportions(list=canopy_seeds_3, tree_ratio=tree_2)  # -> locations_per_plant_2, species_per_plant_2
species_proportions_4 = SpeciesProportions(list=sub_canopy_seeds_3, shrub_ratio=shrub, grass_ratio=grass)  # -> locations_per_plant_2, species_per_plant_2
sub_canopy_seeds_4 = Point([species_proportions_2.locations_per_plant_2, species_proportions_4.locations_per_plant_2])
subcanopy_species = Data([species_proportions_2.species_per_plant_2, species_proportions_4.species_per_plant_2])
canopy_seeds_4 = Point([species_proportions.locations_per_plant_2, species_proportions_3.locations_per_plant_2])
canopy_species = Data([species_proportions.species_per_plant_2, species_proportions_3.species_per_plant_2])

# ---- group: Visualise canopy species
unit_z_2 = UnitZ(Factor=1)
seed_species = Data(canopy_species)
seed_locations = Point(canopy_seeds_4)
simulated_time_3 = Number(simulated_time_2)
base_terrain_surface_6 = Surface(base_terrain_surface_2)
mesh_ray_3 = MeshRay(Mesh=base_terrain_surface_6, Point=seed_locations, Direction=unit_z_2)  # -> Point, Hit
plant_appearance_canopy_mesh = PlantAppearanceCanopyMesh(Species=seed_species, Locations=mesh_ray_3.Point, Times=simulated_time_3, Sides=4)  # -> Canopies, Color, Label
custom_preview = CustomPreview(Geometry=plant_appearance_canopy_mesh.Canopies, Material=plant_appearance_canopy_mesh.Color)

# ---- group: Visualise subcanopy species
seed_species_2 = Data(subcanopy_species)
seed_locations_2 = Point(sub_canopy_seeds_4)
simulated_time_4 = Number(simulated_time_2)
plant_appearance_canopy_mesh_2 = PlantAppearanceCanopyMesh(Species=seed_species_2, Locations=seed_locations_2, Times=simulated_time_4, Sides=4)  # -> Canopies, Color, Label
custom_preview_2 = CustomPreview(Geometry=plant_appearance_canopy_mesh_2.Canopies, Material=plant_appearance_canopy_mesh_2.Color)

# ---- group: Remove cells outside site boundary and inside buildings
planted_tiles_2 = Geometry(planted_tiles)
unplanted_tiles_2 = Geometry(unplanted_tiles)
base_terrain_surface_7 = Surface(base_terrain_surface_2)
cluster = Cluster(brep=base_terrain_surface_7, curve_a=unplanted_tiles_2, list=planted_tiles_2)  # -> list_2, list_3
planted_tiles_3 = Geometry(cluster.list_3)
planted_tiles_4 = Geometry(planted_tiles_3)

# ----
unplanted_tiles_3 = Geometry(cluster.list_2)
point_on_curve = PointOnCurve(unplanted_tiles_3, parameter=0.5)

# ---- group: Visualise ground
unplanted_tiles_edges = Geometry(planted_tiles_4)
base_terrain_surface_8 = Surface(base_terrain_surface_2)
explode = Explode(Curve=unplanted_tiles_edges, Recursive=True)  # -> Segments, Vertices
cull_index = CullIndex(List=explode.Vertices, Indices="0", Wrap=True)
unit_z_3 = UnitZ(Factor=1)
mesh_ray_4 = MeshRay(Mesh=base_terrain_surface_8, Point=cull_index, Direction=unit_z_3)  # -> Point, Hit
clean_tree = CleanTree(RemoveNulls=True, RemoveInvalid=True, RemoveEmpty=False, Tree=mesh_ray_4.Point)
prune_tree_2 = PruneTree(Tree=clean_tree, Minimum="3", Maximum=0)
delaunay_mesh = DelaunayMesh(Points=prune_tree_2, Plane=PlaneXY(0, 0, 0))
custom_preview_3 = CustomPreview(Geometry=delaunay_mesh, Material=ColourSwatch(SwatchColor=RGB(143, 43, 0)))

# ---- group: Remove cells outside site boundary and inside buildings (continued)
point_in_breps_2 = PointInBreps(Brep=building_volumes_3, Point=point_on_curve, Strict=False)  # -> Inside, Index

# ----
cull_pattern_6 = CullPattern(List=unplanted_tiles_3, CullPattern=invert(point_in_breps_2.Inside))

# ---- group: Remove cells outside site boundary and inside buildings (continued)
unplanted_tiles_4 = Geometry(cull_pattern_6)

# ---- group: Visualise tiles
unplanted_tiles_edges_2 = Geometry(unplanted_tiles_4)
base_terrain_surface_9 = Surface(base_terrain_surface_2)
explode_2 = Explode(Curve=unplanted_tiles_edges_2, Recursive=True)  # -> Segments, Vertices
cull_index_2 = CullIndex(List=explode_2.Vertices, Indices="0", Wrap=True)
unit_z_4 = UnitZ(Factor=1)
mesh_ray_5 = MeshRay(Mesh=base_terrain_surface_9, Point=cull_index_2, Direction=unit_z_4)  # -> Point, Hit
clean_tree_2 = CleanTree(RemoveNulls=True, RemoveInvalid=True, RemoveEmpty=False, Tree=mesh_ray_5.Point)
prune_tree_3 = PruneTree(Tree=clean_tree_2, Minimum="3", Maximum=0)
delaunay_mesh_2 = DelaunayMesh(Points=prune_tree_3, Plane=PlaneXY(0, 0, 0))
custom_preview_4 = CustomPreview(Geometry=delaunay_mesh_2, Material=ColourSwatch(SwatchColor=RGB(74, 74, 74)))

# ----
mesh_edges = MeshEdges(Mesh=delaunay_mesh_2)  # -> NakedEdges, InteriorEdges, NonManifoldEdges

# ---- group: Visualise tiles (continued)
custom_preview_5 = CustomPreview(Geometry=mesh_edges.NakedEdges, Material=ColourSwatch(SwatchColor=RGB(255, 255, 255)))

# ==== cluster SpeciesProportions
shrub_ratio = ClusterInput()
grass_ratio = ClusterInput()
tree_ratio = ClusterInput()
list = ClusterInput()
shrub_ratio_2 = Number(shrub_ratio)
tree_ratio_2 = Number(tree_ratio)
grass_ratio_2 = Number(grass_ratio)
jitter = Jitter(List=list, Jitter=1, Seed=2)  # -> Values, Indices
generic_species = GenericSpecies()  # -> ShrubS, GrassS, TreeS
addition = Addition(A=tree_ratio_2, B=0)
addition_2 = Addition(A=shrub_ratio_2, B=0)
addition_3 = Addition(A=grass_ratio_2, B=0)
list_length = ListLength(List=jitter.Values)
division = Division(A=list_length, B=100)
multiplication = Multiplication(A=division, B=addition_3)
multiplication_2 = Multiplication(A=division, B=addition_2)
multiplication_3 = Multiplication(A=division, B=addition)
repeat_data = RepeatData(Data=generic_species.ShrubS, Length=multiplication_2)
repeat_data_2 = RepeatData(Data=generic_species.GrassS, Length=multiplication)
repeat_data_3 = RepeatData(Data=generic_species.TreeS, Length=multiplication_3)
jitter_2 = Jitter(List=[repeat_data, repeat_data_2, repeat_data_3], Jitter=1, Seed=2)  # -> Values, Indices
prune_tree = PruneTree(Tree=jitter_2.Values, Minimum=1, Maximum=0)
list_length_2 = ListLength(List=prune_tree)
split_list = SplitList(List=prune_tree, Index=list_length_2)  # -> ListA, ListB
split_list_2 = SplitList(List=jitter.Values, Index=list_length_2)  # -> ListA, ListB
species_per_plant = Data(split_list.ListA)
locations_per_plant = Point(split_list_2.ListA)
species_per_plant_2 = ClusterOutput(species_per_plant)
locations_per_plant_2 = ClusterOutput(locations_per_plant)

# ==== cluster Cluster
brep = ClusterInput()
deconstruct_brep = DeconstructBrep(Brep=brep)  # -> Faces, Edges, Vertices
join_curves = JoinCurves(Curves=deconstruct_brep.Edges, Preserve=False)
project = Project(Geometry=join_curves, Plane=PlaneXY(0, 0, 0))  # -> Geometry, Transform
offset_curve = OffsetCurve(Curve=project.Geometry, Distance=Slider(670, range=0..1000), Plane=PlaneXY(0, 0, 0), Corners=1)
curve_a = ClusterInput()
list = ClusterInput()
curve_curve = CurveCurve(CurveA=curve_a, CurveB=offset_curve)  # -> Points, ParamsA, ParamsB
curve_curve_2 = CurveCurve(CurveA=list, CurveB=offset_curve)  # -> Points, ParamsA, ParamsB
list_length = ListLength(List=curve_curve.Points)  # -> flatten(Length)
list_length_2 = ListLength(List=curve_curve_2.Points)  # -> flatten(Length)
larger_than = LargerThan(FirstNumber=list_length, SecondNumber=0)  # -> LargerThan, OrEqualTo
larger_than_2 = LargerThan(FirstNumber=list_length_2, SecondNumber=0)  # -> LargerThan, OrEqualTo
cull_pattern = CullPattern(List=curve_a, CullPattern=invert(larger_than.LargerThan))
cull_pattern_2 = CullPattern(List=list, CullPattern=invert(larger_than_2.LargerThan))
list_2 = ClusterOutput(cull_pattern)
list_3 = ClusterOutput(cull_pattern_2)
