# Grasshopper definition Groundhog - South Park.ghx (Grasshopper 0.9.76)

# ---- group: The circles that push and pull the main path into a curved shape
pull_force_of_c_attractors = Slider(-679, range=-20000..20000)
geometry_pipeline = GeometryPipeline(
    GroupByLayer=False,
    GroupByType=False,
    IncludeHidden=True,
    IncludeLocked=True,
    LayerFilter="Attractors C",
    NameFilter="*",
    TypeFilter=1)
pull_force_of_b_attractors = Slider(620, range=-20000..20000)
geometry_pipeline_2 = GeometryPipeline(
    GroupByLayer=False,
    GroupByType=False,
    IncludeHidden=True,
    IncludeLocked=True,
    LayerFilter="Attractors B",
    NameFilter="*",
    TypeFilter=1)
pull_force_of_a_attractors = Slider(9042, range=-20000..20000)
# Groundhog Project File
# This Grasshopper definition and its corresponding Rhinoceros model were developed by Albert Rex and Philip Belesky as part of the Groundhog project.
# 
# The definition and model are provided as speculative reverse-engineerings of how this landscape project could have been (partly) designed using computational methods. More information available at https://www.groundhog.la/projects/south-park/
# 
# This definition depends on components from version v0.9.1b of the Groundhog plugin. It is available for download at http://groundhog.la/plugin/
# 
# This definition is licensed under the terms of the GPL v3 https://opensource.org/licenses/GPL-3.0
geometry_pipeline_3 = GeometryPipeline(
    GroupByLayer=False,
    GroupByType=False,
    IncludeHidden=True,
    IncludeLocked=True,
    LayerFilter="Attractors A",
    NameFilter="*",
    TypeFilter=1)
attractors_a = Geometry(geometry_pipeline_3)
attractors_b = Geometry(geometry_pipeline_2)
attractors_c = Geometry(geometry_pipeline)
pull_for_a = Number(pull_force_of_a_attractors)
pull_for_b = Number(pull_force_of_b_attractors)
pull_for_c = Number(pull_force_of_c_attractors)

# ----
path_points_count = Slider(150, range=0..1000)
path_central_axis = Curve(<curve referenced from the Rhino model>)
path_divisions = Integer(path_points_count)

# ---- group: The dimensions of the tiles
paver_fillet = Slider(0.5, range=-0.5..0.5)
paver_width = Slider(900, range=500..2500)
paver_max_height = Slider(15000, range=1000..20000)

# ----
garden_pull_points = Slider(14, range=0..20)
garden_bed_size = Slider(6626, range=0..100000)
site_boundary = Curve(<curve referenced from the Rhino model>)
planter_edges = Curve([<curve referenced from the Rhino model> x2])

# ---- group: Divide the central path line into points and then pull those points towards the type A attractor circles
path_central_axis_2 = Curve(path_central_axis)
attractors_a_2 = Geometry(attractors_a)
path_divisions_2 = Integer(path_divisions)
pull_for_a_2 = Number(pull_for_a)
divide_curve = DivideCurve(Curve=path_central_axis_2, Count=path_divisions_2, Kinks=False)  # -> Points, Tangents, Parameters
closest_point = ClosestPoint(Point=divide_curve.Points, Cloud=attractors_a_2)  # -> ClosestPoint, CPIndex, Distance
vector_2pt = Vector2Pt(PointA=divide_curve.Points, PointB=closest_point.ClosestPoint, Unitize=False)  # -> Vector, Length
amplitude = Amplitude(Vector=vector_2pt.Vector, Amplitude=pull_for_a_2)  # -> graft(Vector)
move = Move(Geometry=graft(divide_curve.Points), Motion=amplitude)  # -> Geometry, Transform
interpolate = Interpolate(Vertices=flatten(move.Geometry), Degree=3, Periodic=False, KnotStyle=1)  # -> Curve, Length, Domain
line = Line(StartPoint=graft(closest_point.ClosestPoint), EndPoint=move.Geometry)

# ----
fillet = Number(paver_fillet)
paver_width_2 = Number(paver_width)

# ---- group: Make and pull points from planter edges
planter_edges_2 = Curve(planter_edges)
attractors_a_3 = Geometry(attractors_a)
divide_curve_2 = DivideCurve(Curve=planter_edges_2, Count=garden_pull_points, Kinks=False)  # -> graft(Points), Tangents, Parameters
closest_point_2 = ClosestPoint(Point=divide_curve_2.Points, Cloud=attractors_a_3)  # -> ClosestPoint, CPIndex, Distance
vector_2pt_2 = Vector2Pt(PointA=divide_curve_2.Points, PointB=closest_point_2.ClosestPoint, Unitize=True)  # -> Vector, Length
amplitude_2 = Amplitude(Vector=vector_2pt_2.Vector, Amplitude=garden_bed_size)
negative = Negative(Value=amplitude_2)
move_2 = Move(Geometry=divide_curve_2.Points, Motion=negative)  # -> Geometry, Transform

# ----
circle_cnr = CircleCNR(Center=attractors_a_2, Normal=Vector(0, 0, 1), Radius=pull_for_a_2)
custom_preview = CustomPreview(Geometry=[circle_cnr, interpolate.Curve], Shader=ColourSwatch(SwatchColor=RGB(255, 0, 224)))
custom_preview_2 = CustomPreview(Geometry=line, Shader=ColourSwatch(SwatchColor=RGB(125, 81, 125)))

# ---- group: Create a generic offset
number_slider = Slider(2274, range=0..5000)
path_center = Curve(interpolate.Curve)
multiplication = Multiplication(A=number_slider, B=-1)
offset = Offset(Curve=path_center, Distance=number_slider, Plane=PlaneXY(0, 0, 0), Corners=1)
offset_2 = Offset(Curve=path_center, Distance=multiplication, Plane=PlaneXY(0, 0, 0), Corners=1)
path_edges = Curve([offset, offset_2])

# ---- group: Make boundaries from pulled points and intersect with the site boundary to form the planted area
trim_tree = TrimTree(Tree=move_2.Geometry, Depth=1)
site_boundary_2 = Curve(site_boundary)
interpolate_2 = Interpolate(Vertices=trim_tree, Degree=5, Periodic=False, KnotStyle=1)  # -> Curve, Length, Domain
trim_with_region = TrimWithRegion(Curve=interpolate_2.Curve, Region=site_boundary_2)  # -> Inside, Outside
curve_curve = CurveCurve(CurveA=site_boundary_2, CurveB=trim_with_region.Inside)  # -> Points, ParamsA, ParamsB
shatter = Shatter(Curve=site_boundary_2, Parameters=curve_curve.ParamsA)
length = Length(Curve=shatter)
sort_list = SortList(Keys=length, ValuesA=shatter)  # -> Keys, ValuesA
list_item = ListItem(List=sort_list.ValuesA, Index=0, Wrap=True)
join_curves = JoinCurves(Curves=flatten([trim_with_region.Inside, list_item]), Preserve=False)
planter_outlines = Curve(join_curves)

# ----
boundary_surfaces = BoundarySurfaces(Edges=planter_outlines)
path_outline = CustomPreview(Geometry=boundary_surfaces, Material=ColourSwatch(SwatchColor=RGB(0, 255, 72)))

# ---- group: Make tile outlines by dividing the main axis into points then offsetting those at tangents
path_central_axis_3 = Curve(path_central_axis)
paver_width_3 = Number(paver_width)
paver_height = Number(paver_max_height)
unit_z = UnitZ(Factor=1)
divide_distance = DivideDistance(Curve=path_central_axis_3, Distance=paver_width_3)  # -> graft(Points), graft(Tangents), Parameters
cross_product = CrossProduct(VectorA=divide_distance.Tangents, VectorB=unit_z, Unitize=False)  # -> Vector, Length
multiplication_2 = Multiplication(A=cross_product.Vector, B=paver_height)
negative_2 = Negative(Value=multiplication_2)
move_3 = Move(Geometry=divide_distance.Points, Motion=negative_2)  # -> Geometry, Transform
move_4 = Move(Geometry=divide_distance.Points, Motion=multiplication_2)  # -> Geometry, Transform
line_2 = Line(StartPoint=move_4.Geometry, EndPoint=move_3.Geometry)  # -> flatten(Line)
paver_outlines = Line(line_2)

# ----
unit_z_2 = UnitZ(Factor=1)

# ---- group: Repeat the same division and pull process with the second set of attractor points
path_divisions_3 = Integer(path_divisions)
attractors_b_2 = Geometry(attractors_b)
pull_for_b_2 = Number(pull_for_b)
path_edges_2 = Curve(path_edges)
divide_curve_3 = DivideCurve(Curve=path_edges_2, Count=path_divisions_3, Kinks=False)  # -> Points, Tangents, Parameters
closest_point_3 = ClosestPoint(Point=divide_curve_3.Points, Cloud=attractors_b_2)  # -> ClosestPoint, CPIndex, Distance
vector_2pt_3 = Vector2Pt(PointA=divide_curve_3.Points, PointB=closest_point_3.ClosestPoint, Unitize=False)  # -> Vector, Length
amplitude_3 = Amplitude(Vector=vector_2pt_3.Vector, Amplitude=pull_for_b_2)  # -> graft(Vector)
move_5 = Move(Geometry=graft(divide_curve_3.Points), Motion=amplitude_3)  # -> Geometry, Transform
line_3 = Line(StartPoint=graft(closest_point_3.ClosestPoint), EndPoint=move_5.Geometry)

# ----
trim_tree_2 = TrimTree(Tree=move_5.Geometry, Depth=1)

# ---- group: Repeat the same division and pull process with the second set of attractor points (continued)
interpolate_3 = Interpolate(Vertices=trim_tree_2, Degree=3, Periodic=False, KnotStyle=1)  # -> Curve, Length, Domain

# ----
circle_cnr_2 = CircleCNR(Center=attractors_b_2, Normal=Vector(0, 0, 1), Radius=pull_for_b_2)
custom_preview_3 = CustomPreview(Geometry=line_3, Shader=ColourSwatch(SwatchColor=RGB(111, 140, 140)))
custom_preview_4 = CustomPreview(Geometry=[circle_cnr_2, interpolate_3.Curve], Shader=ColourSwatch(SwatchColor=RGB(0, 255, 224)))

# ---- group: Repeat the same division and pull process with the second set of attractor points
path_edges_3 = Curve(interpolate_3.Curve)
path_divisions_4 = Integer(path_divisions)
attractors_b_3 = Geometry(attractors_c)
pull_for_b_3 = Number(pull_for_c)
divide_curve_4 = DivideCurve(Curve=path_edges_3, Count=path_divisions_4, Kinks=False)  # -> Points, Tangents, Parameters
closest_point_4 = ClosestPoint(Point=divide_curve_4.Points, Cloud=attractors_b_3)  # -> ClosestPoint, CPIndex, Distance
vector_2pt_4 = Vector2Pt(PointA=divide_curve_4.Points, PointB=closest_point_4.ClosestPoint, Unitize=False)  # -> Vector, Length
amplitude_4 = Amplitude(Vector=vector_2pt_4.Vector, Amplitude=pull_for_b_3)  # -> graft(Vector)
move_6 = Move(Geometry=graft(divide_curve_4.Points), Motion=amplitude_4)  # -> Geometry, Transform
trim_tree_3 = TrimTree(Tree=move_6.Geometry, Depth=1)
line_4 = Line(StartPoint=graft(closest_point_4.ClosestPoint), EndPoint=move_6.Geometry)
interpolate_4 = Interpolate(Vertices=trim_tree_3, Degree=3, Periodic=False, KnotStyle=1)  # -> Curve, Length, Domain

# ----
circle_cnr_3 = CircleCNR(Center=attractors_b_3, Normal=Vector(0, 0, 1), Radius=pull_for_b_3)
custom_preview_5 = CustomPreview(Geometry=[circle_cnr_3, interpolate_4.Curve], Shader=ColourSwatch(SwatchColor=RGB(255, 255, 224)))
custom_preview_6 = CustomPreview(Geometry=line_4, Shader=ColourSwatch(SwatchColor=RGB(184, 184, 184)))

# ---- group: Join the path together
end = EndPoints(Curve=interpolate_4.Curve)  # -> Start, End
dispatch = Dispatch(List=flatten(end.End), DispatchPattern=[True, False])  # -> ListA, ListB
dispatch_2 = Dispatch(List=flatten(end.Start), DispatchPattern=[True, False])  # -> ListA, ListB
ln = Line(StartPoint=dispatch_2.ListA, EndPoint=dispatch_2.ListB)
ln_2 = Line(StartPoint=dispatch.ListA, EndPoint=dispatch.ListB)
join_curves_2 = JoinCurves(Curves=flatten([ln, ln_2, interpolate_4.Curve]), Preserve=False)
path_outline_2 = Curve(join_curves_2)

# ---- group: Trim Path to Site Boundary
site_boundary_3 = Curve(site_boundary)
path_outline_3 = Curve(path_outline_2)
trim_with_region_2 = TrimWithRegion(Curve=site_boundary_3, Region=path_outline_3)  # -> Inside, Outside
trim_with_region_3 = TrimWithRegion(Curve=path_outline_3, Region=site_boundary_3)  # -> Inside, Outside
join_curves_3 = JoinCurves(Curves=flatten([trim_with_region_3.Inside, trim_with_region_2.Inside]), Preserve=False)
trimmed_path_outline = Curve(join_curves_3)

# ---- group: Combine path and boundary of the tiles (this sets up a clean trim)
paver_outlines_2 = Line(paver_outlines)
path_outline_4 = Curve(trimmed_path_outline)
bounding_box = BoundingBox(Content=paver_outlines_2, Plane=PlaneXY(0, 0, 0), UnionBox=True)  # -> Box, Box_2
deconstruct_brep = DeconstructBrep(Brep=bounding_box.Box)  # -> Faces, Edges, Vertices
trim_with_region_4 = TrimWithRegion(Curve=deconstruct_brep.Faces, Region=path_outline_4)  # -> Inside, Outside
trim_with_region_5 = TrimWithRegion(Curve=path_outline_4, Region=deconstruct_brep.Faces)  # -> Inside, Outside
join_curves_4 = JoinCurves(Curves=flatten([trim_with_region_4.Inside, trim_with_region_5.Inside]), Preserve=False)

# ---- group: Trim the tiles down to the boundary
curve_line = CurveLine(Curve=graft(join_curves_4), Line=line_2)  # -> Points, Params, Count
prune_tree = PruneTree(Tree=curve_line.Points, Minimum=Slider(2, range=0..10), Maximum=0)
interpolate_5 = Interpolate(Vertices=prune_tree, Degree=3, Periodic=False, KnotStyle=1)  # -> Curve, Length, Domain
trimmed_path_outlines = Curve(interpolate_5.Curve)

# ---- group: Make tile edges including fillet
trimmed_path_outlines_2 = Curve(trimmed_path_outlines)
fillet_2 = Number(fillet)
paver_width_4 = Number(paver_width_2)
multiplication_3 = Multiplication(A=paver_width_4, B=fillet_2)
end_points = EndPoints(Curve=simplify(trimmed_path_outlines_2))  # -> Start, End

# ----
list_item_2 = ListItem(List=flatten(trimmed_path_outlines_2), Index=0, Wrap=True)
evaluate_curve = EvaluateCurve(Curve=list_item_2, Parameter=0)  # -> Point, Tangent, Angle
cross_product_2 = CrossProduct(VectorA=evaluate_curve.Tangent, VectorB=unit_z_2, Unitize=False)  # -> Vector, Length
multiplication_4 = Multiplication(A=paver_width_4, B=cross_product_2.Vector)

# ---- group: Make tile edges including fillet (continued)
move_7 = Move(Geometry=trimmed_path_outlines_2, Motion=multiplication_4)  # -> Geometry, Transform
end_points_2 = EndPoints(Curve=simplify(move_7.Geometry))  # -> Start, End
interpolate_6 = Interpolate(Vertices=[end_points.Start, end_points_2.Start, end_points_2.End, end_points.End], Degree=1, Periodic=True, KnotStyle=1)  # -> Curve, Length, Domain
fillet_3 = Fillet(Curve=interpolate_6.Curve, Radius=multiplication_3)

# ---- group: Make surfaces for each tile
# We could replace this block with just a Boundary Surface component; however that becomes slow when dealing with a large number of tiles. Instead we identify the curves of the filleted arc-ends (by removing the two longest segments) and then loft those.
explode = Explode(Curve=fillet_3, Recursive=True)  # -> Segments, Vertices
length_2 = Length(Curve=explode.Segments)
list_length = ListLength(List=explode.Segments)
sort_list_2 = SortList(Keys=length_2, ValuesA=explode.Segments)  # -> Keys, ValuesA
subtraction = Subtraction(A=list_length, B=3)
sub_list = SubList(List=sort_list_2.ValuesA, Domain=subtraction, Wrap=False)  # -> List, Index
join_curves_5 = JoinCurves(Curves=sub_list.List, Preserve=False)
dispatch_3 = Dispatch(List=join_curves_5, DispatchPattern=[True, False])  # -> ListA, ListB
flip_curve = FlipCurve(Curve=dispatch_3.ListB)  # -> Curve, Flag
loft = Loft(
    Curves=[dispatch_3.ListA, flip_curve.Curve],
    Options={Adjust=False, Closed=False, LoftEnds=0, LoftSimp=0, LoftType=0, Rebuild=10, Refit=0.01})

# ----
custom_preview_7 = CustomPreview(Geometry=loft, Shader=ColourSwatch(SwatchColor=RGB(43, 43, 43)))
